# Grasshopper definition 001_Getting_Started.gh (Grasshopper 1.0.7)
# plug-ins: RhinoCodePluginGH

# ----
# #The Numpy Array:
# A Multidimensional Array Object
# test_random
number_slider = Slider(4, range=0..4)
numpy = Script(rows=number_slider, columns=Slider(11, range=0..20))  # -> out, a, arr0_OUT, arr1_OUT, arr2_OUT, arr3_OUT; inputs rows: Int32, columns: Int32
# ---------- numpy: Python ----------
"""Grasshopper Script"""
#! python 3
a = "Welcome to Wickerson Studios!"
print(a)

# r: numpy

import numpy

arr = numpy.random.rand(rows, columns)

print(arr)
print(type(arr))
arr = arr.tolist()
print(arr)

arr_OUT = [arr[i] if i < rows else False for i in range(4)]
arr0_OUT, arr1_OUT, arr2_OUT, arr3_OUT = arr_OUT
# ---------- end numpy ----------
panel = Panel(numpy.a)
number = Number(numpy.arr3_OUT)
number_2 = Number(numpy.arr0_OUT)
# 001 Learning Python
# Introduction: Getting Started
# gpt-4 Text Prompt
panel_2 = Panel(number_2)
number_3 = Number(numpy.arr1_OUT)
panel_3 = Panel(number_3)
number_4 = Number(numpy.arr2_OUT)
panel_4 = Panel(number_4)
number_slider_2 = Slider(10, range=0..100)
panel_5 = Panel(number)
multiplication = Multiplication(A=number_2, B=number_slider_2)
multiplication_2 = Multiplication(A=number_3, B=number_slider_2)
construct_point = ConstructPoint(XCoordinate=multiplication, YCoordinate=graft(multiplication), ZCoordinate=0)
construct_point_2 = ConstructPoint(XCoordinate=multiplication, YCoordinate=graft(multiplication), ZCoordinate=multiplication_2)
unit_x = UnitX(Factor=number_4)
line = Line(StartPoint=construct_point, EndPoint=construct_point_2)
move = Move(Geometry=line, Motion=unit_x)  # -> Geometry, Transform
list_item = ListItem(List=graft(line), Index=0, Wrap=True)
list_item_2 = ListItem(List=graft(move.Geometry), Index=0, Wrap=True)
unit_y = UnitY(Factor=number)
loft = Loft(
    Curves=[list_item, list_item_2],
    Options={Adjust=False, Closed=False, LoftEnds=0, LoftSimp=0, LoftType=0, Rebuild=10, Refit=0.01})
extrude = Extrude(Base=loft, Direction=graft(unit_y))

linearregression = Script()  # -> out, a
# ---------- linearregression: Python ----------
# r: numpy

import numpy as np

class SimpleNN:
    def __init__(self, input_size, hidden_size, output_size):
        # weights
        self.W1 = np.random.randn(input_size, hidden_size)
        self.W2 = np.random.randn(hidden_size, output_size)
        # biases
        self.b1 = np.zeros((1, hidden_size))
        self.b2 = np.zeros((1, output_size))

    def sigmoid(self, z):
        return 1 / (1 + np.exp(-z))

    def sigmoid_derivative(self, z):
        return z * (1 - z)

    def forward(self, X):
        self.z1 = np.dot(X, self.W1) + self.b1
        self.a1 = self.sigmoid(self.z1)
        self.z2 = np.dot(self.a1, self.W2) + self.b2
        output = self.sigmoid(self.z2)
        return output

    def backward(self, X, y, output, learning_rate):
        self.output_error = y - output
        self.output_delta = self.output_error * self.sigmoid_derivative(output)

        self.z1_error = self.output_delta.dot(self.W2.T)
        self.z1_delta = self.z1_error * self.sigmoid_derivative(self.a1)

        self.W1 += X.T.dot(self.z1_delta) * learning_rate
        self.W2 += self.a1.T.dot(self.output_delta) * learning_rate
        self.b1 += np.sum(self.z1_delta, axis=0, keepdims=True) * learning_rate
        self.b2 += np.sum(self.output_delta, axis=0, keepdims=True) * learning_rate

    def train(self, X, y, learning_rate=0.01, epochs=1000):
        for _ in range(epochs):
            output = self.forward(X)
            self.backward(X, y, output, learning_rate)

import rhinoscriptsyntax as rs
import numpy as np

# Assume some training data (you can replace this with your data)
X_train = np.array([[0, 0], [0, 1], [1, 0], [1, 1]])
y_train = np.array([[0], [1], [1], [0]])

# Create a neural network instance
nn = SimpleNN(input_size=2, hidden_size=3, output_size=1)

# Train the neural network
nn.train(X_train, y_train, learning_rate=0.01, epochs=10000)

# Test the neural network (using training data for simplicity)
output = nn.forward(X_train)

# Assign the results to Grasshopper outputs
a = output
b = nn.W1
c = nn.W2
d = nn.b1
e = nn.b2
# ---------- end linearregression ----------
# Create a supervised Learning algorithm with NUMPY
# for  a python 3 script for the python 3 script
# node in grasshopper for Rhino8WIP using the
# Rhino Common API and NUMPY if necessary.
# Output the parts in different variable outputs in
# the python 3 node in grasshopper.
# gpt-4 Initial Response
# Certainly! Below, I will provide a simple supervised
# learning algorithm  implemented using Numpy for a Python 3
# script that can be used in a Grasshopper
# node for Rhino 8 WIP. The neural network will
# perform simple regression tasks.
linearregression_2 = Script()  # -> out, a
# ---------- linearregression_2: Python ----------
# r: numpy

import numpy as np

class SimpleNN:
    def __init__(self, input_size, hidden_size, output_size):
        # weights
        self.W1 = np.random.randn(input_size, hidden_size)
        self.W2 = np.random.randn(hidden_size, output_size)
        # biases
        self.b1 = np.zeros((1, hidden_size))
        self.b2 = np.zeros((1, output_size))

    def sigmoid(self, z):
        return 1 / (1 + np.exp(-z))

    def sigmoid_derivative(self, z):
        return z * (1 - z)

    def forward(self, X):
        self.z1 = np.dot(X, self.W1) + self.b1
        self.a1 = self.sigmoid(self.z1)
        self.z2 = np.dot(self.a1, self.W2) + self.b2
        output = self.sigmoid(self.z2)
        return output

    def backward(self, X, y, output, learning_rate):
        self.output_error = y - output
        self.output_delta = self.output_error * self.sigmoid_derivative(output)

        self.z1_error = self.output_delta.dot(self.W2.T)
        self.z1_delta = self.z1_error * self.sigmoid_derivative(self.a1)

        self.W1 += X.T.dot(self.z1_delta) * learning_rate
        self.W2 += self.a1.T.dot(self.output_delta) * learning_rate
        self.b1 += np.sum(self.z1_delta, axis=0, keepdims=True) * learning_rate
        self.b2 += np.sum(self.output_delta, axis=0, keepdims=True) * learning_rate

    def train(self, X, y, learning_rate=0.01, epochs=1000):
        for _ in range(epochs):
            output = self.forward(X)
            self.backward(X, y, output, learning_rate)
# ---------- end linearregression_2 ----------
panel_6 = Panel(linearregression.out)
panel_7 = Panel(linearregression.a)
panel_8 = Panel(linearregression_2.out)
