# Grasshopper definition 002_Arithmetic_Operations.gh (Grasshopper 1.0.7)
# plug-ins: RhinoCodePluginGH

x_x_factor = Slider(-10, range=-10..10)
y_x_factor = Slider(-10, range=-10..10)

# ----
# Oscillation Algorithm
# The oscillation algorithm can be use to animate
# any geometry that is driven by a number sliders.
# Simply swap out the number sliders at the
# multiplication node in the oscillation script.
panel = Panel("1")
trigger = Trigger(Interval=20, TimerInterval=20, Target=data_recorder)
data_recorder = DataRecorder(panel, DataLimit=-10, RecordData=False)
list_length = ListLength(List=data_recorder)
division = Division(A=list_length, B=Slider(31, range=0..1000))
cosine = Cosine(Value=division)
sine = Sine(Value=division)
panel_2 = Panel([sine, cosine])
multiplication = Multiplication(A=cosine, B=y_x_factor)
multiplication_2 = Multiplication(A=sine, B=x_x_factor)

# ----
# 2nd gpt-4 Text Prompt
# Great, now create a much more complex model
# with complex trigonometric polynomials and the
# NUMPY python library.
adjustment = Slider(1.374, range=-3..3)
# gpt-4 2nd Response
# Alright, let's craft a more intricate model using
# trigonometric functions and numpy. We'll
# generate a mesh-like structure based on a
# sine-cosine function. The height (Z-axis) of the
# mesh will be dictated by this trigonometric
# function.
x_x_factor_2 = Slider(-10, range=-10..10)  # disabled
x_y_factor = Slider(10, range=-10..10)  # disabled
z_factor = Slider(50, range=0..50)  # disabled
# 3rd gpt-4 Text Prompt
# Can you create a nurbs surface instead of a mesh?
# gpt-4 3rd Response
y_y_factor = Slider(10, range=-10..10)  # disabled
y_x_factor_2 = Slider(-10, range=-10..10)  # disabled

# ----
# #The Numpy Array:
# A Multidimensional Array Object
# test_random
number_slider = Slider(4, range=0..4)  # disabled
number_slider_2 = Slider(11, range=0..20)  # disabled
numpy = Script(rows=number_slider, columns=number_slider_2)  # -> out, a, arr0_OUT, arr1_OUT, arr2_OUT, arr3_OUT; inputs rows: Int32, columns: Int32; disabled
# ---------- numpy: Python ----------
"""Grasshopper Script"""
#! python 3
a = "Welcome to Wickerson Studios!"
print(a)

# r: numpy

import numpy

arr = numpy.random.rand(rows, columns)

print(arr)
print(type(arr))
arr = arr.tolist()
print(arr)

arr_OUT = [arr[i] if i < rows else False for i in range(4)]
arr0_OUT, arr1_OUT, arr2_OUT, arr3_OUT = arr_OUT
# ---------- end numpy ----------
panel_3 = Panel(numpy.a)  # disabled
number = Number(numpy.arr0_OUT)  # disabled
# 002 Python Refresher
# Basic Data Structures
# Numerical Data Types and Structures
# gpt-4 Text Prompt
# Create a geometric 3D model with
# 
# Numerical Data Types and Structures
# and
# Arithmetic Operations
# 
# for  a python 3 script for the python 3 script
# node in grasshopper for Rhino8WIP using the
# 
# Rhino Common API.
# 
# Output the parts of the model in different
# variable outputs in the python 3 node in
# grasshopper.
panel_4 = Panel(number)  # disabled
number_2 = Number(numpy.arr1_OUT)  # disabled
panel_5 = Panel(number_2)  # disabled
number_3 = Number(numpy.arr2_OUT)  # disabled
panel_6 = Panel(number_3)  # disabled
number_4 = Number(numpy.arr3_OUT)  # disabled
number_slider_3 = Slider(10, range=0..100)  # disabled
panel_7 = Panel(number_4)  # disabled
multiplication_3 = Multiplication(A=number, B=number_slider_3)  # disabled
multiplication_4 = Multiplication(A=number_2, B=number_slider_3)  # disabled
construct_point = ConstructPoint(XCoordinate=multiplication_3, YCoordinate=graft(multiplication_3), ZCoordinate=0)  # disabled
construct_point_2 = ConstructPoint(XCoordinate=multiplication_3, YCoordinate=graft(multiplication_3), ZCoordinate=multiplication_4)  # disabled
unit_x = UnitX(Factor=number_3)  # disabled
line = Line(StartPoint=construct_point, EndPoint=construct_point_2)  # disabled
move = Move(Geometry=line, Motion=unit_x)  # -> Geometry, Transform; disabled
list_item = ListItem(List=graft(line), Index=0, Wrap=True)  # disabled
list_item_2 = ListItem(List=graft(move.Geometry), Index=0, Wrap=True)  # disabled
unit_y = UnitY(Factor=number_4)  # disabled
loft = Loft(
    Curves=[list_item, list_item_2],
    Options={Adjust=False, Closed=False, LoftEnds=0, LoftSimp=0, LoftType=0, Rebuild=10, Refit=0.01})  # disabled
extrude = Extrude(Base=loft, Direction=graft(unit_y))  # disabled

# ----
# Certainly! Creating a NURBS surface requires a
# different approach than a mesh. Instead of
# creating a grid of vertices, we'll generate a grid
# of control points and then create a NURBS
# surface from those points.
x_y_factor_2 = Slider(10, range=-10..10)
z_factor_2 = Slider(10, range=1..10)
y_y_factor_2 = Slider(10, range=-10..10)
depth = Slider(6.29, range=0..10)  # disabled
height = Slider(4.89, range=0..10)  # disabled
# gpt-4 Initial Response
# Certainly, I can guide you through a simple 3D
# geometric model. We'll be using numerical data
# types and arithmetic operations to define our
# geometric object and then use the
# RhinoCommon API to create it in Rhino.
width = Slider(7.35, range=0..10)  # disabled
artihmetic_operations = Script(x=width, y=depth, z=height, addition=adjustment, multiplication=adjustment, division=adjustment)  # -> out, output_box, output_width, output_depth, output_height; inputs x: Double, y: Double, z: Double, addition: Double, multiplication: Double, division: Double; disabled
# ---------- artihmetic_operations: Python ----------
import Rhino.Geometry as rg

# Numerical Data Types and Structures:
# Let's define three numbers. 
"""
x = 5.0  # This could be the width of our box.
y = 3.0  # This could be the depth of our box.
z = 7.0  # This could be the height of our box.
"""

# Arithmetic Operations:
# Add some operations to change the dimensions.
new_width = x + addition
new_depth = y * multiplication
new_height = z / division

# Using RhinoCommon API to create a box.
base_point = rg.Point3d(0, 0, 0)  # The base point from where our box will start.
plane = rg.Plane(base_point, rg.Vector3d.ZAxis)
corner_point = rg.Point3d(new_width, new_depth, new_height)
bounding_box = rg.BoundingBox(base_point, corner_point)
box = rg.Box(bounding_box)

# Output the parts of the model in different variable outputs.
output_box = box
output_width = new_width
output_depth = new_depth
output_height = new_height
# ---------- end artihmetic_operations ----------
artihmetic_operations_2 = Script(xx=multiplication_2, xy=x_y_factor_2, xz=z_factor_2, yx=multiplication, yy=y_y_factor_2, yz=z_factor_2)  # -> reverse(out), output_surface; inputs xx: Double, xy: Double, xz: Int32, yx: Double, yy: Double, yz: Int32
# ---------- artihmetic_operations_2: Python ----------
# r: numpy

import Rhino.Geometry as rg
import numpy as np

# Define a grid of x and y values
x = np.linspace(xx, xy, xz)
y = np.linspace(yx, yy, yz)
X, Y = np.meshgrid(x, y)

# Define a complex trigonometric polynomial function
Z = np.sin(X) * np.cos(Y) + np.sin(2*X) * np.cos(2*Y)

# Convert the numpy arrays to lists so they can be iterated over
X = X.tolist()
Y = Y.tolist()
Z = Z.tolist()

# Create a list to store our control points
control_points = []

# Populate our control points list
for i in range(len(X)):
    for j in range(len(Y)):
        pt = rg.Point3d(X[i][j], Y[i][j], Z[i][j])
        control_points.append(pt)

# Create a NURBS surface from our control points
degree_u = 3
degree_v = 3
u_count = len(X)
v_count = len(Y)

surface = rg.NurbsSurface.CreateThroughPoints(control_points, u_count, v_count, degree_u, degree_v, False, False)

# Output the surface
output_surface = surface
# ---------- end artihmetic_operations_2 ----------
artihmetic_operations_3 = Script(xx=x_x_factor_2, xy=x_y_factor, xz=z_factor, yx=y_x_factor_2, yy=y_y_factor, yz=z_factor)  # -> reverse(out), output_mesh; inputs xx: Double, xy: Double, xz: Int32, yx: Double, yy: Double, yz: Int32; disabled
# ---------- artihmetic_operations_3: Python ----------
# r: numpy

import Rhino.Geometry as rg
import numpy as np

# Define a grid of x and y values
x = np.linspace(xx, xy, xz)
y = np.linspace(yx, yy, yz)
X, Y = np.meshgrid(x, y)

# Define a complex trigonometric polynomial function
Z = np.sin(X) * np.cos(Y) + np.sin(2*X) * np.cos(2*Y)

# Convert the numpy arrays to lists so they can be iterated over
X = X.tolist()
Y = Y.tolist()
Z = Z.tolist()

# Create a list to store our vertices
vertices = []

# Populate our vertices list
for i in range(len(X)):
    for j in range(len(Y)):
        pt = rg.Point3d(X[i][j], Y[i][j], Z[i][j])
        vertices.append(pt)

# Create a mesh based on our vertices
mesh = rg.Mesh()

for i in range(len(X) - 1):
    for j in range(len(Y) - 1):
        mesh.Vertices.Add(vertices[i * len(Y) + j])
        mesh.Vertices.Add(vertices[i * len(Y) + j + 1])
        mesh.Vertices.Add(vertices[(i + 1) * len(Y) + j + 1])
        mesh.Vertices.Add(vertices[(i + 1) * len(Y) + j])
        
        mesh.Faces.AddFace(i * len(Y) + j, i * len(Y) + j + 1, (i + 1) * len(Y) + j + 1, (i + 1) * len(Y) + j)

# Output the mesh
output_mesh = mesh
# ---------- end artihmetic_operations_3 ----------
mesh = Mesh(artihmetic_operations_3.output_mesh)  # disabled
panel_8 = Panel(artihmetic_operations_3.out)  # disabled
panel_9 = Panel(artihmetic_operations.out)  # disabled
surface = Surface(artihmetic_operations_2.output_surface)
box = Box(artihmetic_operations.output_box)  # disabled
panel_10 = Panel(artihmetic_operations_2.out)
panel_11 = Panel(mesh)  # disabled
panel_12 = Panel(surface)
entwine = Entwine(
    Branch00=box,
    Branch01=artihmetic_operations.output_width,
    Branch02=artihmetic_operations.output_depth,
    Branch03=artihmetic_operations.output_height,
    FlattenInputs=True)  # disabled
panel_13 = Panel(entwine)  # disabled
