# Grasshopper definition 003_Booleans.gh (Grasshopper 1.0.7)
# plug-ins: RhinoCodePluginGH, Kangaroo2 Components

# ----
# Oscillation Algorithm
# The oscillation algorithm can be use to animate
# any geometry that is driven by a number sliders.
# Simply swap out the number sliders at the
# multiplication node in the oscillation script.
panel = Panel("1")
trigger = Trigger(Interval=20, TimerInterval=20, Target=data_recorder)
data_recorder = DataRecorder(panel, DataLimit=-10, RecordData=False)
list_length = ListLength(List=data_recorder)
division = Division(A=list_length, B=Slider(31, range=0..1000))
cosine = Cosine(Value=division)
sine = Sine(Value=division)
panel_2 = Panel([sine, cosine])
multiplication = Multiplication(A=cosine)
multiplication_2 = Multiplication(A=sine)

# ----
# #The Numpy Array:
# A Multidimensional Array Object
# test_random
number_slider = Slider(4, range=0..4)  # disabled
number_slider_2 = Slider(11, range=0..20)  # disabled
numpy = Script(rows=number_slider, columns=number_slider_2)  # -> out, a, arr0_OUT, arr1_OUT, arr2_OUT, arr3_OUT; inputs rows: Int32, columns: Int32; disabled
# ---------- numpy: Python ----------
"""Grasshopper Script"""
#! python 3
a = "Welcome to Wickerson Studios!"
print(a)

# r: numpy

import numpy

arr = numpy.random.rand(rows, columns)

print(arr)
print(type(arr))
arr = arr.tolist()
print(arr)

arr_OUT = [arr[i] if i < rows else False for i in range(4)]
arr0_OUT, arr1_OUT, arr2_OUT, arr3_OUT = arr_OUT
# ---------- end numpy ----------
panel_3 = Panel(numpy.a)  # disabled
number = Number(numpy.arr0_OUT)  # disabled
# 002 Python Refresher
# Basic Data Structures
# Booleans
# gpt-4 Text Prompt
# Create a geometric 3D model with
# 
# Numerical Data Types and Structures
# and
# Booleans
# 
# for  a python 3 script for the python 3 script
# node in grasshopper for Rhino8WIP using the
# 
# Rhino Common API.
# 
# Output the parts of the model in different
# variable outputs in the python 3 node in
# grasshopper.
panel_4 = Panel(number)  # disabled
number_2 = Number(numpy.arr1_OUT)  # disabled
panel_5 = Panel(number_2)  # disabled
number_3 = Number(numpy.arr2_OUT)  # disabled
panel_6 = Panel(number_3)  # disabled
number_4 = Number(numpy.arr3_OUT)  # disabled
number_slider_3 = Slider(10, range=0..100)  # disabled
panel_7 = Panel(number_4)  # disabled
multiplication_3 = Multiplication(A=number, B=number_slider_3)  # disabled
multiplication_4 = Multiplication(A=number_2, B=number_slider_3)  # disabled
construct_point = ConstructPoint(XCoordinate=multiplication_3, YCoordinate=graft(multiplication_3), ZCoordinate=0)  # disabled
construct_point_2 = ConstructPoint(XCoordinate=multiplication_3, YCoordinate=graft(multiplication_3), ZCoordinate=multiplication_4)  # disabled
unit_x = UnitX(Factor=number_3)  # disabled
line = Line(StartPoint=construct_point, EndPoint=construct_point_2)  # disabled
move = Move(Geometry=line, Motion=unit_x)  # -> Geometry, Transform; disabled
list_item = ListItem(List=graft(line), Index=0, Wrap=True)  # disabled
list_item_2 = ListItem(List=graft(move.Geometry), Index=0, Wrap=True)  # disabled
unit_y = UnitY(Factor=number_4)  # disabled
loft = Loft(
    Curves=[list_item, list_item_2],
    Options={Adjust=False, Closed=False, LoftEnds=0, LoftSimp=0, LoftType=0, Rebuild=10, Refit=0.01})  # disabled
extrude = Extrude(Base=loft, Direction=graft(unit_y))  # disabled

# ----
# gpt-4 2nd Response
# Alright! Let's modify the above script to include
# several Boolean operations that will:
# 
# Toggle the creation of the surface.
# Choose between two different trigonometric
# Invert the Z-values of the surface (make hills into valleys and vice versa).
x_x_factor = Slider(-3, range=-3..3)
x_x_factor_2 = Slider(3, range=-3..3)
x_x_factor_3 = Slider(-3, range=-3..3)
x_x_factor_4 = Slider(3, range=-3..3)
depth = Slider(6.7, range=0..10)  # disabled
height = Slider(4.96, range=0..10)  # disabled
# gpt-4 Initial Response
# Certainly! Let's create a simple 3D model of a
# cube whose dimensions (length, width, height)
# are defined using numerical data types. We'll
# also use a boolean to decide if the cube should
# be displayed or not.
width = Slider(7.35, range=0..10)  # disabled
# 2nd gpt-4 Text Prompt
# Great, now create a much more complex model
# with complex trigonometric polynomials and the
# NUMPY python library.
boolean_toggle = BooleanToggle(True)  # disabled
booleans = Script(
    x_range_min=x_x_factor,
    x_range_max=x_x_factor_2,
    y_range_min=x_x_factor_3,
    y_range_max=x_x_factor_4,
    res=Slider(100, range=0..100),
    use_alternate_eq=Toggle(True),
    invert_surface=Toggle(False),
    create=Toggle(True))  # -> reverse(out), surface; inputs x_range_min: Double, x_range_max: Double, y_range_min: Double, y_range_max: Double, res: Int32, use_alternate_eq: Boolean, invert_surface: Boolean, create: Boolean
# ---------- booleans: Python ----------
# r: numpy

import Rhino.Geometry as rg
import numpy as np

def create_trig_surface(x_range, y_range, res, use_alternate_eq, invert_surface):
    """
    Create a surface based on trigonometric polynomials.
    :param x_range: tuple of (x_range_min, x_range_max) values for x.
    :param y_range: tuple of (y_range_min, y_range_max) values for y.
    :param res: resolution or number of points in both x and y directions.
    :param use_alternate_eq: Boolean to switch to an alternate equation.
    :param invert_surface: Boolean to invert the surface.
    :return: Rhino surface.
    """
    
    # Create a grid of x, y points
    x = np.linspace(x_range[0], x_range[1], res)
    y = np.linspace(y_range[0], y_range[1], res)
    
    X, Y = np.meshgrid(x, y)
    
    # Choose the equation based on the Boolean value
    if use_alternate_eq:
        Z = np.sin(X) * np.sin(Y)
    else:
        Z = np.sin(X) * np.cos(Y) + np.sin(Y) * np.cos(X)
    
    # Invert the surface if required
    if invert_surface:
        Z = -Z
    
    # Convert numpy arrays to a list of points
    points = [rg.Point3d(X[i,j], Y[i,j], Z[i,j]) for i in range(res) for j in range(res)]
    
    # Create a Rhino surface from the grid of points
    surface = rg.NurbsSurface.CreateFromPoints(points, res, res, 3, 3)
    
    return surface

# Parameters
x_range = (x_range_min, x_range_max * np.pi)
y_range = (y_range_min, y_range_max * np.pi)
res = res  # resolution; increase for more detailed surface

# Boolean Operations
create_surface = create  # Toggle creation of the surface
use_alternate_eq = use_alternate_eq  # Choose between two equations
invert_surface = invert_surface  # Invert the Z-values

if create_surface:
    surface = create_trig_surface(x_range, y_range, res, use_alternate_eq, invert_surface)
else:
    surface = None

# Output
# surface: Trigonometric surface based on the polynomial
# ---------- end booleans ----------
booleans_2 = Script(l=width, w=depth, h=height, show_cube=boolean_toggle)  # -> out, bottom, top, side1, side2, side3, side4; inputs l: Double, w: Double, h: Double, show_cube: Boolean; disabled
# ---------- booleans_2: Python ----------
import Rhino.Geometry as rg

# Inputs:
# l = length of the cube
# w = width of the cube
# h = height of the cube
# showCube = show_cube

def main(l, w, h, showCube):
    if not showCube:
        return None, None, None, None

    # Bottom rectangle
    pt1 = rg.Point3d(0, 0, 0)
    pt2 = rg.Point3d(l, 0, 0)
    pt3 = rg.Point3d(l, w, 0)
    pt4 = rg.Point3d(0, w, 0)
    bottom_rect = rg.Polyline([pt1, pt2, pt3, pt4, pt1]).ToNurbsCurve()

    # Top rectangle
    pt5 = rg.Point3d(0, 0, h)
    pt6 = rg.Point3d(l, 0, h)
    pt7 = rg.Point3d(l, w, h)
    pt8 = rg.Point3d(0, w, h)
    top_rect = rg.Polyline([pt5, pt6, pt7, pt8, pt5]).ToNurbsCurve()

    # Side edges
    line1 = rg.Line(pt1, pt5).ToNurbsCurve()
    line2 = rg.Line(pt2, pt6).ToNurbsCurve()
    line3 = rg.Line(pt3, pt7).ToNurbsCurve()
    line4 = rg.Line(pt4, pt8).ToNurbsCurve()

    return bottom_rect, top_rect, line1, line2, line3, line4

# Define your input values
#l, w, h = 10.0, 5.0, 7.0  # Example values for length, width, height
showCube = show_cube  # Example boolean value

bottom, top, side1, side2, side3, side4 = main(l, w, h, showCube)

# Outputs
# bottom: Bottom face of the cube
# top: Top face of the cube
# side1, side2, side3, side4: The four vertical edges of the cube
# ---------- end booleans_2 ----------
surface = Surface(booleans.surface)
panel_8 = Panel(booleans.out)
panel_9 = Panel(booleans_2.out)  # disabled
entwine = Entwine(
    Branch00=booleans_2.bottom,
    Branch01=booleans_2.top,
    Branch02=booleans_2.side1,
    Branch03=booleans_2.side2,
    Branch04=booleans_2.side3,
    Branch05=booleans_2.side4,
    FlattenInputs=True)  # disabled
panel_10 = Panel(surface)
panel_11 = Panel(entwine)  # disabled
multipipe = MultiPipe(Curves=flatten(entwine), NodeSize=0.5, EndOffset=1, StrutSize=1, Segment=0, KinkAngle=0.6, CubeFit=0, Caps=0)  # disabled
