# Grasshopper definition 004_Keyworks_and_or_not.gh (Grasshopper 1.0.7)
# plug-ins: RhinoCodePluginGH

# ----
# Oscillation Algorithm
# The oscillation algorithm can be use to animate
# any geometry that is driven by a number sliders.
# Simply swap out the number sliders at the
# multiplication node in the oscillation script.
panel = Panel("1")
trigger = Trigger(Interval=20, TimerInterval=20, Target=data_recorder)
data_recorder = DataRecorder(panel, DataLimit=-10, RecordData=False)
list_length = ListLength(List=data_recorder)
division = Division(A=list_length, B=Slider(31, range=0..1000))
cosine = Cosine(Value=division)
sine = Sine(Value=division)
panel_2 = Panel([sine, cosine])
multiplication = Multiplication(A=cosine)
multiplication_2 = Multiplication(A=sine)

# ----
# 3rd gpt-4 Text Prompt
# Use this same logic to produce a NURBS
# surface instead of a MESH surface.
# gpt-4 3rd Response
# Creating a NURBS surface based on the same
# logic requires a different approach than the
# mesh. We'll be creating a set of control points
# based on our trigonometric polynomial, then use
# those control points to define a NURBS
# surface.
# 
# Here's how to produce a NURBS surface in
# RhinoCommon using the provided logic:
freq = Slider(5.67, range=0..10)  # disabled
amp = Slider(0.43, range=0..10)  # disabled
x_range_min = Slider(-3, range=-3..3)  # disabled
x_range_max = Slider(3, range=-3..3)  # disabled
y_range_min = Slider(-3, range=-3..3)  # disabled
y_range_max = Slider(3, range=-3..3)  # disabled
x_y__samples = Slider(33, range=0..100)  # disabled
# 2nd gpt-4 Text Prompt
# Great, now create a much more complex model
# with complex trigonometric polynomials and the
# NUMPY python library.
# gpt-4 2nd Response
# Alright! Let's modify the above script to include
# several Boolean operations that will:
# 
# Toggle the creation of the surface.
# Choose between two different trigonometric
# Invert the Z-values of the surface (make hills
# into valleys and vice vAlright, let's create a more
# intricate model using trigonometric functions
# and the numpy library.
# 
# In this example, we'll design a 3D sinusoidal
# wave surface defined by a complex
# trigonometric polynomial. To visualize it
# effectively in Grasshopper, we'll produce a mesh
#  based on the polynomial. This mesh can then
# be directly visualized in Rhino
number_slider = Slider(3, range=0..10)  # disabled
# gpt-4 Initial Response
# To generate a geometric 3D model using
# Python for Grasshopper in Rhino 8 WIP and
# integrate the Rhino Common API, we can
# create a simple script that leverages some basic
# Rhino geometry, like points, lines, and surfaces,
# and interacts with them using numerical data
# types and structures, and the keywords "and,"
# "or," and "not."
length = Slider(2.88, range=0..10)  # disabled
width = Slider(1.66, range=0..10)  # disabled
height = Slider(10, range=0.01..10)  # disabled
number_slider_2 = Slider(6, range=0..10)  # disabled
amp_2 = Slider(0.32, range=0..10)
y_range_max_2 = Slider(3, range=-3..3)
x_y__samples_2 = Slider(16, range=0..100)
x_range_min_2 = Slider(-3, range=-3..3)
x_range_max_2 = Slider(3, range=-3..3)
y_range_min_2 = Slider(-3, range=-3..3)

# ----
# #The Numpy Array:
# A Multidimensional Array Object
# test_random
number_slider_3 = Slider(4, range=0..4)  # disabled
number_slider_4 = Slider(11, range=0..20)  # disabled
numpy = Script(rows=number_slider_3, columns=number_slider_4)  # -> out, a, arr0_OUT, arr1_OUT, arr2_OUT, arr3_OUT; inputs rows: Int32, columns: Int32; disabled
# ---------- numpy: Python ----------
"""Grasshopper Script"""
#! python 3
a = "Welcome to Wickerson Studios!"
print(a)

# r: numpy

import numpy

arr = numpy.random.rand(rows, columns)

print(arr)
print(type(arr))
arr = arr.tolist()
print(arr)

arr_OUT = [arr[i] if i < rows else False for i in range(4)]
arr0_OUT, arr1_OUT, arr2_OUT, arr3_OUT = arr_OUT
# ---------- end numpy ----------
panel_3 = Panel(numpy.a)  # disabled
number = Number(numpy.arr0_OUT)  # disabled
# 002 Python Refresher
# Basic Data Structures
# Keywords: and, or, not
# gpt-4 Text Prompt
# Create a geometric 3D model with
# 
# Numerical Data Types and Structures
# and with
# Keywords: and, or, not
# 
# for  a python 3 script for the python 3 script
# node in grasshopper for Rhino8WIP using the
# 
# Rhino Common API.
# 
# Output the parts of the model in different
# variable outputs in the python 3 node in
# grasshopper.
panel_4 = Panel(number)  # disabled
number_2 = Number(numpy.arr1_OUT)  # disabled
panel_5 = Panel(number_2)  # disabled
number_3 = Number(numpy.arr2_OUT)  # disabled
panel_6 = Panel(number_3)  # disabled
number_4 = Number(numpy.arr3_OUT)  # disabled
number_slider_5 = Slider(10, range=0..100)  # disabled
panel_7 = Panel(number_4)  # disabled
multiplication_3 = Multiplication(A=number, B=number_slider_5)  # disabled
multiplication_4 = Multiplication(A=number_2, B=number_slider_5)  # disabled
construct_point = ConstructPoint(XCoordinate=multiplication_3, YCoordinate=graft(multiplication_3), ZCoordinate=0)  # disabled
construct_point_2 = ConstructPoint(XCoordinate=multiplication_3, YCoordinate=graft(multiplication_3), ZCoordinate=multiplication_4)  # disabled
unit_x = UnitX(Factor=number_3)  # disabled
line = Line(StartPoint=construct_point, EndPoint=construct_point_2)  # disabled
move = Move(Geometry=line, Motion=unit_x)  # -> Geometry, Transform; disabled
list_item = ListItem(List=graft(line), Index=0, Wrap=True)  # disabled
list_item_2 = ListItem(List=graft(move.Geometry), Index=0, Wrap=True)  # disabled
unit_y = UnitY(Factor=number_4)  # disabled
loft = Loft(
    Curves=[list_item, list_item_2],
    Options={Adjust=False, Closed=False, LoftEnds=0, LoftSimp=0, LoftType=0, Rebuild=10, Refit=0.01})  # disabled
extrude = Extrude(Base=loft, Direction=graft(unit_y))  # disabled

keywords_and_or_not = Script(
    x_range_min=x_range_min_2,
    x_range_max=x_range_max_2,
    y_range_min=y_range_min_2,
    y_range_max=y_range_max_2,
    x_samples=x_y__samples_2,
    y_samples=x_y__samples_2,
    amp=amp_2,
    freq=Slider(3.96, range=0..10))  # -> reverse(out), a; inputs x_range_min: Double, x_range_max: Double, y_range_min: Double, y_range_max: Double, x_samples: Int32, y_samples: Int32, use_alternate_eq: Boolean, amp: Double, freq: Double
# ---------- keywords_and_or_not: Python ----------
# r: numpy

import Rhino.Geometry as rg
import numpy as np

def create_sinusoidal_nurbs(domain_x, domain_y, samples_x, samples_y, amplitude, frequency):
    # Create arrays of u and v parameters
    u = np.linspace(domain_x[0], domain_x[1], samples_x)
    v = np.linspace(domain_y[0], domain_y[1], samples_y)
    
    U, V = np.meshgrid(u, v)
    
    # Evaluate the complex trigonometric polynomial function with conditions
    Z = np.zeros_like(U)
    
    for i in range(samples_x):
        for j in range(samples_y):
            if (U[i,j] > 2 and U[i,j] < 8) or (V[i,j] > 3 and V[i,j] < 7):
                Z[i, j] = amplitude * np.sin(frequency * U[i, j]) * np.cos(frequency * V[i, j])
            elif U[i,j] <= 2 or U[i,j] >= 8 and V[i,j] <= 3 or V[i,j] >= 7:
                Z[i, j] = amplitude * np.sin(frequency * V[i, j]) * np.cos(frequency * U[i, j])
            else:
                Z[i, j] = amplitude * np.sin(frequency * U[i, j])

    # Convert the nested list of control points into a single list
    control_points = [rg.Point3d(U[i, j], V[i, j], Z[i, j]) for i in range(samples_x) for j in range(samples_y)]

    # Create the NURBS surface
    degree_u = 3 if samples_x > 3 else samples_x - 1
    degree_v = 3 if samples_y > 3 else samples_y - 1
    nurbs_surface = rg.NurbsSurface.CreateThroughPoints(control_points, samples_x, samples_y, degree_u, degree_v, False, False)

    return nurbs_surface

# Parameters
domain_x = (x_range_min, x_range_max)
domain_y = (y_range_min, y_range_max)
samples_x = x_samples
samples_y = y_samples
amplitude = amp
frequency = freq

# Create the sinusoidal NURBS surface
sinusoidal_nurbs = create_sinusoidal_nurbs(domain_x, domain_y, samples_x, samples_y, amplitude, frequency)

# Outputs
a = sinusoidal_nurbs
# ---------- end keywords_and_or_not ----------
keywords_and_or_not_2 = Script(
    x_range_min=x_range_min,
    x_range_max=x_range_max,
    y_range_min=y_range_min,
    y_range_max=y_range_max,
    x_samples=x_y__samples,
    y_samples=x_y__samples,
    amp=amp,
    freq=freq)  # -> reverse(out), a; inputs x_range_min: Double, x_range_max: Double, y_range_min: Double, y_range_max: Double, x_samples: Int32, y_samples: Int32, use_alternate_eq: Boolean, amp: Double, freq: Double; disabled
# ---------- keywords_and_or_not_2: Python ----------
# r: numpy

import Rhino.Geometry as rg
import numpy as np

def create_sinusoidal_mesh(domain_x, domain_y, samples_x, samples_y, amplitude, frequency):
    # Create arrays of u and v parameters
    u = np.linspace(domain_x[0], domain_x[1], samples_x)
    v = np.linspace(domain_y[0], domain_y[1], samples_y)
    
    U, V = np.meshgrid(u, v)
    
    # Evaluate the complex trigonometric polynomial function with conditions
    Z = np.zeros_like(U)
    
    for i in range(samples_x):
        for j in range(samples_y):
            if (U[i,j] > 2 and U[i,j] < 8) or (V[i,j] > 3 and V[i,j] < 7):
                Z[i, j] = amplitude * np.sin(frequency * U[i, j]) * np.cos(frequency * V[i, j])
            elif U[i,j] <= 2 or U[i,j] >= 8 and V[i,j] <= 3 or V[i,j] >= 7:
                Z[i, j] = amplitude * np.sin(frequency * V[i, j]) * np.cos(frequency * U[i, j])
            else:
                Z[i, j] = amplitude * np.sin(frequency * U[i, j])
    
    # Create vertices for the mesh
    vertices = [rg.Point3d(U[i, j], V[i, j], Z[i, j]) for i in range(samples_x) for j in range(samples_y)]
    
    # Generate the mesh faces
    mesh = rg.Mesh()
    for i in range(samples_x - 1):
        for j in range(samples_y - 1):
            pt1_index = i * samples_y + j
            pt2_index = (i + 1) * samples_y + j
            pt3_index = (i + 1) * samples_y + j + 1
            pt4_index = i * samples_y + j + 1
            
            # Only add faces if the height difference isn't too great (just an example condition)
            if abs(Z[i,j] - Z[i+1,j]) < amplitude / 2 and abs(Z[i,j+1] - Z[i+1,j+1]) < amplitude / 2:
                mesh.Faces.AddFace(pt1_index, pt2_index, pt3_index, pt4_index)
            else:
                # Possible spot for the 'but' keyword, but in Python, 'else' serves a similar purpose.
                pass
    
    mesh.Vertices.AddVertices(vertices)
    
    return mesh

# Parameters
domain_x = (x_range_min, x_range_max)
domain_y = (y_range_min, y_range_max)
samples_x = x_samples
samples_y = y_samples
amplitude = amp
frequency = freq

# Create the sinusoidal mesh
sinusoidal_mesh = create_sinusoidal_mesh(domain_x, domain_y, samples_x, samples_y, amplitude, frequency)

# Outputs
a = sinusoidal_mesh
# ---------- end keywords_and_or_not_2 ----------
keywords_and_or_not_3 = Script(l=length, w=width, h=height, z_min=number_slider_2, z_max=number_slider)  # -> out, a, b, c; inputs l: Double, w: Double, h: Double, z_min: Int32, z_max: Int32; disabled
# ---------- keywords_and_or_not_3: Python ----------
import Rhino.Geometry as rg

# Create a base point
base_point = rg.Point3d(0, 0, 0)

# Define parameters for the box
length = l
width = w
height = h

# Define the corner points of the box
pt1 = base_point
pt2 = rg.Point3d(base_point.X + length, base_point.Y, base_point.Z)
pt3 = rg.Point3d(base_point.X + length, base_point.Y + width, base_point.Z)
pt4 = rg.Point3d(base_point.X, base_point.Y + width, base_point.Z)
pt5 = rg.Point3d(base_point.X, base_point.Y, base_point.Z + height)
pt6 = rg.Point3d(base_point.X + length, base_point.Y, base_point.Z + height)
pt7 = rg.Point3d(base_point.X + length, base_point.Y + width, base_point.Z + height)
pt8 = rg.Point3d(base_point.X, base_point.Y + width, base_point.Z + height)

# Create a box using the eight corner points
box_corners = [pt1, pt2, pt3, pt4, pt5, pt6, pt7, pt8]
box = rg.Brep.CreateFromBox(box_corners)

# Output the parts of the box based on certain conditions
bottom_face = None
top_face = None
side_faces = []

for i in range(6):
    face = box.Faces[i]
    center = face.GetBoundingBox(False).Center
    z_value = center.Z

    if z_value < z_max and not(z_value > z_min):
        bottom_face = face
    elif z_value > height - z_max or z_value == height:
        top_face = face
    else:
        side_faces.append(face)

# Outputs
a = bottom_face
b = top_face
c = side_faces
# ---------- end keywords_and_or_not_3 ----------
panel_8 = Panel(keywords_and_or_not_3.out)  # disabled
surface = Surface(keywords_and_or_not.a)
panel_9 = Panel(keywords_and_or_not.out)
mesh = Mesh(keywords_and_or_not_2.a)  # disabled
panel_10 = Panel(surface)
entwine = Entwine(Branch00=keywords_and_or_not_3.a, Branch01=keywords_and_or_not_3.b, Branch02=keywords_and_or_not_3.c, FlattenInputs=True)  # disabled
panel_11 = Panel(keywords_and_or_not_2.out)  # disabled
panel_12 = Panel(mesh)  # disabled
panel_13 = Panel(entwine)  # disabled
