# Grasshopper definition 005_Operator_Precedence.gh (Grasshopper 1.0.7)
# plug-ins: RhinoCodePluginGH

# ----
# Oscillation Algorithm
# The oscillation algorithm can be use to animate
# any geometry that is driven by a number sliders.
# Simply swap out the number sliders at the
# multiplication node in the oscillation script.
panel = Panel("1")
trigger = Trigger(Interval=20, TimerInterval=20, Target=data_recorder)
data_recorder = DataRecorder(panel, DataLimit=-10, RecordData=False)
list_length = ListLength(List=data_recorder)
division = Division(A=list_length, B=Slider(31, range=0..1000))
cosine = Cosine(Value=division)
sine = Sine(Value=division)
panel_2 = Panel([sine, cosine])
multiplication = Multiplication(A=cosine)
multiplication_2 = Multiplication(A=sine)

freq = Slider(5.67, range=0..10)
width = Slider(4.65, range=0..10)  # disabled
height = Slider(8.28, range=0.01..10)  # disabled
number_slider = Slider(7.63, range=0..10)  # disabled
# gpt-4 Initial Response
# Certainly! Here's a simple Python 3 script for a
# Grasshopper node in Rhino8WIP using the
# Rhino Common API.
# 
# This script will:
# 
# Create a 3D geometric model comprising a
# sphere and a box.
# Use numerical data types and structures to
# manipulate these objects.
# Use boolean operator precedence to decide
# which object to output.
radius = Slider(11.36, range=0..20)  # disabled
amp = Slider(0.43, range=0..10)
y_range_max = Slider(3, range=-3..3)
x_y__samples = Slider(33, range=0..100)
x_range_min = Slider(-3, range=-3..3)
x_range_max = Slider(3, range=-3..3)
y_range_min = Slider(-3, range=-3..3)

# ----
# #The Numpy Array:
# A Multidimensional Array Object
# test_random
number_slider_2 = Slider(4, range=0..4)  # disabled
number_slider_3 = Slider(11, range=0..20)  # disabled
numpy = Script(rows=number_slider_2, columns=number_slider_3)  # -> out, a, arr0_OUT, arr1_OUT, arr2_OUT, arr3_OUT; inputs rows: Int32, columns: Int32; disabled
# ---------- numpy: Python ----------
"""Grasshopper Script"""
#! python 3
a = "Welcome to Wickerson Studios!"
print(a)

# r: numpy

import numpy

arr = numpy.random.rand(rows, columns)

print(arr)
print(type(arr))
arr = arr.tolist()
print(arr)

arr_OUT = [arr[i] if i < rows else False for i in range(4)]
arr0_OUT, arr1_OUT, arr2_OUT, arr3_OUT = arr_OUT
# ---------- end numpy ----------
panel_3 = Panel(numpy.a)  # disabled
number = Number(numpy.arr0_OUT)  # disabled
# 002 Python Refresher
# Basic Data Structures
# Boolean: Operator Precedence
# gpt-4 Text Prompt
# Create a geometric 3D model with
# 
# Numerical Data Types and Structures
# and with
# Boolean Operator Precedence
# 
# for  a python 3 script for the python 3 script
# node in grasshopper for Rhino8WIP using the
# 
# Rhino Common API.
# 
# Output the parts of the model in different
# variable outputs in the python 3 node in
# grasshopper.
panel_4 = Panel(number)  # disabled
number_2 = Number(numpy.arr1_OUT)  # disabled
panel_5 = Panel(number_2)  # disabled
number_3 = Number(numpy.arr2_OUT)  # disabled
panel_6 = Panel(number_3)  # disabled
number_4 = Number(numpy.arr3_OUT)  # disabled
number_slider_4 = Slider(10, range=0..100)  # disabled
panel_7 = Panel(number_4)  # disabled
multiplication_3 = Multiplication(A=number, B=number_slider_4)  # disabled
multiplication_4 = Multiplication(A=number_2, B=number_slider_4)  # disabled
construct_point = ConstructPoint(XCoordinate=multiplication_3, YCoordinate=graft(multiplication_3), ZCoordinate=0)  # disabled
construct_point_2 = ConstructPoint(XCoordinate=multiplication_3, YCoordinate=graft(multiplication_3), ZCoordinate=multiplication_4)  # disabled
unit_x = UnitX(Factor=number_3)  # disabled
line = Line(StartPoint=construct_point, EndPoint=construct_point_2)  # disabled
move = Move(Geometry=line, Motion=unit_x)  # -> Geometry, Transform; disabled
list_item = ListItem(List=graft(line), Index=0, Wrap=True)  # disabled
list_item_2 = ListItem(List=graft(move.Geometry), Index=0, Wrap=True)  # disabled
unit_y = UnitY(Factor=number_4)  # disabled
loft = Loft(
    Curves=[list_item, list_item_2],
    Options={Adjust=False, Closed=False, LoftEnds=0, LoftSimp=0, LoftType=0, Rebuild=10, Refit=0.01})  # disabled
extrude = Extrude(Base=loft, Direction=graft(unit_y))  # disabled

number_slider_5 = Slider(3.96, range=0..10)  # disabled
amp_2 = Slider(0.32, range=0..10)  # disabled
y_range_max_2 = Slider(3, range=-3..3)  # disabled
x_y__samples_2 = Slider(16, range=0..100)  # disabled
# 3rd gpt-4 Text Prompt
# Use this same logic to produce a NURBS
# surface instead of a MESH surface.
# gpt-4 3rd Response
# Creating a NURBS surface based on the same
# logic requires a different approach than the
# mesh. We'll be creating a set of control points
# based on our trigonometric polynomial, then use
# those control points to define a NURBS
# surface.
# 
# Here's how to produce a NURBS surface in
# RhinoCommon using the provided logic:
x_range_min_2 = Slider(-3, range=-3..3)  # disabled
x_range_max_2 = Slider(3, range=-3..3)  # disabled
y_range_min_2 = Slider(-3, range=-3..3)  # disabled
# 2nd gpt-4 Text Prompt
# Great, now create a much more complex model
# with complex trigonometric polynomials and the
# NUMPY python library.
# gpt-4 2nd Response
# Certainly! Let's modify the previous example to
# integrate multiple boolean operations and
# decisions in the creation of our geometry.
# 
# We'll:
# 
# Decide the type of mesh based on multiple
# conditions.
# Modify our trigonometric polynomial's shape
# using boolean operations.
# Make some visual modifications to the mesh
# based on boolean conditions.
boolean_toggle = BooleanToggle(False)  # disabled
keywords_and_or_not = Script(
    x_range_min=x_range_min_2,
    x_range_max=x_range_max_2,
    y_range_min=y_range_min_2,
    y_range_max=y_range_max_2,
    x_samples=x_y__samples_2,
    y_samples=x_y__samples_2,
    amp=amp_2,
    freq=number_slider_5)  # -> reverse(out), a; inputs x_range_min: Double, x_range_max: Double, y_range_min: Double, y_range_max: Double, x_samples: Int32, y_samples: Int32, use_alternate_eq: Boolean, amp: Double, freq: Double; disabled
# ---------- keywords_and_or_not: Python ----------
# r: numpy

import Rhino.Geometry as rg
import numpy as np

def create_sinusoidal_nurbs(domain_x, domain_y, samples_x, samples_y, amplitude, frequency):
    # Create arrays of u and v parameters
    u = np.linspace(domain_x[0], domain_x[1], samples_x)
    v = np.linspace(domain_y[0], domain_y[1], samples_y)
    
    U, V = np.meshgrid(u, v)
    
    # Evaluate the complex trigonometric polynomial function with conditions
    Z = np.zeros_like(U)
    
    for i in range(samples_x):
        for j in range(samples_y):
            if (U[i,j] > 2 and U[i,j] < 8) or (V[i,j] > 3 and V[i,j] < 7):
                Z[i, j] = amplitude * np.sin(frequency * U[i, j]) * np.cos(frequency * V[i, j])
            elif U[i,j] <= 2 or U[i,j] >= 8 and V[i,j] <= 3 or V[i,j] >= 7:
                Z[i, j] = amplitude * np.sin(frequency * V[i, j]) * np.cos(frequency * U[i, j])
            else:
                Z[i, j] = amplitude * np.sin(frequency * U[i, j])

    # Convert the nested list of control points into a single list
    control_points = [rg.Point3d(U[i, j], V[i, j], Z[i, j]) for i in range(samples_x) for j in range(samples_y)]

    # Create the NURBS surface
    degree_u = 3 if samples_x > 3 else samples_x - 1
    degree_v = 3 if samples_y > 3 else samples_y - 1
    nurbs_surface = rg.NurbsSurface.CreateThroughPoints(control_points, samples_x, samples_y, degree_u, degree_v, False, False)

    return nurbs_surface

# Parameters
domain_x = (x_range_min, x_range_max)
domain_y = (y_range_min, y_range_max)
samples_x = x_samples
samples_y = y_samples
amplitude = amp
frequency = freq

# Create the sinusoidal NURBS surface
sinusoidal_nurbs = create_sinusoidal_nurbs(domain_x, domain_y, samples_x, samples_y, amplitude, frequency)

# Outputs
a = sinusoidal_nurbs
# ---------- end keywords_and_or_not ----------
operator_precedence = Script(radius=radius, length=width, width=height, height=number_slider, condition=boolean_toggle)  # -> out, geometry; inputs radius: Double, length: Double, width: Double, height: Int32, condition: Boolean; disabled
# ---------- operator_precedence: Python ----------
import Rhino.Geometry as rg

def main(radius, length, width, height, condition):
    """
    Parameters:
    radius : float
        Radius of the sphere
    length : float
        Length of the box
    width : float
        Width of the box
    height : float
        Height of the box
    condition : bool
        Condition to decide which geometry to output
    
    Returns:
    Sphere or Box geometry based on the condition
    """

    # Create a sphere centered at (0,0,0)
    sphere_center = rg.Point3d(0,0,0)
    sphere_structure = rg.Sphere(sphere_center, radius)
    sphere_brep = rg.Brep.CreateFromSphere(sphere_structure)  # Convert to Brep geometry
    
    # Create a box 
    box_base = rg.Plane.WorldXY
    box_interval = rg.Interval(-length/2, length/2), rg.Interval(-width/2, width/2), rg.Interval(0, height)
    box = rg.Box(box_base, box_interval[0], box_interval[1], box_interval[2]).ToBrep()  # Convert to Brep geometry
    
    # Boolean operator precedence
    if condition or (radius > 10 and width > 5):
        return sphere_brep
    else:
        return box

# Example use
geometry = main(radius, length, width, height, condition)
# ---------- end operator_precedence ----------
operation_precedence = Script(
    x_range_min=x_range_min,
    x_range_max=x_range_max,
    y_range_min=y_range_min,
    y_range_max=y_range_max,
    x_samples=x_y__samples,
    y_samples=x_y__samples,
    amp=amp,
    freq=freq)  # -> reverse(out), a; inputs x_range_min: Double, x_range_max: Double, y_range_min: Double, y_range_max: Double, x_samples: Int32, y_samples: Int32, use_alternate_eq: Boolean, amp: Double, freq: Double; unedited script template
entwine = Entwine(Branch00=operator_precedence.geometry, FlattenInputs=True)  # disabled
surface = Surface(keywords_and_or_not.a)  # disabled
panel_8 = Panel(operator_precedence.out)  # disabled
panel_9 = Panel(operation_precedence.out)
mesh = Mesh(operation_precedence.a)
panel_10 = Panel(keywords_and_or_not.out)  # disabled
panel_11 = Panel(surface)  # disabled
panel_12 = Panel(mesh)
panel_13 = Panel(operator_precedence.geometry)  # disabled
