# Grasshopper definition 006_Strings_None.gh (Grasshopper 1.0.7)
# plug-ins: RhinoCodePluginGH

amp = Slider(10, range=0..10)

# ----
# Oscillation Algorithm
# The oscillation algorithm can be use to animate
# any geometry that is driven by a number sliders.
# Simply swap out the number sliders at the
# multiplication node in the oscillation script.
panel = Panel("1")
trigger = Trigger(Interval=20, TimerInterval=20, Target=data_recorder)
data_recorder = DataRecorder(panel, DataLimit=-10, RecordData=False)
list_length = ListLength(List=data_recorder)
division = Division(A=list_length, B=Slider(125, range=0..1000))
cosine = Cosine(Value=division)
sine = Sine(Value=division)
panel_2 = Panel([sine, cosine])
multiplication = Multiplication(A=cosine, B=amp)
multiplication_2 = Multiplication(A=sine)

# ----
# Certainly! Let's add a condition to label our
# surface based on its complexity using the None
# keyword and other string manipulations.
# 
# For simplicity, let's use the maximum height (z-
# value) of the surface points as a measure of
# complexity. If the height exceeds a certain
# threshold (for instance, 5 units, as we did
# previously), we'll label it "Complex Surface".
# Otherwise, the label will remain as None.
x_range_min = Slider(-3, range=-3..3)
x_range_max = Slider(3, range=-3..3)
y_range_min = Slider(-3, range=-3..3)
y_range_max = Slider(3, range=-3..3)
x_y__samples = Slider(6, range=0..20)
x_y__samples_2 = Slider(11, range=0..20)

# ----
# #The Numpy Array:
# A Multidimensional Array Object
# test_random
number_slider = Slider(4, range=0..4)  # disabled
number_slider_2 = Slider(11, range=0..20)  # disabled
numpy = Script(rows=number_slider, columns=number_slider_2)  # -> out, a, arr0_OUT, arr1_OUT, arr2_OUT, arr3_OUT; inputs rows: Int32, columns: Int32; disabled
# ---------- numpy: Python ----------
"""Grasshopper Script"""
#! python 3
a = "Welcome to Wickerson Studios!"
print(a)

# r: numpy

import numpy

arr = numpy.random.rand(rows, columns)

print(arr)
print(type(arr))
arr = arr.tolist()
print(arr)

arr_OUT = [arr[i] if i < rows else False for i in range(4)]
arr0_OUT, arr1_OUT, arr2_OUT, arr3_OUT = arr_OUT
# ---------- end numpy ----------
panel_3 = Panel(numpy.a)  # disabled
number = Number(numpy.arr0_OUT)  # disabled
# 002 Python Refresher
# Basic Data Structures
# Keywords: and, or, not
# gpt-4 Text Prompt
# Create a geometric 3D model with
# 
# Numerical Data Types and Structures
# and with
# Strings and the Keyword: None
# 
# for  a python 3 script for the python 3 script
# node in grasshopper for Rhino8WIP using the
# 
# Rhino Common API.
# 
# Output the parts of the model in different
# variable outputs in the python 3 node in
# grasshopper.
panel_4 = Panel(number)  # disabled
number_2 = Number(numpy.arr1_OUT)  # disabled
panel_5 = Panel(number_2)  # disabled
number_3 = Number(numpy.arr2_OUT)  # disabled
panel_6 = Panel(number_3)  # disabled
number_4 = Number(numpy.arr3_OUT)  # disabled
number_slider_3 = Slider(10, range=0..100)  # disabled
panel_7 = Panel(number_4)  # disabled
multiplication_3 = Multiplication(A=number, B=number_slider_3)  # disabled
multiplication_4 = Multiplication(A=number_2, B=number_slider_3)  # disabled
construct_point = ConstructPoint(XCoordinate=multiplication_3, YCoordinate=graft(multiplication_3), ZCoordinate=0)  # disabled
construct_point_2 = ConstructPoint(XCoordinate=multiplication_3, YCoordinate=graft(multiplication_3), ZCoordinate=multiplication_4)  # disabled
unit_x = UnitX(Factor=number_3)  # disabled
line = Line(StartPoint=construct_point, EndPoint=construct_point_2)  # disabled
move = Move(Geometry=line, Motion=unit_x)  # -> Geometry, Transform; disabled
list_item = ListItem(List=graft(line), Index=0, Wrap=True)  # disabled
list_item_2 = ListItem(List=graft(move.Geometry), Index=0, Wrap=True)  # disabled
unit_y = UnitY(Factor=number_4)  # disabled
loft = Loft(
    Curves=[list_item, list_item_2],
    Options={Adjust=False, Closed=False, LoftEnds=0, LoftSimp=0, LoftType=0, Rebuild=10, Refit=0.01})  # disabled
extrude = Extrude(Base=loft, Direction=graft(unit_y))  # disabled

depth = Slider(2.88, range=0..10)  # disabled
# gpt-4 Initial Response
# I understand that you would like to create a 3D
# model in Grasshopper for Rhino using a Python script node that interacts with the Rhino
# Common API. However, your request is quite
# abstract. Let's make a simple script as an
# example:
# 
# This script will generate a Box (a simple
# geometric 3D model) based on numerical data
# types (such as integers for dimension values)
# and Strings (to perhaps label the box), and we'll
# incorporate the keyword None.
width = Slider(1.66, range=0..10)  # disabled
# 2nd gpt-4 Text Prompt
# Great, now create a much more complex model
# with complex trigonometric polynomials and the
# NUMPY python library.
# gpt-4 2nd Response
height = Slider(6.59, range=0.01..10)  # disabled
string_keyword_none = Script(
    x_range_min=x_range_min,
    x_range_max=x_range_max,
    y_range_min=y_range_min,
    y_range_max=y_range_max,
    u_count=x_y__samples,
    v_count=x_y__samples_2,
    amp=multiplication,
    indicator=Slider(2.07, range=0..10))  # -> reverse(out), A, B; inputs x_range_min: Double, x_range_max: Double, y_range_min: Double, y_range_max: Double, u_count: Int32, v_count: Int32, use_alternate_eq: Boolean, amp: Double, indicator: Double
# ---------- string_keyword_none: Python ----------
# r: numpy

import Rhino.Geometry as rg
import numpy as np

def trigonometric_surface(u_count, v_count, u_domain, v_domain):
    """Create a surface defined by a trigonometric polynomial."""
    
    max_z = float('-inf')
    
    # Generate the control points for the surface based on trigonometric function
    control_points = []
    for i in np.linspace(u_domain[0], u_domain[1], u_count):
        for j in np.linspace(v_domain[0], v_domain[1], v_count):
            x = i
            y = j
            z = amp * (np.sin(i) * np.cos(j))
            if z > max_z:
                max_z = z
            control_points.append(rg.Point3d(x, y, z))

    # Create the NURBS surface directly using the CreateFromPoints method
    ns = rg.NurbsSurface.CreateFromPoints(control_points, u_count, v_count, u_count - 1, v_count - 1)
    
    # Determine label based on the maximum height
    label = "Complex Surface" if max_z > indicator else None
    
    return ns, label

# Surface parameters
u_count = u_count
v_count = v_count
u_domain = [x_range_min, x_range_max * np.pi]
v_domain = [y_range_min, y_range_max * np.pi]

# Generate the surface
surface_model, surface_label = trigonometric_surface(u_count, v_count, u_domain, v_domain)

# Output
A = surface_model
B = surface_label
# ---------- end string_keyword_none ----------
string_keyword_none_2 = Script(w=width, d=depth, h=height)  # -> out, A, B; inputs w: Double, d: Double, h: Double; disabled
# ---------- string_keyword_none_2: Python ----------
import Rhino.Geometry as rg

def create_box(width, depth, height, label=None):
    """Create a box with a given width, depth, and height."""
    base_point = rg.Point3d(0, 0, 0)
    base_plane = rg.Plane(base_point, rg.Vector3d.ZAxis)
    interval_x = rg.Interval(0, width)
    interval_y = rg.Interval(0, depth)
    interval_z = rg.Interval(0, height)
    box = rg.Box(base_plane, interval_x, interval_y, interval_z)
    
    # Assign a label based on height condition
    if height > 5:
        label = "Happy Box"
    
    return box, label

# Numerical Data for dimensions of the box
width = w
depth = d
height = h

# Creating the 3D model
box_model, label = create_box(width, depth, height)

# Output
A = box_model
B = label
# ---------- end string_keyword_none_2 ----------
panel_8 = Panel(string_keyword_none_2.out)  # disabled
entwine = Entwine(Branch00=string_keyword_none_2.A, Branch01=string_keyword_none_2.B, FlattenInputs=True)  # disabled
mesh = Mesh(string_keyword_none.A)
surface = Surface(string_keyword_none.A)
panel_9 = Panel(string_keyword_none.out)
panel_10 = Panel(entwine)  # disabled
panel_11 = Panel(surface)
panel_12 = Panel(string_keyword_none.B)
