# Grasshopper definition 007_Lists_len_function.gh (Grasshopper 1.0.7)
# plug-ins: RhinoCodePluginGH

amp = Slider(2, range=0..2)
x_y__samples = Slider(20, range=0..20)
x_y__samples_2 = Slider(20, range=0..20)
x_range_max = Slider(3, range=-3..3)
# Certainly! Let's create a complex geometric
# model based on trigonometric polynomials using
# the numpy library in Rhino's Python
# environment.
# 
# We will generate a 3D parametric surface based
# on trigonometric functions, then output the
# resulting mesh from the script. The len() function
# will be used to output the number of vertices in
# the created mesh.
x_range_min = Slider(-3, range=-3..3)

# ----
# Oscillation Algorithm
# The oscillation algorithm can be use to animate
# any geometry that is driven by a number sliders.
# Simply swap out the number sliders at the
# multiplication node in the oscillation script.
panel = Panel("1")
trigger = Trigger(Interval=20, TimerInterval=20, Target=data_recorder)
data_recorder = DataRecorder(panel, DataLimit=-10, RecordData=False)
list_length = ListLength(List=data_recorder)
division = Division(A=list_length, B=Slider(317, range=0..1000))
cosine = Cosine(Value=division)
sine = Sine(Value=division)
panel_2 = Panel([sine, cosine])
multiplication = Multiplication(A=sine, B=x_range_min)
multiplication_2 = Multiplication(A=cosine, B=x_range_max)

# ----
# #The Numpy Array:
# A Multidimensional Array Object
# test_random
number_slider = Slider(4, range=0..4)  # disabled
number_slider_2 = Slider(11, range=0..20)  # disabled
numpy = Script(rows=number_slider, columns=number_slider_2)  # -> out, a, arr0_OUT, arr1_OUT, arr2_OUT, arr3_OUT; inputs rows: Int32, columns: Int32; disabled
# ---------- numpy: Python ----------
"""Grasshopper Script"""
#! python 3
a = "Welcome to Wickerson Studios!"
print(a)

# r: numpy

import numpy

arr = numpy.random.rand(rows, columns)

print(arr)
print(type(arr))
arr = arr.tolist()
print(arr)

arr_OUT = [arr[i] if i < rows else False for i in range(4)]
arr0_OUT, arr1_OUT, arr2_OUT, arr3_OUT = arr_OUT
# ---------- end numpy ----------
panel_3 = Panel(numpy.a)  # disabled
number = Number(numpy.arr0_OUT)  # disabled
# 002 Python Refresher
# Container Data Structures
# Lists Keyword: is
# gpt-4 Text Prompt
# Create a geometric 3D model with
# 
# Container Data Structures
# with
# Lists len() function
# 
# for  a python 3 script for the python 3 script
# node in grasshopper for Rhino8WIP using the
# 
# Rhino Common API.
# 
# Output the parts of the model in different
# variable outputs in the python 3 node in
# grasshopper.
panel_4 = Panel(number)  # disabled
number_2 = Number(numpy.arr1_OUT)  # disabled
panel_5 = Panel(number_2)  # disabled
number_3 = Number(numpy.arr2_OUT)  # disabled
panel_6 = Panel(number_3)  # disabled
number_4 = Number(numpy.arr3_OUT)  # disabled
number_slider_3 = Slider(10, range=0..100)  # disabled
panel_7 = Panel(number_4)  # disabled
multiplication_3 = Multiplication(A=number, B=number_slider_3)  # disabled
multiplication_4 = Multiplication(A=number_2, B=number_slider_3)  # disabled
construct_point = ConstructPoint(XCoordinate=multiplication_3, YCoordinate=graft(multiplication_3), ZCoordinate=0)  # disabled
construct_point_2 = ConstructPoint(XCoordinate=multiplication_3, YCoordinate=graft(multiplication_3), ZCoordinate=multiplication_4)  # disabled
unit_x = UnitX(Factor=number_3)  # disabled
line = Line(StartPoint=construct_point, EndPoint=construct_point_2)  # disabled
move = Move(Geometry=line, Motion=unit_x)  # -> Geometry, Transform; disabled
list_item = ListItem(List=graft(line), Index=0, Wrap=True)  # disabled
list_item_2 = ListItem(List=graft(move.Geometry), Index=0, Wrap=True)  # disabled
unit_y = UnitY(Factor=number_4)  # disabled
loft = Loft(
    Curves=[list_item, list_item_2],
    Options={Adjust=False, Closed=False, LoftEnds=0, LoftSimp=0, LoftType=0, Rebuild=10, Refit=0.01})  # disabled
extrude = Extrude(Base=loft, Direction=graft(unit_y))  # disabled

# ----
# gpt-4 Initial Response
# To create a simple geometric 3D model using
# the Rhino Common API, and outputting the
# parts of the model as different variables in a
# Python node in Grasshopper for Rhino 8 WIP,
# follow the instructions and code sample below.
# 2nd gpt-4 Text Prompt
# Great, now create a much more complex model
# with complex trigonometric polynomials and the
# NUMPY python library.
# gpt-4 2nd Response
number_slider_4 = Slider(7.226, range=0..10)
lists_len = Script(u_freq=multiplication, v_freq=multiplication_2, u_count=x_y__samples, v_count=x_y__samples_2, scale=amp)  # -> reverse(out), a, b; inputs u_freq: Double, v_freq: Double, u_count: Int32, v_count: Int32, scale: Double
# ---------- lists_len: Python ----------
# r: numpy

import Rhino.Geometry as rg
import numpy as np

def create_trigonometric_surface(u_count, v_count, u_freq, v_freq, scale):
    """
    Generate a 3D parametric surface based on trigonometric functions.
    u_count, v_count: Number of divisions in u and v direction
    u_freq, v_freq: Frequency of sine waves in u and v direction
    scale: Amplitude scaling factor
    """
    
    # Create an empty list to store vertices
    vertices = []
    
    # Create a grid of u and v parameters
    u_values = np.linspace(0, 2 * np.pi, u_count)
    v_values = np.linspace(0, 2 * np.pi, v_count)
    
    for u in u_values:
        for v in v_values:
            # Define the x, y, z coordinates based on trigonometric functions
            x = scale * np.sin(u * u_freq) + u
            y = scale * np.cos(v * v_freq) + v
            z = scale * np.sin(u * u_freq) * np.cos(v * v_freq)
            
            # Create a 3D point and append to the vertices list
            vertices.append(rg.Point3d(x, y, z))
    
    # Create mesh from vertices
    mesh = rg.Mesh()
    
    for u in range(u_count - 1):
        for v in range(v_count - 1):
            # Calculate vertex indices for the current face
            pt1 = u * v_count + v
            pt2 = (u + 1) * v_count + v
            pt3 = (u + 1) * v_count + (v + 1)
            pt4 = u * v_count + (v + 1)
            
            # Add the face to the mesh
            mesh.Faces.AddFace(pt1, pt2, pt3, pt4)
    
    mesh.Vertices.AddVertices(vertices)
    
    return mesh

# Define parameters for the surface
"""
u_count, v_count = 50, 50
u_freq, v_freq = 3, 3
scale = 5.0
"""

# Create the trigonometric surface
surface_mesh = create_trigonometric_surface(u_count, v_count, u_freq, v_freq, scale)

# Output the mesh and the number of vertices using the len() function
a = surface_mesh
b = len(surface_mesh.Vertices)
# ---------- end lists_len ----------
list_len = Script(s=number_slider_4)  # -> out, a, b; inputs s: Double
# ---------- list_len: Python ----------
import Rhino.Geometry as rg

def create_cube(size):
    """Create a cube centered at the origin with the given size."""
    # Bottom 4 corners
    pt1 = rg.Point3d(-size/2, -size/2, -size/2)
    pt2 = rg.Point3d(size/2, -size/2, -size/2)
    pt3 = rg.Point3d(size/2, size/2, -size/2)
    pt4 = rg.Point3d(-size/2, size/2, -size/2)
    
    # Top 4 corners
    pt5 = rg.Point3d(-size/2, -size/2, size/2)
    pt6 = rg.Point3d(size/2, -size/2, size/2)
    pt7 = rg.Point3d(size/2, size/2, size/2)
    pt8 = rg.Point3d(-size/2, size/2, size/2)
    
    # Create lines to form the cube
    lines = [
        rg.Line(pt1, pt2),
        rg.Line(pt2, pt3),
        rg.Line(pt3, pt4),
        rg.Line(pt4, pt1),
        
        rg.Line(pt5, pt6),
        rg.Line(pt6, pt7),
        rg.Line(pt7, pt8),
        rg.Line(pt8, pt5),
        
        rg.Line(pt1, pt5),
        rg.Line(pt2, pt6),
        rg.Line(pt3, pt7),
        rg.Line(pt4, pt8),
    ]
    
    return lines

# Adjust the cube size as needed
size = s  # Cube with 10 units per side

# Create the cube
cube_lines = create_cube(size)

# Output the cube
a = cube_lines

# Additionally outputting the length of the lines using the len() function
b = len(cube_lines)
# ---------- end list_len ----------
panel_8 = Panel(list_len.out)
entwine = Entwine(Branch00=list_len.a, Branch01=list_len.b, FlattenInputs=True)
mesh = Mesh(lists_len.a)
panel_9 = Panel(lists_len.out)
panel_10 = Panel(lists_len.b)
panel_11 = Panel(mesh)
panel_12 = Panel(entwine)
