# Grasshopper definition 008_Lists_Keyword_is.gh (Grasshopper 1.0.7)
# plug-ins: RhinoCodePluginGH

# Oscillation Algorithm
# The oscillation algorithm can be use to animate
# any geometry that is driven by a number sliders.
# Simply swap out the number sliders at the
# multiplication node in the oscillation script.
panel = Panel("1")  # disabled
trigger = Trigger(Interval=20, TimerInterval=20, Target=data_recorder)  # disabled
data_recorder = DataRecorder(panel, DataLimit=-10, RecordData=False)  # disabled
number_slider = Slider(58, range=0..1000)  # disabled
list_length = ListLength(List=data_recorder)  # disabled
division = Division(A=list_length, B=number_slider)  # disabled
cosine = Cosine(Value=division)  # disabled
sine = Sine(Value=division)  # disabled
panel_2 = Panel([sine, cosine])  # disabled
# 2nd gpt-4 Text Prompt
# Great, now create a much more complex model
# with complex trigonometric polynomials and the
# NUMPY python library. An be sure to use the keyword is.
z_length = Slider(7.226, range=0..10)

# ----
# #The Numpy Array:
# A Multidimensional Array Object
# test_random
number_slider_2 = Slider(4, range=0..4)
numpy = Script(rows=number_slider_2, columns=Slider(11, range=0..20))  # -> out, a, arr0_OUT, arr1_OUT, arr2_OUT, arr3_OUT; inputs rows: Int32, columns: Int32
# ---------- numpy: Python ----------
"""Grasshopper Script"""
#! python 3
a = "Welcome to Wickerson Studios!"
print(a)

# r: numpy

import numpy

arr = numpy.random.rand(rows, columns)

print(arr)
print(type(arr))
arr = arr.tolist()
print(arr)

arr_OUT = [arr[i] if i < rows else False for i in range(4)]
arr0_OUT, arr1_OUT, arr2_OUT, arr3_OUT = arr_OUT
# ---------- end numpy ----------
panel_3 = Panel(numpy.a)
number = Number(numpy.arr0_OUT)
# 002 Python Refresher
# Container Data Structures
# Lists Keyword: is
# gpt-4 Text Prompt
# Create a geometric 3D model with
# 
# Container Data Structures
# with
# Lists Keyword "is"
# 
# for  a python 3 script for the python 3 script
# node in grasshopper for Rhino8WIP using the
# 
# Rhino Common API.
# 
# Output the parts of the model in different
# variable outputs in the python 3 node in
# grasshopper.
panel_4 = Panel(number)
number_2 = Number(numpy.arr1_OUT)
panel_5 = Panel(number_2)
number_3 = Number(numpy.arr2_OUT)
panel_6 = Panel(number_3)
number_4 = Number(numpy.arr3_OUT)
number_slider_3 = Slider(10, range=0..100)
panel_7 = Panel(number_4)
multiplication = Multiplication(A=number, B=number_slider_3)
multiplication_2 = Multiplication(A=number_2, B=number_slider_3)
construct_point = ConstructPoint(XCoordinate=multiplication, YCoordinate=graft(multiplication), ZCoordinate=0)
construct_point_2 = ConstructPoint(XCoordinate=multiplication, YCoordinate=graft(multiplication), ZCoordinate=multiplication_2)
unit_x = UnitX(Factor=number_3)
line = Line(StartPoint=construct_point, EndPoint=construct_point_2)
move = Move(Geometry=line, Motion=unit_x)  # -> Geometry, Transform
list_item = ListItem(List=graft(line), Index=0, Wrap=True)
list_item_2 = ListItem(List=graft(move.Geometry), Index=0, Wrap=True)
unit_y = UnitY(Factor=number_4)
loft = Loft(
    Curves=[list_item, list_item_2],
    Options={Adjust=False, Closed=False, LoftEnds=0, LoftSimp=0, LoftType=0, Rebuild=10, Refit=0.01})
extrude = Extrude(Base=loft, Direction=graft(unit_y))

# ----
# gpt-4 Initial Response
# To create a simple geometric 3D model using
# the Rhino Common API, and outputting the
# parts of the model as different variables in a
# Python node in Grasshopper for Rhino 8 WIP,
# follow the instructions and code sample below.
x_length = Slider(7.226, range=0..10)
y_length = Slider(5.862, range=0..10)
v_values = Slider(11, range=0..20)
u_values = Slider(20, range=0..20)
u_values_2 = Slider(-1.92, range=-3..3)
multiplication_3 = Multiplication(A=cosine, B=u_values_2)  # disabled
v_values_2 = Slider(-0.81, range=-3..3)
multiplication_4 = Multiplication(A=cosine, B=v_values_2)  # disabled
# gpt-4 2nd Response
# Certainly! Let's create a more complex geometry
# in Rhino using trigonometric functions with the
# help of numpy to generate the points. For this
# demonstration, we'll create a parametric surface
# based on trigonometric polynomials, and we'll
# use the is keyword as part of our control logic.
u_values_3 = Slider(-3, range=-3..3)
multiplication_5 = Multiplication(A=sine, B=u_values_3)  # disabled
v_values_3 = Slider(-3, range=-3..3)
multiplication_6 = Multiplication(A=sine, B=v_values_3)  # disabled
list_keyword_is = Script(x=x_length, y=y_length, z=z_length)  # -> out, model; inputs x: Double, y: Double, z: Double
# ---------- list_keyword_is: Python ----------
import Rhino.Geometry as rg

def create_geometry(lists):
    # Check if any two lists within the main list are the same instance.
    # This would be rare in normal circumstances unless intentionally done.
    for i in range(len(lists)):
        for j in range(i+1, len(lists)):
            if lists[i] is lists[j]:
                # If two lists are the exact same instance, create a box.
                base_plane = rg.Plane.WorldXY
                x_length = x
                y_length = y
                z_length = z
                box = rg.Box(base_plane, rg.Interval(0, x_length), rg.Interval(0, y_length), rg.Interval(0, z_length))
                return box
    return None

# Example: Two of the lists here are the exact same instance.
list1 = [rg.Point3d(0,0,0), rg.Point3d(10,0,0), rg.Point3d(5,10,0)]
list2 = list1  # This is not a copy. list2 is list1.
lists = [list1, list2]

# Generate the geometric model.
model = create_geometry(lists)

# The variable 'model' can now be connected to your Grasshopper Python node output.
# ---------- end list_keyword_is ----------
list_keyword_is_2 = Script(u1=u_values_3, u2=u_values_2, u3=u_values, v1=v_values_3, v2=v_values_2, v3=v_values)  # -> reverse(out), model; inputs u1: Double, u2: Double, u3: Int32, v1: Double, v2: Double, v3: Int32
# ---------- list_keyword_is_2: Python ----------
# r: numpy

import Rhino.Geometry as rg
import numpy as np

def generate_points(uv_set):
    """Generate a set of 3D points based on trigonometric polynomials."""
    u_values, v_values = uv_set
    
    points = []
    for u in u_values:
        row = []
        for v in v_values:
            x = u * np.cos(np.pi * u) * np.sin(np.pi * v)
            y = u * np.sin(np.pi * u) * np.sin(np.pi * v)
            z = u * np.cos(np.pi * v)
            row.append(rg.Point3d(x, y, z))
        points.append(row)
    return points

def create_surface(points):
    """Create a surface from the generated points."""
    curves = [rg.Curve.CreateInterpolatedCurve(pt_list, 3) for pt_list in points]
    return rg.Brep.CreateFromLoft(curves, rg.Point3d.Unset, rg.Point3d.Unset, rg.LoftType.Normal, False)[0]


# Generate u and v value sets.
u_values = np.linspace(u1, u2, u3)
v_values = np.linspace(v1, v2, v3)

# Let's intentionally create two identical sets.
uv_set_1 = [u_values, v_values]
uv_set_2 = uv_set_1  # This makes uv_set_2 point to the same memory location as uv_set_1.

# Check if the two uv sets are identical using the `is` keyword.
if uv_set_1 is uv_set_2:
    points = generate_points(uv_set_1)
    model = create_surface(points)

# The variable 'model' can now be connected to your Grasshopper Python node output.
# ---------- end list_keyword_is_2 ----------
panel_8 = Panel(list_keyword_is.out)
entwine = Entwine(Branch00=list_keyword_is.model, FlattenInputs=True)
entwine_2 = Entwine(FlattenInputs=True)
panel_9 = Panel(list_keyword_is_2.out)
panel_10 = Panel(list_keyword_is.model)
panel_11 = Panel(list_keyword_is_2.model)
