# Grasshopper definition 009_Lists_append.gh (Grasshopper 1.0.7)
# plug-ins: RhinoCodePluginGH

# Oscillation Algorithm
# The oscillation algorithm can be use to animate
# any geometry that is driven by a number sliders.
# Simply swap out the number sliders at the
# multiplication node in the oscillation script.
panel = Panel("1")  # disabled
trigger = Trigger(Interval=20, TimerInterval=20, Target=data_recorder)  # disabled
data_recorder = DataRecorder(panel, DataLimit=-10, RecordData=False)  # disabled
number_slider = Slider(58, range=0..1000)  # disabled
list_length = ListLength(List=data_recorder)  # disabled
division = Division(A=list_length, B=number_slider)  # disabled
cosine = Cosine(Value=division)  # disabled
sine = Sine(Value=division)  # disabled
panel_2 = Panel([sine, cosine])  # disabled
# 2nd gpt-4 Text Prompt
# Great, now create a much more complex model
# with complex trigonometric polynomials and the
# NUMPY python library. And be sure to use the
# append() function several times.
z_length = Slider(9.019, range=0..10)
y_length = Slider(2.757, range=0..10)
# gpt-4 Initial Response
# Certainly! Here's a simple script that generates
# a geometric 3D model. This example will create
# a parametric array of spheres in 3D space using
#  a  list and the append() function in a
# Grasshopper Python node. We will use the
# RhinoCommon API to create the geometry.
number_slider_2 = Slider(4, range=0..10)

# ----
# #The Numpy Array:
# A Multidimensional Array Object
# test_random
number_slider_3 = Slider(4, range=0..4)
numpy = Script(rows=number_slider_3, columns=Slider(11, range=0..20))  # -> out, a, arr0_OUT, arr1_OUT, arr2_OUT, arr3_OUT; inputs rows: Int32, columns: Int32
# ---------- numpy: Python ----------
"""Grasshopper Script"""
#! python 3
a = "Welcome to Wickerson Studios!"
print(a)

# r: numpy

import numpy

arr = numpy.random.rand(rows, columns)

print(arr)
print(type(arr))
arr = arr.tolist()
print(arr)

arr_OUT = [arr[i] if i < rows else False for i in range(4)]
arr0_OUT, arr1_OUT, arr2_OUT, arr3_OUT = arr_OUT
# ---------- end numpy ----------
panel_3 = Panel(numpy.a)
number = Number(numpy.arr0_OUT)
# 002 Python Refresher
# Container Data Structures
# Lists append() function
# gpt-4 Text Prompt
# Create a geometric 3D model with
# 
# Container Data Structures
# with
# Lists append() function
# 
# for  a python 3 script for the python 3 script
# node in grasshopper for Rhino8WIP using the
# 
# Rhino Common API.
# 
# Output the parts of the model in different
# variable outputs in the python 3 node in
# grasshopper.
panel_4 = Panel(number)
number_2 = Number(numpy.arr1_OUT)
panel_5 = Panel(number_2)
number_3 = Number(numpy.arr2_OUT)
panel_6 = Panel(number_3)
number_4 = Number(numpy.arr3_OUT)
number_slider_4 = Slider(10, range=0..100)
panel_7 = Panel(number_4)
multiplication = Multiplication(A=number, B=number_slider_4)
multiplication_2 = Multiplication(A=number_2, B=number_slider_4)
construct_point = ConstructPoint(XCoordinate=multiplication, YCoordinate=graft(multiplication), ZCoordinate=0)
construct_point_2 = ConstructPoint(XCoordinate=multiplication, YCoordinate=graft(multiplication), ZCoordinate=multiplication_2)
unit_x = UnitX(Factor=number_3)
line = Line(StartPoint=construct_point, EndPoint=construct_point_2)
move = Move(Geometry=line, Motion=unit_x)  # -> Geometry, Transform
list_item = ListItem(List=graft(line), Index=0, Wrap=True)
list_item_2 = ListItem(List=graft(move.Geometry), Index=0, Wrap=True)
unit_y = UnitY(Factor=number_4)
loft = Loft(
    Curves=[list_item, list_item_2],
    Options={Adjust=False, Closed=False, LoftEnds=0, LoftSimp=0, LoftType=0, Rebuild=10, Refit=0.01})
extrude = Extrude(Base=loft, Direction=graft(unit_y))

v_values = Slider(11, range=0..20)
u_values = Slider(20, range=0..20)
u_values_2 = Slider(-3, range=-3..3)
# gpt-4 2nd Response
# Sure, let's create a more complex model using
# trigonometric functions and the numpy library.
# We'll construct a spiral-like form using
# trigonometric polynomial functions.
# 
# This model will be generated using the formula:
# r(t)=a+b×sin(n×t)
# z(t)=t
multiplication_3 = Multiplication(A=sine, B=u_values_2)  # disabled
u_values_3 = Slider(-1.92, range=-3..3)
multiplication_4 = Multiplication(A=cosine, B=u_values_3)  # disabled
v_values_2 = Slider(-0.81, range=-3..3)
multiplication_5 = Multiplication(A=cosine, B=v_values_2)  # disabled
v_values_3 = Slider(-3, range=-3..3)
multiplication_6 = Multiplication(A=sine, B=v_values_3)  # disabled
list_append = Script(num_cylinders=number_slider_2, base_radius=y_length, height=z_length)  # -> out, a, b, c, d, e; inputs num_cylinders: Int32, base_radius: Double, height: Double
# ---------- list_append: Python ----------
import Rhino.Geometry as rg
import scriptcontext as sc

def create_cylinder(pt, radius, height):
    """Create a cylinder with given base point, radius, and height."""
    circle = rg.Circle(pt, radius)
    cylinder = rg.Cylinder(circle, height)
    return rg.Brep.CreateFromCylinder(cylinder, False, False)

def main(num_cylinders, base_radius, height):
    """Generate the series of cylinders and return as a list."""
    cylinders = []
    for i in range(num_cylinders):
        pt = rg.Point3d(0, i * (base_radius*2 + 10), 0)  # Adjusting y-coordinates to avoid overlap
        radius = base_radius + i
        cylinders.append(create_cylinder(pt, radius, height))
    return cylinders

# Number of cylinders, base radius, and height of each cylinder
"""
num_cylinders = 5
base_radius = 5
height = 20
"""

# Call the main function
cylinders_list = main(num_cylinders, base_radius, height)

# Output for Grasshopper (for simplicity, assuming we've a maximum of 5 cylinders)
a = cylinders_list[0] if len(cylinders_list) > 0 else None
b = cylinders_list[1] if len(cylinders_list) > 1 else None
c = cylinders_list[2] if len(cylinders_list) > 2 else None
d = cylinders_list[3] if len(cylinders_list) > 3 else None
e = cylinders_list[4] if len(cylinders_list) > 4 else None
# ---------- end list_append ----------
list_append_2 = Script(u1=u_values_2, u2=u_values_3, u3=u_values, v1=v_values_3, v2=v_values_2, v3=v_values)  # -> reverse(out), model; inputs u1: Double, u2: Double, u3: Int32, v1: Double, v2: Double, v3: Int32
# ---------- list_append_2: Python ----------
# r: numpy

import Rhino.Geometry as rg
import numpy as np

def generate_points(uv_set):
    """Generate a set of 3D points based on trigonometric polynomials."""
    u_values, v_values = uv_set
    
    points = []
    for u in u_values:
        row = []
        for v in v_values:
            x = u * np.cos(np.pi * u) * np.sin(np.pi * v)
            y = u * np.sin(np.pi * u) * np.sin(np.pi * v)
            z = u * np.cos(np.pi * v)
            row.append(rg.Point3d(x, y, z))
        points.append(row)
    return points

def create_surface(points):
    """Create a surface from the generated points."""
    curves = [rg.Curve.CreateInterpolatedCurve(pt_list, 3) for pt_list in points]
    return rg.Brep.CreateFromLoft(curves, rg.Point3d.Unset, rg.Point3d.Unset, rg.LoftType.Normal, False)[0]


# Generate u and v value sets.
u_values = np.linspace(u1, u2, u3)
v_values = np.linspace(v1, v2, v3)

# Let's intentionally create two identical sets.
uv_set_1 = [u_values, v_values]
uv_set_2 = uv_set_1  # This makes uv_set_2 point to the same memory location as uv_set_1.

# Check if the two uv sets are identical using the `is` keyword.
if uv_set_1 is uv_set_2:
    points = generate_points(uv_set_1)
    model = create_surface(points)

# The variable 'model' can now be connected to your Grasshopper Python node output.
# ---------- end list_append_2 ----------
entwine = Entwine(
    Branch00=list_append.a,
    Branch01=list_append.b,
    Branch02=list_append.c,
    Branch03=list_append.d,
    Branch04=list_append.e,
    FlattenInputs=True)
panel_8 = Panel(list_append.out)
entwine_2 = Entwine(FlattenInputs=True)
panel_9 = Panel(list_append_2.out)
panel_10 = Panel(entwine)
panel_11 = Panel(list_append_2.model)
