# Grasshopper definition 010_Lists_insert.gh (Grasshopper 1.0.7)
# plug-ins: RhinoCodePluginGH

# ----
# Oscillation Algorithm
# The oscillation algorithm can be use to animate
# any geometry that is driven by a number sliders.
# Simply swap out the number sliders at the
# multiplication node in the oscillation script.
panel = Panel("1")  # disabled
trigger = Trigger(Interval=20, TimerInterval=20, Target=data_recorder)  # disabled
data_recorder = DataRecorder(panel, DataLimit=-10, RecordData=False)  # disabled
number_slider = Slider(58, range=0..1000)  # disabled
list_length = ListLength(List=data_recorder)  # disabled
division = Division(A=list_length, B=number_slider)  # disabled
cosine = Cosine(Value=division)  # disabled
sine = Sine(Value=division)  # disabled
panel_2 = Panel([sine, cosine])  # disabled
multiplication = Multiplication(A=sine)  # disabled
multiplication_2 = Multiplication(A=cosine)  # disabled
multiplication_3 = Multiplication(A=sine)  # disabled
multiplication_4 = Multiplication(A=cosine)  # disabled

u_values = Slider(13, range=0..20)
v_values = Slider(9, range=0..20)
# Alright! Here's an example that will create a
# complex 3D sine wave pattern using the numpy
# library combined with trigonometric functions. It
# will create a series of points based on this wave
# pattern, and subsequently, we'll insert additional
# points at specific indices to increase the
# complexity.
u_values_2 = Slider(-3, range=-3..3)
u_values_3 = Slider(0.7, range=-3..3)
# 2nd gpt-4 Text Prompt
# Great, now create a much more complex model
# with complex trigonometric polynomials and the
# NUMPY python library. And be sure to use the
# insert() function several times.
# gpt-4 2nd Response
z_length = Slider(4.14, range=0..10)  # disabled
y_length = Slider(3.759, range=0..10)  # disabled
# gpt-4 Initial Response
# To create a geometric 3D model using Rhino
# Common API in a Python 3 script for
# Grasshopper in Rhino 8 WIP, you need to
# leverage the RhinoCommon namespace to
# manipulate geometry.
y_length_2 = Slider(2.335, range=0..10)  # disabled

# ----
# #The Numpy Array:
# A Multidimensional Array Object
# test_random
number_slider_2 = Slider(4, range=0..4)  # disabled
number_slider_3 = Slider(5, range=0..20)  # disabled
numpy = Script(rows=number_slider_2, columns=number_slider_3)  # -> out, a, arr0_OUT, arr1_OUT, arr2_OUT, arr3_OUT; inputs rows: Int32, columns: Int32; disabled
# ---------- numpy: Python ----------
"""Grasshopper Script"""
#! python 3
a = "Welcome to Wickerson Studios!"
print(a)

# r: numpy

import numpy

arr = numpy.random.rand(rows, columns)

print(arr)
print(type(arr))
arr = arr.tolist()
print(arr)

arr_OUT = [arr[i] if i < rows else False for i in range(4)]
arr0_OUT, arr1_OUT, arr2_OUT, arr3_OUT = arr_OUT
# ---------- end numpy ----------
panel_3 = Panel(numpy.a)  # disabled
number = Number(numpy.arr0_OUT)  # disabled
# 002 Python Refresher
# Container Data Structures
# Lists insert() function
# gpt-4 Text Prompt
# Create a geometric 3D model with
# 
# Container Data Structures
# with
# Lists insert() function
# 
# for  a python 3 script for the python 3 script
# node in grasshopper for Rhino8WIP using the
# 
# Rhino Common API.
# 
# Output the parts of the model in different
# variable outputs in the python 3 node in
# grasshopper.
panel_4 = Panel(number)  # disabled
number_2 = Number(numpy.arr1_OUT)  # disabled
panel_5 = Panel(number_2)  # disabled
number_3 = Number(numpy.arr2_OUT)  # disabled
panel_6 = Panel(number_3)  # disabled
number_4 = Number(numpy.arr3_OUT)  # disabled
number_slider_4 = Slider(10, range=0..100)  # disabled
panel_7 = Panel(number_4)  # disabled
multiplication_5 = Multiplication(A=number, B=number_slider_4)  # disabled
multiplication_6 = Multiplication(A=number_2, B=number_slider_4)  # disabled
construct_point = ConstructPoint(XCoordinate=multiplication_5, YCoordinate=graft(multiplication_5), ZCoordinate=0)  # disabled
construct_point_2 = ConstructPoint(XCoordinate=multiplication_5, YCoordinate=graft(multiplication_5), ZCoordinate=multiplication_6)  # disabled
unit_x = UnitX(Factor=number_3)  # disabled
line = Line(StartPoint=construct_point, EndPoint=construct_point_2)  # disabled
move = Move(Geometry=line, Motion=unit_x)  # -> Geometry, Transform; disabled
list_item = ListItem(List=graft(line), Index=0, Wrap=True)  # disabled
list_item_2 = ListItem(List=graft(move.Geometry), Index=0, Wrap=True)  # disabled
unit_y = UnitY(Factor=number_4)  # disabled
loft = Loft(
    Curves=[list_item, list_item_2],
    Options={Adjust=False, Closed=False, LoftEnds=0, LoftSimp=0, LoftType=0, Rebuild=10, Refit=0.01})  # disabled
extrude = Extrude(Base=loft, Direction=graft(unit_y))  # disabled

list_insert = Script(freq_x=u_values_2, freq_y=u_values_3, amp_x=u_values, amp_y=v_values, num_points=Slider(12, range=0..100))  # -> reverse(out), d; inputs freq_x: Double, freq_y: Double, amp_x: Int32, amp_y: Double, num_points: Int32
# ---------- list_insert: Python ----------
# r: numpy

import Rhino.Geometry as rg
import numpy as np

def generate_wave_pattern(freq_x, freq_y, amp_x, amp_y, num_points):
    """
    Generate a 3D sine wave pattern.
    :param freq_x: Frequency of the wave in X direction.
    :param freq_y: Frequency of the wave in Y direction.
    :param amp_x: Amplitude of the wave in X direction.
    :param amp_y: Amplitude of the wave in Y direction.
    :param num_points: Number of points along one direction.
    :return: List of Point3d objects forming the wave pattern.
    """
    points = []

    u = np.linspace(0, 2 * np.pi, num_points)
    v = np.linspace(0, 2 * np.pi, num_points)

    for i in u:
        for j in v:
            x = i
            y = j
            z = amp_x * np.sin(freq_x * i) + amp_y * np.sin(freq_y * j)
            points.append(rg.Point3d(x, y, z))

    # Using insert() to add complexity
    for i in range(10, len(points), 15):  # Add a new point every 15 indices, starting from the 10th index
        pt = points[i]
        new_pt = rg.Point3d(pt.X, pt.Y, pt.Z + 5)  # Shifted 5 units upward in Z direction
        points.insert(i, new_pt)

    return points

def main():
    pts = generate_wave_pattern(freq_x=1, freq_y=2, amp_x=5, amp_y=5, num_points=50)
    polyline = rg.Polyline(pts)
    return polyline.ToPolylineCurve()

# Output
d = main()
# ---------- end list_insert ----------
list_insert_2 = Script(x=y_length_2, y=y_length, z=z_length)  # -> out, a, b, c, d; inputs x: Double, y: Double, z: Double; disabled
# ---------- list_insert_2: Python ----------
import Rhino.Geometry as rg

def main():
    # Step 1: Create a 3D point
    pt1 = rg.Point3d(0, 0, 0)
    
    # Step 2: Create a copy of this point and move it
    pt2 = rg.Point3d(pt1)
    pt2.Transform(rg.Transform.Translation(10,10,10))
    
    # Using list's insert() function
    pts_list = [pt1, pt2]
    
    # Step 3: Insert a new point between the first two points
    middle_pt = rg.Point3d((pt1.X + pt2.X) / 2, (pt1.Y + pt2.Y) / 2, (pt1.Z + pt2.Z) / 2)
    pts_list.insert(1, middle_pt)
    
    # Step 4: Create a polyline using these points and convert it to a PolylineCurve
    polyline = rg.Polyline(pts_list)
    polyline_curve = polyline.ToPolylineCurve()
    
    return pt1, pt2, middle_pt, polyline_curve

# Call the main function and unpack its results to the output
pt1, pt2, middle_pt, polyline_curve = main()

# Outputs
a = pt1
b = pt2
c = middle_pt
d = polyline_curve
# ---------- end list_insert_2 ----------
panel_8 = Panel(list_insert_2.out)  # disabled
entwine = Entwine(
    Branch00=list_insert_2.a,
    Branch01=list_insert_2.b,
    Branch02=list_insert_2.c,
    Branch03=list_insert_2.d,
    FlattenInputs=True)  # disabled
entwine_2 = Entwine(FlattenInputs=True)
panel_9 = Panel(list_insert.out)
panel_10 = Panel(entwine)  # disabled
panel_11 = Panel(list_insert.d)
