# Grasshopper definition 011_Lists_concatenation.gh (Grasshopper 1.0.7)
# plug-ins: RhinoCodePluginGH

# ----
# Oscillation Algorithm
# The oscillation algorithm can be use to animate
# any geometry that is driven by a number sliders.
# Simply swap out the number sliders at the
# multiplication node in the oscillation script.
panel = Panel("1")
trigger = Trigger(Interval=20, TimerInterval=20, Target=data_recorder)
data_recorder = DataRecorder(panel, DataLimit=-10, RecordData=False)
list_length = ListLength(List=data_recorder)
division = Division(A=list_length, B=Slider(147, range=0..1000))
cosine = Cosine(Value=division)
sine = Sine(Value=division)
panel_2 = Panel([sine, cosine])
multiplication = Multiplication(A=sine)
multiplication_2 = Multiplication(A=cosine)

# ----
# #The Numpy Array:
# A Multidimensional Array Object
# test_random
number_slider = Slider(4, range=0..4)  # disabled
number_slider_2 = Slider(5, range=0..20)  # disabled
numpy = Script(rows=number_slider, columns=number_slider_2)  # -> out, a, arr0_OUT, arr1_OUT, arr2_OUT, arr3_OUT; inputs rows: Int32, columns: Int32; disabled
# ---------- numpy: Python ----------
"""Grasshopper Script"""
#! python 3
a = "Welcome to Wickerson Studios!"
print(a)

# r: numpy

import numpy

arr = numpy.random.rand(rows, columns)

print(arr)
print(type(arr))
arr = arr.tolist()
print(arr)

arr_OUT = [arr[i] if i < rows else False for i in range(4)]
arr0_OUT, arr1_OUT, arr2_OUT, arr3_OUT = arr_OUT
# ---------- end numpy ----------
panel_3 = Panel(numpy.a)  # disabled
number = Number(numpy.arr0_OUT)  # disabled
# 002 Python Refresher
# Container Data Structures
# List Concatenation
# gpt-4 Text Prompt
# Create a geometric 3D model with
# 
# Container Data Structures
# with
# List concatenation with sublists
# 
# for  a python 3 script for the python 3 script
# node in grasshopper for Rhino8WIP using the
# 
# Rhino Common API.
# 
# Output the parts of the model in different
# variable outputs in the python 3 node in
# grasshopper.
panel_4 = Panel(number)  # disabled
number_2 = Number(numpy.arr1_OUT)  # disabled
panel_5 = Panel(number_2)  # disabled
number_3 = Number(numpy.arr2_OUT)  # disabled
panel_6 = Panel(number_3)  # disabled
number_4 = Number(numpy.arr3_OUT)  # disabled
number_slider_3 = Slider(10, range=0..100)  # disabled
panel_7 = Panel(number_4)  # disabled
multiplication_3 = Multiplication(A=number, B=number_slider_3)  # disabled
multiplication_4 = Multiplication(A=number_2, B=number_slider_3)  # disabled
construct_point = ConstructPoint(XCoordinate=multiplication_3, YCoordinate=graft(multiplication_3), ZCoordinate=0)  # disabled
construct_point_2 = ConstructPoint(XCoordinate=multiplication_3, YCoordinate=graft(multiplication_3), ZCoordinate=multiplication_4)  # disabled
unit_x = UnitX(Factor=number_3)  # disabled
line = Line(StartPoint=construct_point, EndPoint=construct_point_2)  # disabled
move = Move(Geometry=line, Motion=unit_x)  # -> Geometry, Transform; disabled
list_item = ListItem(List=graft(line), Index=0, Wrap=True)  # disabled
list_item_2 = ListItem(List=graft(move.Geometry), Index=0, Wrap=True)  # disabled
unit_y = UnitY(Factor=number_4)  # disabled
loft = Loft(
    Curves=[list_item, list_item_2],
    Options={Adjust=False, Closed=False, LoftEnds=0, LoftSimp=0, LoftType=0, Rebuild=10, Refit=0.01})  # disabled
extrude = Extrude(Base=loft, Direction=graft(unit_y))  # disabled

# ----
# Certainly! Here's an outline of what I'm going to make:
# 
# Geometric Model - A simple 3D model composed
# of points, lines, and surfaces. I'll use
# a 3x3x3 grid of points.
# Container Data Structures - I'll create a few lists
# and sublists to contain these points, lines, and
# surfaces.
# List Concatenation - I'll demonstrate combining
# (concatenating) lists and sublists.
# Output using Grasshopper's Python Script Node
#  - The concatenated lists will be output as
# separate variables.
# 2nd gpt-4 Text Prompt
# Great, now create a much more complex model
# with complex trigonometric polynomials and the
# NUMPY python library. And be sure to use the
# List Concatenation and sublists  several times.
# gpt-4 2nd Response
size = Slider(3, range=0..10)  # disabled
# Absolutely! Let's make a more complex
# geometric model using numpy for trigonometric
# polynomial calculations. I will also frequently use
# list concatenation and sublists as requested.
# 
# The model I'll generate will be a 3D surface
# based on trigonometric polynomial functions for
# both X and Y axes with Z being the resultant.
amp_x = Slider(24, range=0..50)
division_2 = Division(A=amp_x, B=Slider(7, range=0..10))
# gpt-4 Initial Response
list_concatenation = Script(x=size)  # -> out, a, b, c; inputs x: Int32; disabled
# ---------- list_concatenation: Python ----------
import Rhino.Geometry as rg

# Define the main function to create the 3D model
def create_3D_model(size=x):
    points = []
    for x in range(size):
        for y in range(size):
            for z in range(size):
                points.append(rg.Point3d(x, y, z))
    
    # Using the points to create some lines
    lines = [rg.Line(points[i], points[i+1]) for i in range(0, len(points)-1, 2)]
    
    # Using lines to create some surfaces/extrusions
    extrusions = [rg.Extrusion.Create(line.ToNurbsCurve(), 1.0, True) for line in lines]
    
    return points, lines, extrusions

# Create the model
points, lines, extrusions = create_3D_model()

# Create container data structures
points_list = [points[i:i+3] for i in range(0, len(points), 3)]   # Chunk the points into groups of 3
lines_list = [lines[i:i+2] for i in range(0, len(lines), 2)]      # Chunk the lines into groups of 2

# Concatenate lists
all_points = []
for sublist in points_list:
    all_points.extend(sublist)

all_lines = []
for sublist in lines_list:
    all_lines.extend(sublist)

# Output the parts of the model
a = all_points
b = all_lines
c = extrusions
# ---------- end list_concatenation ----------
list_concatenation_2 = Script(u=amp_x, v=amp_x, chunks=division_2)  # -> reverse(out), a, b, c; inputs u: Int32, v: Int32, chunks: Int32
# ---------- list_concatenation_2: Python ----------
# r: numpy

import Rhino.Geometry as rg
import numpy as np
import Grasshopper as gh

def create_trigonometric_surface(u_size=u, v_size=v):
    # Generate a grid of u, v values from 0 to 2*pi
    u = np.linspace(0, 2*np.pi, u_size)
    v = np.linspace(0, 2*np.pi, v_size)
    
    U, V = np.meshgrid(u, v)
    
    # Compute x, y, z using trigonometric polynomial functions
    X = np.cos(U) + np.sin(3*U) + 2*np.sin(2*U)
    Y = np.sin(V) + 2*np.sin(2*V) + np.tan(3*V)
    Z = 2*np.sin(U + V) + np.sin(2*U + V) + 2*np.sin(2*U + 2*V)
    
    # Create 3D mesh from the computed values
    vertices = [rg.Point3d(X[i, j], Y[i, j], Z[i, j]) for i in range(u_size) for j in range(v_size)]
    
    faces = []
    for i in range(u_size - 1):
        for j in range(v_size - 1):
            pt1_index = i * v_size + j
            pt2_index = (i+1) * v_size + j
            pt3_index = (i+1) * v_size + j + 1
            pt4_index = i * v_size + j + 1
            faces.append(rg.MeshFace(pt1_index, pt2_index, pt3_index, pt4_index))
    
    mesh = rg.Mesh()
    for vertex in vertices:
        mesh.Vertices.Add(vertex)
    for face in faces:
        mesh.Faces.AddFace(face)
    
    return mesh

def chunk_list(l, n):
    return [l[i:i+n] for i in range(0, len(l), n)]

# Generate the complex trigonometric surface
mesh = create_trigonometric_surface()

# Chunk the vertices for output
vertices_sublists = chunk_list([vertex for vertex in mesh.Vertices], chunks)

# Now let's set these vertices into a DataTree
tree = gh.DataTree[rg.Point3d]()
for i, sublist in enumerate(vertices_sublists):
    for point in sublist:
        # Convert Point3f to Point3d
        point3d = rg.Point3d(point.X, point.Y, point.Z)
        path = gh.Kernel.Data.GH_Path(i)
        tree.Add(point3d, path)
        
# Create the DataTree to hold the sublists
tree = gh.DataTree[rg.Point3d]()

for i, sublist in enumerate(vertices_sublists):
    path = gh.Kernel.Data.GH_Path(i)
    for point in sublist:
        # Convert Point3f to Point3d
        point3d = rg.Point3d(point.X, point.Y, point.Z)
        tree.Add(point3d, path)


# Output
a = [vertex for vertex in mesh.Vertices]
b = mesh.Faces.Count
c = tree
# ---------- end list_concatenation_2 ----------
panel_8 = Panel(list_concatenation.out)  # disabled
line_2 = Line(list_concatenation.b)  # disabled
entwine = Entwine(Branch00=list_concatenation.a, Branch01=list_concatenation.b, Branch02=list_concatenation.c, FlattenInputs=True)  # disabled
interpolate = Interpolate(Vertices=list_concatenation_2.c, Degree=3, Periodic=False, KnotStyle=1)  # -> Curve, Length, Domain
entwine_2 = Entwine(Branch00=list_concatenation_2.a, Branch01=list_concatenation_2.b, FlattenInputs=True)
panel_9 = Panel(list_concatenation_2.out)
panel_10 = Panel(entwine)  # disabled
panel_11 = Panel(list_concatenation_2.c)
panel_12 = Panel(entwine_2)
