# Grasshopper definition 012_List_remove.gh (Grasshopper 1.0.7)
# plug-ins: RhinoCodePluginGH

# ----
# Oscillation Algorithm
# The oscillation algorithm can be use to animate
# any geometry that is driven by a number sliders.
# Simply swap out the number sliders at the
# multiplication node in the oscillation script.
panel = Panel("1")
trigger = Trigger(Interval=20, TimerInterval=20, Target=data_recorder)
data_recorder = DataRecorder(panel, DataLimit=-10, RecordData=False)
list_length = ListLength(List=data_recorder)
division = Division(A=list_length, B=Slider(166, range=0..1000))
cosine = Cosine(Value=division)
sine = Sine(Value=division)
panel_2 = Panel([sine, cosine])
multiplication = Multiplication(A=sine, B=Slider(2.734, range=0..10))
multiplication_2 = Multiplication(A=cosine, B=Slider(2.71, range=0..10))
multiplication_3 = Multiplication(A=sine, B=Slider(8.161, range=0..10))
multiplication_4 = Multiplication(A=cosine, B=Slider(8.425, range=0..10))
multiplication_5 = Multiplication(A=cosine, B=Slider(4.909, range=0..10))

# ----
# Parametric Version
number_slider = Slider(0, range=0..10)

# ----
# #The Numpy Array:
# A Multidimensional Array Object
# test_random
number_slider_2 = Slider(4, range=0..4)  # disabled
number_slider_3 = Slider(5, range=0..20)  # disabled
numpy = Script(rows=number_slider_2, columns=number_slider_3)  # -> out, a, arr0_OUT, arr1_OUT, arr2_OUT, arr3_OUT; inputs rows: Int32, columns: Int32; disabled
# ---------- numpy: Python ----------
"""Grasshopper Script"""
#! python 3
a = "Welcome to Wickerson Studios!"
print(a)

# r: numpy

import numpy

arr = numpy.random.rand(rows, columns)

print(arr)
print(type(arr))
arr = arr.tolist()
print(arr)

arr_OUT = [arr[i] if i < rows else False for i in range(4)]
arr0_OUT, arr1_OUT, arr2_OUT, arr3_OUT = arr_OUT
# ---------- end numpy ----------
panel_3 = Panel(numpy.a)  # disabled
number = Number(numpy.arr0_OUT)  # disabled
# 002 Python Refresher
# Container Data Structures
# List remove() function
# gpt-4 Text Prompt
# Create a geometric 3D model with
# 
# Container Data Structures
# with
# List remove() function
# 
# in python 3 code for the python 3 script
# node in grasshopper for Rhino8WIP using the
# 
# Rhino Common API.
# 
# Output the parts of the model in different
# variable outputs in the python 3 node in
# grasshopper.
panel_4 = Panel(number)  # disabled
number_2 = Number(numpy.arr1_OUT)  # disabled
panel_5 = Panel(number_2)  # disabled
number_3 = Number(numpy.arr2_OUT)  # disabled
panel_6 = Panel(number_3)  # disabled
number_4 = Number(numpy.arr3_OUT)  # disabled
number_slider_4 = Slider(10, range=0..100)  # disabled
panel_7 = Panel(number_4)  # disabled
multiplication_6 = Multiplication(A=number, B=number_slider_4)  # disabled
multiplication_7 = Multiplication(A=number_2, B=number_slider_4)  # disabled
construct_point = ConstructPoint(XCoordinate=multiplication_6, YCoordinate=graft(multiplication_6), ZCoordinate=0)  # disabled
construct_point_2 = ConstructPoint(XCoordinate=multiplication_6, YCoordinate=graft(multiplication_6), ZCoordinate=multiplication_7)  # disabled
unit_x = UnitX(Factor=number_3)  # disabled
line = Line(StartPoint=construct_point, EndPoint=construct_point_2)  # disabled
move = Move(Geometry=line, Motion=unit_x)  # -> Geometry, Transform; disabled
list_item = ListItem(List=graft(line), Index=0, Wrap=True)  # disabled
list_item_2 = ListItem(List=graft(move.Geometry), Index=0, Wrap=True)  # disabled
unit_y = UnitY(Factor=number_4)  # disabled
loft = Loft(
    Curves=[list_item, list_item_2],
    Options={Adjust=False, Closed=False, LoftEnds=0, LoftSimp=0, LoftType=0, Rebuild=10, Refit=0.01})  # disabled
extrude = Extrude(Base=loft, Direction=graft(unit_y))  # disabled

# ----
# 2nd gpt-4 Text Prompt
# Great, now create a much more complex model
# with complex trigonometric polynomials and the
# NUMPY python library. And be sure to use the
# List remove() function  several times.
# gpt-4 2nd Response
size = Slider(3.73, range=0..50)  # disabled
# gpt-4 Initial Response
# Creating a geometric 3D model using the Rhino
# Common API involves quite a few steps, but I'll
# provide you with a basic example. This example
# will create a 3D model of a set of boxes and use
# a list's remove() function to remove some boxes
#  based on a condition. After the removal, the
# remaining boxes will be output.
volumn = Slider(11.62, range=0..50)  # disabled
# Creating a more complex model requires
# defining the kind of geometry we want to
# generate and how the trigonometric functions
# influence it. For the sake of this example, let's
# create a parametric surface in 3D space
# influenced by trigonometric polynomials. This
# surface will then be intersected with planes, and
# based on some condition, some of these
# intersections (curves) will be removed.
list_remove = Script()  # -> reverse(out), out_mesh, out_curves; disabled
# ---------- list_remove: Python ----------
# r: numpy

import Rhino
import rhinoscriptsyntax as rs
import numpy as np

def trig_surface(u, v):
    """Define a trigonometric polynomial surface."""
    x = u
    y = v
    z = 5 * np.sin(u) * np.cos(v) + 3 * np.sin(2 * u) + 2 * np.cos(3 * v)
    return x, y, z

def generate_surface_mesh(umin, umax, vmin, vmax, step):
    """Generate a mesh using numpy and the trig_surface function."""
    u = np.arange(umin, umax, step)
    v = np.arange(vmin, vmax, step)
    U, V = np.meshgrid(u, v)
    X, Y, Z = trig_surface(U, V)

    faces = []
    vertices = []
    for i in range(len(u) - 1):
        for j in range(len(v) - 1):
            pt1 = Rhino.Geometry.Point3d(X[i][j], Y[i][j], Z[i][j])
            pt2 = Rhino.Geometry.Point3d(X[i + 1][j], Y[i + 1][j], Z[i + 1][j])
            pt3 = Rhino.Geometry.Point3d(X[i + 1][j + 1], Y[i + 1][j + 1], Z[i + 1][j + 1])
            pt4 = Rhino.Geometry.Point3d(X[i][j + 1], Y[i][j + 1], Z[i][j + 1])

            vertices.extend([pt1, pt2, pt3, pt4])
            faces.append([len(vertices) - 4, len(vertices) - 3, len(vertices) - 2, len(vertices) - 1])
    
    mesh = Rhino.Geometry.Mesh()
    for v in vertices:
        mesh.Vertices.Add(v)
    for f in faces:
        mesh.Faces.AddFace(f[0], f[1], f[2], f[3])
    return mesh

def intersect_mesh_with_planes(mesh, plane_count, spacing):
    """Intersect the mesh with a set of vertical planes."""
    intersections = []
    for i in range(plane_count):
        plane = Rhino.Geometry.Plane(Rhino.Geometry.Point3d(i * spacing, 0, 0), Rhino.Geometry.Vector3d.ZAxis)
        intersection_curves = Rhino.Geometry.Intersect.Intersection.MeshPlane(mesh, plane)
        if intersection_curves:
            intersections.extend(intersection_curves)
    return intersections


def main():
    # Generate a mesh from the trigonometric surface
    mesh = generate_surface_mesh(0, 10, 0, 10, 0.5)
    
    # Intersect the mesh with planes
    curves = intersect_mesh_with_planes(mesh, 10, 1)
    
    # Remove curves with length less than a threshold
    threshold = 3
    for curve in curves[:]:  # iterate over a copy of the list to safely modify it
        if curve.Length < threshold:
            curves.remove(curve)

    
    # Output the mesh and curves
    return mesh, curves

# Call the main function
result_mesh, result_curves = main()

# Output in Grasshopper's Python component
out_mesh = result_mesh
out_curves = result_curves
# ---------- end list_remove ----------
mesh = Mesh(list_remove.out_mesh)  # disabled
curve = Curve(list_remove.out_curves)  # disabled
list_remove_2 = Script(vol=volumn, size=size)  # -> out, result_boxes; inputs vol: Double, size: Double; disabled
# ---------- list_remove_2: Python ----------
import Rhino
import rhinoscriptsyntax as rs
import random

def create_random_box():
    """Creates a random sized box at the origin."""
    width = random.uniform(1, size)
    depth = random.uniform(1, size)
    height = random.uniform(1, size)
    
    return Rhino.Geometry.Box(Rhino.Geometry.Plane.WorldXY, Rhino.Geometry.Interval(0, width), Rhino.Geometry.Interval(0, depth), Rhino.Geometry.Interval(0, height))

def main():
    # Create a list of random boxes
    boxes = [create_random_box() for _ in range(10)]
    
    # Iterate through the list and remove boxes with volume less than vol
    for box in boxes:
        if box.Volume < vol:
            boxes.remove(box)
    
    # Output the boxes
    return boxes

# Call the main function and retrieve the result
result_boxes = main()

# Output the boxes to Grasshopper's output
for i, box in enumerate(result_boxes):
    # Assuming you've defined outputs named 'box_1', 'box_2', etc. in your Grasshopper node
    exec(f'box_{i+1} = box')
# ---------- end list_remove_2 ----------
pi = Pi(Factor=Slider(10, range=0..10))
panel_8 = Panel(list_remove.out)  # disabled
entwine = Entwine(Branch00=mesh, Branch01=curve, FlattenInputs=True)  # disabled
panel_9 = Panel(list_remove_2.out)  # disabled
list_remove_3 = Script(
    umin=number_slider,
    umax=pi,
    vmin=Slider(0, range=0..10),
    vmax=pi,
    step=Slider(1, range=0.1..1),
    plane_count=Slider(20, range=0..50),
    plane_spacing=Slider(2, range=0..2),
    length_threshold=Slider(2, range=0..2),
    A=multiplication,
    B=multiplication_2,
    C=multiplication_3,
    D=multiplication_4,
    E=multiplication_5)  # -> reverse(out), out_mesh, out_curves; inputs umin: Double, umax: Double, vmin: Double, vmax: Double, step: Double, plane_count: Int32, plane_spacing: Double, length_threshold: Double, A: Double, B: Double, C: Double, D: Double, E: Double
# ---------- list_remove_3: Python ----------
# r: numpy

import Rhino
import rhinoscriptsyntax as rs
import numpy as np

def trig_surface(u, v):
    """Define a trigonometric polynomial surface."""
    x = u
    y = v
    z = A * np.sin(u) * np.cos(v) + B * np.sin(D * u) + C * np.cos(E * v)
    return x, y, z

def generate_surface_mesh(umin, umax, vmin, vmax, step):
    """Generate a mesh using numpy and the trig_surface function."""
    u = np.arange(umin, umax, step)
    v = np.arange(vmin, vmax, step)
    U, V = np.meshgrid(u, v)
    X, Y, Z = trig_surface(U, V)

    faces = []
    vertices = []
    for i in range(len(u) - 1):
        for j in range(len(v) - 1):
            pt1 = Rhino.Geometry.Point3d(X[i][j], Y[i][j], Z[i][j])
            pt2 = Rhino.Geometry.Point3d(X[i + 1][j], Y[i + 1][j], Z[i + 1][j])
            pt3 = Rhino.Geometry.Point3d(X[i + 1][j + 1], Y[i + 1][j + 1], Z[i + 1][j + 1])
            pt4 = Rhino.Geometry.Point3d(X[i][j + 1], Y[i][j + 1], Z[i][j + 1])

            vertices.extend([pt1, pt2, pt3, pt4])
            faces.append([len(vertices) - 4, len(vertices) - 3, len(vertices) - 2, len(vertices) - 1])
    
    mesh = Rhino.Geometry.Mesh()
    for v in vertices:
        mesh.Vertices.Add(v)
    for f in faces:
        mesh.Faces.AddFace(f[0], f[1], f[2], f[3])
    return mesh

def intersect_mesh_with_planes(mesh, plane_count, spacing):
    """Intersect the mesh with a set of vertical planes."""
    intersections = []
    for i in range(plane_count):
        plane = Rhino.Geometry.Plane(Rhino.Geometry.Point3d(i * spacing, 0, 0), Rhino.Geometry.Vector3d.ZAxis)
        intersection_curves = Rhino.Geometry.Intersect.Intersection.MeshPlane(mesh, plane)
        if intersection_curves:
            intersections.extend(intersection_curves)
            
    # Debugging: Print the number of intersections found
    print(f"Found {len(intersections)} intersection curves.")
    return intersections

def main(umin, umax, vmin, vmax, step, plane_count, plane_spacing, length_threshold):
    # Generate a mesh from the trigonometric surface
    mesh = generate_surface_mesh(umin, umax, vmin, vmax, step)
    
    # Intersect the mesh with planes
    curves = intersect_mesh_with_planes(mesh, plane_count, plane_spacing)
    
    # Remove curves with length less than the threshold
    for curve in curves[:]:
        if curve.Length < length_threshold:
            curves.remove(curve)
    
    return mesh, curves

# Call the main function with input parameters from Grasshopper
result_mesh, result_curves = main(umin, umax, vmin, vmax, step, plane_count, plane_spacing, length_threshold)

# Output the results to Grasshopper's Python node
out_mesh = result_mesh
out_curves = result_curves
# ---------- end list_remove_3 ----------
panel_10 = Panel(entwine)  # disabled
panel_11 = Panel(list_remove_2.result_boxes)  # disabled
mesh_2 = Mesh(list_remove_3.out_mesh)
curve_2 = Curve(list_remove_3.out_curves)
panel_12 = Panel(list_remove_3.out)
entwine_2 = Entwine(Branch00=mesh_2, Branch01=curve_2, FlattenInputs=True)
panel_13 = Panel(entwine_2)
