# Grasshopper definition 013_List_reversing.gh (Grasshopper 1.0.7)
# plug-ins: RhinoCodePluginGH

# ----
# Oscillation Algorithm
# The oscillation algorithm can be use to animate
# any geometry that is driven by a number sliders.
# Simply swap out the number sliders at the
# multiplication node in the oscillation script.
panel = Panel("1")  # disabled
trigger = Trigger(Interval=20, TimerInterval=20, Target=data_recorder)  # disabled
data_recorder = DataRecorder(panel, DataLimit=-10, RecordData=False)  # disabled
number_slider = Slider(166, range=0..1000)  # disabled
list_length = ListLength(List=data_recorder)  # disabled
division = Division(A=list_length, B=number_slider)  # disabled
cosine = Cosine(Value=division)  # disabled
sine = Sine(Value=division)  # disabled
panel_2 = Panel([sine, cosine])  # disabled
# Alright, let's get creative.
# 
# Here's a Python script using numpy and
# Rhino.Geometry to create a geometric model
# using trigonometric polynomial functions. We will
# create a wavy lattice structure where the height
# of each point on the lattice is dictated by a
# trigonometric function of its x, y coordinates. The
#  reverse() function will be used to flip certain
# arrangements of the pipes, creating a variation
# in the final design:
multiplication = Multiplication(A=sine)  # disabled
multiplication_2 = Multiplication(A=cosine)  # disabled
multiplication_3 = Multiplication(A=sine)  # disabled
multiplication_4 = Multiplication(A=cosine)  # disabled
multiplication_5 = Multiplication(A=cosine)  # disabled

# ----
# gpt-4 Initial Response
# Creating a 3D model using a container data
# structure and leveraging the reverse() function,
# along with the Rhino Common API for
# Grasshopper in Rhino8WIP, can be a complex
# task based on the vagueness of your request.
# However, I will provide a simple example to give
# you a starting point.
number_slider_2 = Slider(3, range=0..10)  # disabled
number_slider_3 = Slider(3, range=0..10)  # disabled
number_slider_4 = Slider(3, range=0..10)  # disabled
number_slider_5 = Slider(5.53, range=0..10)  # disabled
# 2nd gpt-4 Text Prompt
# Great, now create a much more complex model
# with complex trigonometric polynomials and the
# NUMPY python library. And be sure to use the
# List remove() function  several times.
# gpt-4 2nd Response
number_slider_6 = Slider(0.48, range=0..2)  # disabled

# ----
# #The Numpy Array:
# A Multidimensional Array Object
# test_random
number_slider_7 = Slider(4, range=0..4)  # disabled
number_slider_8 = Slider(5, range=0..20)  # disabled
numpy = Script(rows=number_slider_7, columns=number_slider_8)  # -> out, a, arr0_OUT, arr1_OUT, arr2_OUT, arr3_OUT; inputs rows: Int32, columns: Int32; disabled
# ---------- numpy: Python ----------
"""Grasshopper Script"""
#! python 3
a = "Welcome to Wickerson Studios!"
print(a)

# r: numpy

import numpy

arr = numpy.random.rand(rows, columns)

print(arr)
print(type(arr))
arr = arr.tolist()
print(arr)

arr_OUT = [arr[i] if i < rows else False for i in range(4)]
arr0_OUT, arr1_OUT, arr2_OUT, arr3_OUT = arr_OUT
# ---------- end numpy ----------
panel_3 = Panel(numpy.a)  # disabled
number = Number(numpy.arr0_OUT)  # disabled
# 002 Python Refresher
# Container Data Structures
# List reverse() function
# gpt-4 Text Prompt
# Create a geometric 3D model with
# 
# Container Data Structures
# with
# List reverse() function
# 
# in python 3 code for the python 3 script
# node in grasshopper for Rhino8WIP using the
# 
# Rhino Common API.
# 
# Output the parts of the model in different
# variable outputs in the python 3 node in
# grasshopper.
panel_4 = Panel(number)  # disabled
number_2 = Number(numpy.arr1_OUT)  # disabled
panel_5 = Panel(number_2)  # disabled
number_3 = Number(numpy.arr2_OUT)  # disabled
panel_6 = Panel(number_3)  # disabled
number_4 = Number(numpy.arr3_OUT)  # disabled
number_slider_9 = Slider(10, range=0..100)  # disabled
panel_7 = Panel(number_4)  # disabled
multiplication_6 = Multiplication(A=number, B=number_slider_9)  # disabled
multiplication_7 = Multiplication(A=number_2, B=number_slider_9)  # disabled
construct_point = ConstructPoint(XCoordinate=multiplication_6, YCoordinate=graft(multiplication_6), ZCoordinate=0)  # disabled
construct_point_2 = ConstructPoint(XCoordinate=multiplication_6, YCoordinate=graft(multiplication_6), ZCoordinate=multiplication_7)  # disabled
unit_x = UnitX(Factor=number_3)  # disabled
line = Line(StartPoint=construct_point, EndPoint=construct_point_2)  # disabled
move = Move(Geometry=line, Motion=unit_x)  # -> Geometry, Transform; disabled
list_item = ListItem(List=graft(line), Index=0, Wrap=True)  # disabled
list_item_2 = ListItem(List=graft(move.Geometry), Index=0, Wrap=True)  # disabled
unit_y = UnitY(Factor=number_4)  # disabled
loft = Loft(
    Curves=[list_item, list_item_2],
    Options={Adjust=False, Closed=False, LoftEnds=0, LoftSimp=0, LoftType=0, Rebuild=10, Refit=0.01})  # disabled
extrude = Extrude(Base=loft, Direction=graft(unit_y))  # disabled

list_reverse = Script(
    x_slider=number_slider_2,
    y_slider=number_slider_3,
    z_slider=number_slider_4,
    spacing_slider=number_slider_5,
    radius_slider=number_slider_6)  # -> out, lattice_output; inputs x_slider: Int32, y_slider: Int32, z_slider: Int32, spacing_slider: Double, radius_slider: Double; disabled
# ---------- list_reverse: Python ----------
import Rhino.Geometry as rg

def create_tube(p0, p1, radius):
    """Generate a cylindrical tube between two points."""
    line = rg.Line(p0, p1)
    circle = rg.Circle(p0, radius)
    height = line.Length
    cylinder = rg.Cylinder(circle, height)
    return rg.Brep.CreateFromCylinder(cylinder, False, False)

def main(x_count, y_count, z_count, spacing, tube_radius):

    breps = []

    # Create tubes in the X-direction
    x_range = list(range(x_count))
    y_range = list(range(y_count))
    z_range = list(range(z_count - 1))
    x_range.reverse()
    for i in x_range:
        for j in y_range:
            for k in z_range:
                p0 = rg.Point3d(i * spacing, j * spacing, k * spacing)
                p1 = rg.Point3d(i * spacing, j * spacing, (k+1) * spacing)
                breps.append(create_tube(p0, p1, tube_radius))

    # Create tubes in the Y-direction
    x_range = list(range(x_count - 1))
    z_range = list(range(z_count))
    x_range.reverse()
    for i in x_range:
        for j in y_range:
            for k in z_range:
                p0 = rg.Point3d(i * spacing, j * spacing, k * spacing)
                p1 = rg.Point3d((i+1) * spacing, j * spacing, k * spacing)
                breps.append(create_tube(p0, p1, tube_radius))

    # Create tubes in the Z-direction
    x_range = list(range(x_count))
    y_range = list(range(y_count - 1))
    x_range.reverse()
    y_range.reverse()
    for i in x_range:
        for j in y_range:
            for k in z_range:
                p0 = rg.Point3d(i * spacing, j * spacing, k * spacing)
                p1 = rg.Point3d(i * spacing, (j+1) * spacing, k * spacing)
                breps.append(create_tube(p0, p1, tube_radius))

    return breps

# Inputs for Grasshopper
# For these inputs, you'd connect Grasshopper components, like sliders.
x_count = x_slider # Connect this to a Grasshopper integer slider (e.g. 1 to 10)
y_count = y_slider # Connect this to a Grasshopper integer slider (e.g. 1 to 10)
z_count = z_slider # Connect this to a Grasshopper integer slider (e.g. 1 to 10)
spacing = spacing_slider # Connect this to a Grasshopper number slider (e.g. 1.0 to 5.0)
tube_radius = radius_slider # Connect this to a Grasshopper number slider (e.g. 0.1 to 1.0)

# Outputs for Grasshopper
lattice_output = main(x_count, y_count, z_count, spacing, tube_radius)
# ---------- end list_reverse ----------
list_reverse_2 = Script(
    x_slider=Slider(6, range=0..10),
    y_slider=Slider(10, range=0..10),
    spacing_slider=Slider(6.54, range=0..10),
    radius_slider=Slider(1.08, range=0..10),
    coeff_slider_1=Slider(3.24, range=0..10),
    coeff_slider_2=Slider(4.16, range=0..10),
    coeff_slider_3=Slider(3.12, range=0..10))  # -> reverse(out), lattice_output; inputs x_slider: Int32, y_slider: Int32, spacing_slider: Double, radius_slider: Double, coeff_slider_1: Double, coeff_slider_2: Double, coeff_slider_3: Double
# ---------- list_reverse_2: Python ----------
# r: numpy

import Rhino.Geometry as rg
import numpy as np

def create_tube(p0, p1, radius):
    """Generate a cylindrical tube between two points."""
    line = rg.Line(p0, p1)
    circle = rg.Circle(p0, radius)
    height = line.Length
    cylinder = rg.Cylinder(circle, height)
    return rg.Brep.CreateFromCylinder(cylinder, False, False)

def trig_function(x, y, coeffs):
    """Compute a trigonometric polynomial function."""
    value = 0
    n = len(coeffs)
    for i in range(n):
        value += coeffs[i] * np.sin((i+1) * x) * np.cos((i+1) * y)
    return value

def main(x_count, y_count, spacing, tube_radius, coeffs):
    breps = []

    # Calculate heights based on trigonometric polynomial
    heights = np.zeros((x_count, y_count))
    for i in range(x_count):
        for j in range(y_count):
            heights[i,j] = trig_function(i, j, coeffs)

    # Create tubes between points
    for i in range(x_count - 1):
        for j in range(y_count - 1):
            p0 = rg.Point3d(i * spacing, j * spacing, heights[i, j] * spacing)
            p1 = rg.Point3d((i+1) * spacing, (j+1) * spacing, heights[i+1, j+1] * spacing)
            breps.append(create_tube(p0, p1, tube_radius))
            
            if i % 2 == 0:  # Use reverse on even columns
                p0, p1 = p1, p0
            breps.append(create_tube(p0, p1, tube_radius))

    return breps

# Inputs for Grasshopper

x_count = x_slider
y_count = y_slider
spacing = spacing_slider
tube_radius = radius_slider
coeffs = [coeff_slider_1, coeff_slider_2, coeff_slider_3]  # Use three sliders for coefficients


# Outputs for Grasshopper
lattice_output = main(x_count, y_count, spacing, tube_radius, coeffs)
# ---------- end list_reverse_2 ----------
panel_8 = Panel(list_reverse.out)  # disabled
panel_9 = Panel(list_reverse_2.out)
panel_10 = Panel(list_reverse_2.lattice_output)
panel_11 = Panel(list_reverse.lattice_output)  # disabled
