# Grasshopper definition 014_List_sort.gh (Grasshopper 1.0.7)
# plug-ins: RhinoCodePluginGH

number_slider = Slider(10, range=0..10)

# ----
# Oscillation Algorithm
# The oscillation algorithm can be use to animate
# any geometry that is driven by a number sliders.
# Simply swap out the number sliders at the
# multiplication node in the oscillation script.
panel = Panel("1")
trigger = Trigger(Interval=20, TimerInterval=20, Target=data_recorder)
data_recorder = DataRecorder(panel, DataLimit=-10, RecordData=False)
list_length = ListLength(List=data_recorder)
division = Division(A=list_length, B=Slider(588, range=0..1000))
cosine = Cosine(Value=division)
sine = Sine(Value=division)
panel_2 = Panel([sine, cosine])
multiplication = Multiplication(A=cosine, B=Slider(1, range=0..1))
multiplication_2 = Multiplication(A=sine, B=Slider(10, range=0..10))
# gpt-4 2nd Response
# Certainly, let's create a more intricate design
# using the numpy library along with trigonometric
# polynomials.
# 
# In this example, I'll generate a series of points
# based on trigonometric polynomials, then sort
# and manipulate them in a complex fashion to
# generate an interesting geometric structure.
# 
# Model Concept:
# 
# Use a trigonometric polynomial to generate a
# set of points.
# Sort them based on their Z-values and apply
# transformations.
# Extrude a polyline formed from these points to
# create a surface.
multiplication_3 = Multiplication(A=sine, B=number_slider)
multiplication_4 = Multiplication(A=cosine, B=Slider(10, range=0..10))
multiplication_5 = Multiplication(A=cosine, B=Slider(1, range=0..1))
multiplication_6 = Multiplication(A=cosine, B=Slider(10, range=0..10))
multiplication_7 = Multiplication(A=cosine, B=Slider(1, range=0..1))

number_slider_2 = Slider(2, range=0..10)  # disabled
number_slider_3 = Slider(5, range=0..10)  # disabled
number_slider_4 = Slider(8, range=0..10)  # disabled
number_slider_5 = Slider(6, range=0..10)  # disabled
number_slider_6 = Slider(2, range=0..10)  # disabled
number_slider_7 = Slider(5, range=0..10)  # disabled
number_slider_8 = Slider(1, range=0..10)  # disabled
number_slider_9 = Slider(0, range=0..10)  # disabled
number_slider_10 = Slider(7, range=0..10)  # disabled
number_slider_11 = Slider(4, range=0..10)  # disabled
number_slider_12 = Slider(7, range=0..10)  # disabled
number_slider_13 = Slider(4, range=0..10)  # disabled
number_slider_14 = Slider(0.73, range=0..1)  # disabled
number_slider_15 = Slider(1, range=0..1)  # disabled
# 2nd gpt-4 Text Prompt
# Great, now create a much more complex model
# with complex trigonometric polynomials and the
# NUMPY python library. And be sure to use the
# List sort() function  several times.
number_slider_16 = Slider(1, range=0..1)  # disabled

# ----
# #The Numpy Array:
# A Multidimensional Array Object
# test_random
number_slider_17 = Slider(4, range=0..4)  # disabled
number_slider_18 = Slider(5, range=0..20)  # disabled
numpy = Script(rows=number_slider_17, columns=number_slider_18)  # -> out, a, arr0_OUT, arr1_OUT, arr2_OUT, arr3_OUT; inputs rows: Int32, columns: Int32; disabled
# ---------- numpy: Python ----------
"""Grasshopper Script"""
#! python 3
a = "Welcome to Wickerson Studios!"
print(a)

# r: numpy

import numpy

arr = numpy.random.rand(rows, columns)

print(arr)
print(type(arr))
arr = arr.tolist()
print(arr)

arr_OUT = [arr[i] if i < rows else False for i in range(4)]
arr0_OUT, arr1_OUT, arr2_OUT, arr3_OUT = arr_OUT
# ---------- end numpy ----------
panel_3 = Panel(numpy.a)  # disabled
number = Number(numpy.arr0_OUT)  # disabled
# 002 Python Refresher
# Container Data Structures
# List sort() function
# gpt-4 Text Prompt
# Create a geometric 3D model with
# 
# Container Data Structures
# with
# List sort() function
# 
# in python 3 code for the python 3 script
# node in grasshopper for Rhino8WIP using the
# 
# Rhino Common API.
# 
# Output the parts of the model in different
# variable outputs in the python 3 node in
# grasshopper.
panel_4 = Panel(number)  # disabled
number_2 = Number(numpy.arr1_OUT)  # disabled
panel_5 = Panel(number_2)  # disabled
number_3 = Number(numpy.arr2_OUT)  # disabled
panel_6 = Panel(number_3)  # disabled
number_4 = Number(numpy.arr3_OUT)  # disabled
number_slider_19 = Slider(10, range=0..100)  # disabled
panel_7 = Panel(number_4)  # disabled
multiplication_8 = Multiplication(A=number, B=number_slider_19)  # disabled
multiplication_9 = Multiplication(A=number_2, B=number_slider_19)  # disabled
construct_point = ConstructPoint(XCoordinate=multiplication_8, YCoordinate=graft(multiplication_8), ZCoordinate=0)  # disabled
construct_point_2 = ConstructPoint(XCoordinate=multiplication_8, YCoordinate=graft(multiplication_8), ZCoordinate=multiplication_9)  # disabled
unit_x = UnitX(Factor=number_3)  # disabled
line = Line(StartPoint=construct_point, EndPoint=construct_point_2)  # disabled
move = Move(Geometry=line, Motion=unit_x)  # -> Geometry, Transform; disabled
list_item = ListItem(List=graft(line), Index=0, Wrap=True)  # disabled
list_item_2 = ListItem(List=graft(move.Geometry), Index=0, Wrap=True)  # disabled
unit_y = UnitY(Factor=number_4)  # disabled
loft = Loft(
    Curves=[list_item, list_item_2],
    Options={Adjust=False, Closed=False, LoftEnds=0, LoftSimp=0, LoftType=0, Rebuild=10, Refit=0.01})  # disabled
extrude = Extrude(Base=loft, Direction=graft(unit_y))  # disabled

# ----
# gpt-4 Initial Response
# To create a geometric 3D model using the
# Rhino Common API in a Python script for
# Grasshopper in Rhino 8 WIP, you will use
# various data structures and the List's sort()
# function to help organize and process your data.
# 
# Below is a simple example that will:
# 
# Create a list of 3D points.
# Sort these points based on their z-values.
# Create a polyline from the sorted points.
# Extrude the polyline into a surface.
construct_point_3 = ConstructPoint(XCoordinate=number_slider_2, YCoordinate=number_slider_3, ZCoordinate=number_slider_4)  # disabled
construct_point_4 = ConstructPoint(XCoordinate=number_slider_5, YCoordinate=number_slider_6, ZCoordinate=number_slider_7)  # disabled
construct_point_5 = ConstructPoint(XCoordinate=number_slider_8, YCoordinate=number_slider_9, ZCoordinate=number_slider_10)  # disabled
construct_point_6 = ConstructPoint(XCoordinate=number_slider_11, YCoordinate=number_slider_12, ZCoordinate=number_slider_13)  # disabled
vector_xyz = VectorXYZ(XComponent=number_slider_14, YComponent=number_slider_15, ZComponent=number_slider_16)  # -> Vector, Length; disabled
vector_xyz_2 = VectorXYZ(XComponent=multiplication, YComponent=multiplication_5, ZComponent=multiplication_7)  # -> Vector, Length
list_sort = Script(pt1=construct_point_3, pt2=construct_point_4, pt3=construct_point_5, pt4=construct_point_6, dir=vector_xyz.Vector)  # -> out, sortedPoints, sortedPolyline, extrudedSurface; inputs pt1: Point3d, pt2: Point3d, pt3: Point3d, pt4: Point3d, dir: Vector3d; disabled
# ---------- list_sort: Python ----------
import Rhino.Geometry as rg

def main():
    # 1. Create a list of 3D points.
    points = [pt1, pt2, pt3, pt4]
    
    # 2. Sort these points based on their z-values.
    points.sort(key=lambda pt: pt.Z)
    
    # 3. Create a polyline from the sorted points.
    polyline = rg.Polyline(points)
    
    # Check if the polyline is closed, if not, add the first point to close it.
    if not polyline.IsClosed:
        polyline.Add(polyline[0])
    
    # 4. Extrude the polyline into a surface.
    curve = polyline.ToNurbsCurve()
    direction = dir
    surface = rg.Surface.CreateExtrusion(curve, direction)
    
    # Outputs
    return points, polyline, surface

# Execute main function and assign results to Grasshopper outputs
sorted_points, sorted_polyline, extruded_surface = main()

# Assign to the Grasshopper component outputs (In Grasshopper script component, name outputs: sortedPoints, sortedPolyline, extrudedSurface)
sortedPoints = sorted_points
sortedPolyline = sorted_polyline.ToNurbsCurve()  # Explicitly converting the polyline to a curve for Grasshopper output.
extrudedSurface = extruded_surface
# ---------- end list_sort ----------
list_sort_2 = Script(
    size=Slider(10, range=0..10),
    A=number_slider,
    B=multiplication_6,
    C=multiplication_2,
    ptCount=Slider(10, range=0..20),
    E=multiplication_4,
    dir=vector_xyz_2.Vector)  # -> out, sortedPoints, sortedPolyline, extrudedSurface; inputs size: Double, A: Double, B: Double, C: Double, ptCount: Int32, E: Double, dir: Vector3d
# ---------- list_sort_2: Python ----------
import Rhino.Geometry as rg

import Rhino.Geometry as rg
import numpy as np

def generate_points(count=100):
    """Generate a set of 3D points based on trigonometric polynomials."""
    x = np.linspace(0, size, count)
    y = np.sin(x) + np.sin(A*x) + np.cos(B*x)
    z = np.cos(x) + np.sin(C*x)
    return [rg.Point3d(x[i], y[i], z[i]) for i in range(count)]

def main(points, direction_vector):
    # Sort these points based on their z-values.
    points.sort(key=lambda pt: pt.Z)

    # Use numpy to apply transformations. Increase the Z value using a sine wave for added complexity.
    for i, pt in enumerate(points):
        pt.Z += E * np.sin(0.5 * i)

    # Sort points based on their y-values for additional manipulation.
    points.sort(key=lambda pt: pt.Y)

    # Create a polyline from the transformed points.
    polyline = rg.Polyline(points)

    # Check if the polyline is closed, if not, add the first point to close it.
    if not polyline.IsClosed:
        polyline.Add(polyline[0])

    # Extrude the polyline to form a surface.
    curve = polyline.ToNurbsCurve()
    surface = rg.Surface.CreateExtrusion(curve, direction_vector)

    return points, polyline, surface

# Generate a set of points based on trigonometric polynomials.
input_points = generate_points(ptCount)

# Set a direction for extrusion.
direction_vector = dir

# Execute the main function and assign results to Grasshopper outputs.
sorted_points, sorted_polyline, extruded_surface = main(input_points, direction_vector)

# Assign to the Grasshopper component outputs (In Grasshopper script component, name outputs: sortedPoints, sortedPolyline, extrudedSurface)
sortedPoints = sorted_points
sortedPolyline = sorted_polyline.ToNurbsCurve() if sorted_polyline else None  # Convert polyline to curve for output.
extrudedSurface = extruded_surface
# ---------- end list_sort_2 ----------
panel_8 = Panel(list_sort.out)  # disabled
point = Point(list_sort.sortedPoints)  # disabled
curve = Curve(list_sort.sortedPolyline)  # disabled
surface = Surface(list_sort.extrudedSurface)  # disabled
entwine = Entwine(Branch00=point, Branch01=curve, Branch02=surface, FlattenInputs=True)  # disabled
entwine_2 = Entwine(
    Branch00=list_sort_2.sortedPoints,
    Branch01=list_sort_2.sortedPolyline,
    Branch02=list_sort_2.extrudedSurface,
    FlattenInputs=True)
panel_9 = Panel(entwine)  # disabled
panel_10 = Panel(entwine_2)
