# Grasshopper definition 015_List_indexing_elements.gh (Grasshopper 1.0.7)
# plug-ins: RhinoCodePluginGH

number_slider = Slider(10, range=0..10)  # disabled
number_slider_2 = Slider(10, range=0..20)  # disabled
number_slider_3 = Slider(10, range=0..10)  # disabled
number_slider_4 = Slider(10, range=0..10)  # disabled
number_slider_5 = Slider(10, range=0..10)  # disabled
number_slider_6 = Slider(1, range=0..1)  # disabled
number_slider_7 = Slider(1, range=0..1)  # disabled
number_slider_8 = Slider(1, range=0..1)  # disabled

# ----
# Oscillation Algorithm
# The oscillation algorithm can be use to animate
# any geometry that is driven by a number sliders.
# Simply swap out the number sliders at the
# multiplication node in the oscillation script.
panel = Panel("1")  # disabled
trigger = Trigger(Interval=20, TimerInterval=20, Target=data_recorder)  # disabled
data_recorder = DataRecorder(panel, DataLimit=-10, RecordData=False)  # disabled
number_slider_9 = Slider(588, range=0..1000)  # disabled
list_length = ListLength(List=data_recorder)  # disabled
division = Division(A=list_length, B=number_slider_9)  # disabled
cosine = Cosine(Value=division)  # disabled
sine = Sine(Value=division)  # disabled
panel_2 = Panel([sine, cosine])  # disabled
multiplication = Multiplication(A=cosine, B=number_slider_6)  # disabled
multiplication_2 = Multiplication(A=sine, B=number_slider_5)  # disabled
# gpt-4 2nd Response
# Creating a complex 3D model in Grasshopper
# using Python, Rhino Common API, and numpy
# can involve a wide array of methodologies and
# creative ideas. Let's use numpy to create a
# mesh that's defined by a complex trigonometric
# polynomial.
# 
# For this example, let's design a surface based
# on the following equation:
# 
# z=sin(x)×cos(y)+sin(y)×cos(x)
multiplication_3 = Multiplication(A=sine, B=number_slider)  # disabled
multiplication_4 = Multiplication(A=cosine, B=number_slider_3)  # disabled
multiplication_5 = Multiplication(A=cosine, B=number_slider_7)  # disabled
multiplication_6 = Multiplication(A=cosine, B=number_slider_4)  # disabled
multiplication_7 = Multiplication(A=cosine, B=number_slider_8)  # disabled

# ----
# #The Numpy Array:
# A Multidimensional Array Object
# test_random
number_slider_10 = Slider(4, range=0..4)  # disabled
number_slider_11 = Slider(5, range=0..20)  # disabled
numpy = Script(rows=number_slider_10, columns=number_slider_11)  # -> out, a, arr0_OUT, arr1_OUT, arr2_OUT, arr3_OUT; inputs rows: Int32, columns: Int32; disabled
# ---------- numpy: Python ----------
"""Grasshopper Script"""
#! python 3
a = "Welcome to Wickerson Studios!"
print(a)

# r: numpy

import numpy

arr = numpy.random.rand(rows, columns)

print(arr)
print(type(arr))
arr = arr.tolist()
print(arr)

arr_OUT = [arr[i] if i < rows else False for i in range(4)]
arr0_OUT, arr1_OUT, arr2_OUT, arr3_OUT = arr_OUT
# ---------- end numpy ----------
panel_3 = Panel(numpy.a)  # disabled
number = Number(numpy.arr0_OUT)  # disabled
# 002 Python Refresher
# Container Data Structures
# List indexing elements
# gpt-4 Text Prompt
# Create a geometric 3D model with
# 
# Container Data Structures
# with
# List indexing elements
# 
# in python 3 code for the python 3 script
# node in grasshopper for Rhino8WIP using the
# 
# Rhino Common API.
# 
# Output the parts of the model in different
# variable outputs in the python 3 node in
# grasshopper.
panel_4 = Panel(number)  # disabled
number_2 = Number(numpy.arr1_OUT)  # disabled
panel_5 = Panel(number_2)  # disabled
number_3 = Number(numpy.arr2_OUT)  # disabled
panel_6 = Panel(number_3)  # disabled
number_4 = Number(numpy.arr3_OUT)  # disabled
number_slider_12 = Slider(10, range=0..100)  # disabled
panel_7 = Panel(number_4)  # disabled
multiplication_8 = Multiplication(A=number, B=number_slider_12)  # disabled
multiplication_9 = Multiplication(A=number_2, B=number_slider_12)  # disabled
construct_point = ConstructPoint(XCoordinate=multiplication_8, YCoordinate=graft(multiplication_8), ZCoordinate=0)  # disabled
construct_point_2 = ConstructPoint(XCoordinate=multiplication_8, YCoordinate=graft(multiplication_8), ZCoordinate=multiplication_9)  # disabled
unit_x = UnitX(Factor=number_3)  # disabled
line = Line(StartPoint=construct_point, EndPoint=construct_point_2)  # disabled
move = Move(Geometry=line, Motion=unit_x)  # -> Geometry, Transform; disabled
list_item = ListItem(List=graft(line), Index=0, Wrap=True)  # disabled
list_item_2 = ListItem(List=graft(move.Geometry), Index=0, Wrap=True)  # disabled
unit_y = UnitY(Factor=number_4)  # disabled
loft = Loft(
    Curves=[list_item, list_item_2],
    Options={Adjust=False, Closed=False, LoftEnds=0, LoftSimp=0, LoftType=0, Rebuild=10, Refit=0.01})  # disabled
extrude = Extrude(Base=loft, Direction=graft(unit_y))  # disabled

number_slider_13 = Slider(-10, range=-10..10.01)  # disabled
# be sure to explicitly use the index() function in the script
# 
# Now, when you run this script in Grasshopper,
# output a will be the mesh, while output b will be
# the index of the first Z value greater than 1 in
# the flattened list.
number_slider_14 = Slider(10, range=0..10)  # disabled
# gpt-4 Initial Response
# Creating a geometric 3D model in Grasshopper
# for Rhino using the Rhino Common API and
# Python involves several steps. For simplicity, I'll
# demonstrate how to create a basic geometric
# model using Python within a Grasshopper node.
# In this example, we'll use a list of points and
# then create lines between these points.
# 2nd gpt-4 Text Prompt
# Great, now create a much more complex model
# with complex trigonometric polynomials and the
# NUMPY python library. And be sure to use the
# List indexing elements  several times.
list_indexing = Script()  # -> out, a, b; inputs pt1: Point3d, pt2: Point3d, pt3: Point3d, pt4: Point3d, dir: Vector3d; disabled
# ---------- list_indexing: Python ----------
import Rhino.Geometry as rg

def main():
    # List of points
    points = [
        rg.Point3d(0,0,0),
        rg.Point3d(10,0,0),
        rg.Point3d(10,10,0),
        rg.Point3d(0,10,0),
        rg.Point3d(5,5,10)
    ]
    
    # Using list indexing to connect points with lines
    lines = [
        rg.Line(points[0], points[1]),
        rg.Line(points[1], points[2]),
        rg.Line(points[2], points[3]),
        rg.Line(points[3], points[0]),
        rg.Line(points[0], points[4]),
        rg.Line(points[1], points[4]),
        rg.Line(points[2], points[4]),
        rg.Line(points[3], points[4])
    ]
    
    return points, lines

# Call the main function and assign results to the output
points_out, lines_out = main()

# Output the parts of the model
a = points_out
b = lines_out
# ---------- end list_indexing ----------
number_slider_15 = Slider(-4.74, range=-10..10)  # disabled
number_slider_16 = Slider(6, range=0..10)  # disabled
number_slider_17 = Slider(-1.99, range=-10..10)  # disabled
panel_8 = Panel(list_indexing.out)  # disabled
point = Point(list_indexing.a)  # disabled
curve = Curve(list_indexing.b)  # disabled
construct_domain = ConstructDomain(DomainStart=Slider(-10, range=-10..10.01), DomainEnd=Slider(10, range=0..10))
construct_domain_2 = ConstructDomain(DomainStart=number_slider_13, DomainEnd=number_slider_14)  # disabled
entwine = Entwine(Branch00=point, Branch01=curve, FlattenInputs=True)  # disabled
list_indexing_2 = Script(
    domainXY=construct_domain,
    resolution=Slider(10, range=0..10),
    multiplier_sin=Slider(0.76, range=-10..10),
    multiplier_cos=Slider(-1.99, range=-10..10))  # -> out, a, b; inputs resolution: Int32, multiplier_sin: Double, multiplier_cos: Double
# ---------- list_indexing_2: Python ----------
import Rhino.Geometry as rg
import numpy as np

def main(domainXY, resolution, multiplier_sin, multiplier_cos):
    x = np.linspace(domainXY.T0, domainXY.T1, resolution)  
    y = np.linspace(domainXY.T0, domainXY.T1, resolution)
    X, Y = np.meshgrid(x, y)
    Z = multiplier_sin * np.sin(X) * np.cos(Y) + multiplier_cos * np.sin(Y) * np.cos(X)

    points = []
    for i in range(X.shape[0]):
        row_points = []
        for j in range(X.shape[1]):
            pt = rg.Point3d(X[i, j], Y[i, j], Z[i, j])
            row_points.append(pt)
        points.append(row_points)

    mesh = rg.Mesh()
    for row in points:
        for pt in row:
            mesh.Vertices.Add(pt)

    for i in range(len(points) - 1):
        for j in range(len(points[i]) - 1):
            mesh.Faces.AddFace(i + j*len(points), i + 1 + j*len(points), i + 1 + (j + 1)*len(points), i + (j + 1)*len(points))

    # Flatten the Z array, convert it to list, and use index() to find the position of the first value greater than 1
    Z_list = Z.flatten().tolist()
    try:
        index_val = Z_list.index(next(filter(lambda x: x > 1, Z_list)))
    except StopIteration:
        index_val = None

    return mesh, index_val

# Call the main function and assign results to the output
a, b = main(domainXY, resolution, multiplier_sin, multiplier_cos)
# ---------- end list_indexing_2 ----------
list_indexing_3 = Script(
    domainXY=construct_domain_2,
    resolution=number_slider_16,
    multiplier_sin=number_slider_17,
    multiplier_cos=number_slider_15)  # -> out, a; inputs resolution: Int32, multiplier_sin: Double, multiplier_cos: Double; disabled
# ---------- list_indexing_3: Python ----------
import Rhino.Geometry as rg
import numpy as np

def main(domainXY, resolution, multiplier_sin, multiplier_cos):
    # Define the range based on the domain provided and resolution
    x = np.linspace(domainXY.T0, domainXY.T1, resolution)  
    y = np.linspace(domainXY.T0, domainXY.T1, resolution)

    # Create a grid of points using numpy's meshgrid
    X, Y = np.meshgrid(x, y)
    
    # Adjust the trigonometric polynomial using the multipliers
    Z = multiplier_sin * np.sin(X) * np.cos(Y) + multiplier_cos * np.sin(Y) * np.cos(X)

    # Create a list to store Rhino point objects
    points = []

    for i in range(X.shape[0]):
        row_points = []
        for j in range(X.shape[1]):
            pt = rg.Point3d(X[i, j], Y[i, j], Z[i, j])
            row_points.append(pt)
        points.append(row_points)

    # Create a mesh
    mesh = rg.Mesh()

    # Add the vertices to the mesh
    for row in points:
        for pt in row:
            mesh.Vertices.Add(pt)

    # Create the mesh faces
    for i in range(len(points) - 1):
        for j in range(len(points[i]) - 1):
            mesh.Faces.AddFace(i + j*len(points), i + 1 + j*len(points), i + 1 + (j + 1)*len(points), i + (j + 1)*len(points))

    return mesh

# Call the main function and assign results to the output
a = main(domainXY, resolution, multiplier_sin, multiplier_cos)
# ---------- end list_indexing_3 ----------
panel_9 = Panel(entwine)  # disabled
panel_10 = Panel(list_indexing_2.out)
panel_11 = Panel(list_indexing_3.out)  # disabled
entwine_2 = Entwine(FlattenInputs=True)  # disabled
entwine_3 = Entwine(Branch00=list_indexing_2.a, Branch01=list_indexing_2.b, FlattenInputs=True)
panel_12 = Panel(entwine_3)
panel_13 = Panel(list_indexing_3.a)  # disabled
