# Grasshopper definition 016_Stacks_append_pop.gh (Grasshopper 1.0.7)
# plug-ins: RhinoCodePluginGH

# ----
# Oscillation Algorithm
# The oscillation algorithm can be use to animate
# any geometry that is driven by a number sliders.
# Simply swap out the number sliders at the
# multiplication node in the oscillation script.
panel = Panel("1")
trigger = Trigger(Interval=20, TimerInterval=20, Target=data_recorder)
data_recorder = DataRecorder(panel, DataLimit=-10, RecordData=False)
list_length = ListLength(List=data_recorder)
division = Division(A=list_length, B=Slider(126, range=0..1000))
cosine = Cosine(Value=division)
sine = Sine(Value=division)
panel_2 = Panel([sine, cosine])
multiplication = Multiplication(A=sine)
multiplication_2 = Multiplication(A=cosine)
multiplication_3 = Multiplication(A=cosine)
multiplication_4 = Multiplication(A=sine, B=Slider(360, range=0..360))

# ----
# To create a geometric 3D model using the
# concept of stacks, let's start by creating a
# Python script that leverages the Rhino Common
# API in a Grasshopper Python node. We'll create
# a simple model by stacking disks on top of each
#  other:
# 
# Use the append() function to add disks
# (cylinders without the top face) to our 3D space.
# Use the pop() function to remove disks from our
#  3D space.
# 2nd gpt-4 Text Prompt
# Great, now create a much more complex model
# with complex trigonometric polynomials and the
# NUMPY python library. And be sure to use the
# Stacks append and pop  several times.
# gpt-4 2nd Response
# Certainly! Let's design a more complex model
# using complex trigonometric polynomials with
# numpy. We'll utilize the stack data structure for
# various components of our model.
# 
# Here's the plan:
# 
# Create a stack of trigonometric curves.
# Using numpy, generate complex trigonometric
# polynomial points for each curve.
# Visualize the curves in Rhino via the
# Grasshopper script node.
# Apply some transformations to these curves,
# pushing them to the stack, and then popping
# them off for further manipulation.
number_slider = Slider(5, range=0..10)

# ----
# #The Numpy Array:
# A Multidimensional Array Object
# test_random
number_slider_2 = Slider(4, range=0..4)  # disabled
number_slider_3 = Slider(5, range=0..20)  # disabled
numpy = Script(rows=number_slider_2, columns=number_slider_3)  # -> out, a, arr0_OUT, arr1_OUT, arr2_OUT, arr3_OUT; inputs rows: Int32, columns: Int32; disabled
# ---------- numpy: Python ----------
"""Grasshopper Script"""
#! python 3
a = "Welcome to Wickerson Studios!"
print(a)

# r: numpy

import numpy

arr = numpy.random.rand(rows, columns)

print(arr)
print(type(arr))
arr = arr.tolist()
print(arr)

arr_OUT = [arr[i] if i < rows else False for i in range(4)]
arr0_OUT, arr1_OUT, arr2_OUT, arr3_OUT = arr_OUT
# ---------- end numpy ----------
panel_3 = Panel(numpy.a)  # disabled
number = Number(numpy.arr0_OUT)  # disabled
# 002 Python Refresher
# Container Data Structures
# Stacks append() and pop() functions
# gpt-4 Text Prompt
# Create a geometric 3D model with
# 
# Container Data Structures
# with
# Stacks append() and pop() functions
# 
# in python 3 code for the python 3 script
# node in grasshopper for Rhino8WIP using the
# 
# Rhino Common API.
# 
# Output the parts of the model in different
# variable outputs in the python 3 node in
# grasshopper.
panel_4 = Panel(number)  # disabled
number_2 = Number(numpy.arr1_OUT)  # disabled
panel_5 = Panel(number_2)  # disabled
number_3 = Number(numpy.arr2_OUT)  # disabled
panel_6 = Panel(number_3)  # disabled
number_4 = Number(numpy.arr3_OUT)  # disabled
number_slider_4 = Slider(10, range=0..100)  # disabled
panel_7 = Panel(number_4)  # disabled
multiplication_5 = Multiplication(A=number, B=number_slider_4)  # disabled
multiplication_6 = Multiplication(A=number_2, B=number_slider_4)  # disabled
construct_point = ConstructPoint(XCoordinate=multiplication_5, YCoordinate=graft(multiplication_5), ZCoordinate=0)  # disabled
construct_point_2 = ConstructPoint(XCoordinate=multiplication_5, YCoordinate=graft(multiplication_5), ZCoordinate=multiplication_6)  # disabled
unit_x = UnitX(Factor=number_3)  # disabled
line = Line(StartPoint=construct_point, EndPoint=construct_point_2)  # disabled
move = Move(Geometry=line, Motion=unit_x)  # -> Geometry, Transform; disabled
list_item = ListItem(List=graft(line), Index=0, Wrap=True)  # disabled
list_item_2 = ListItem(List=graft(move.Geometry), Index=0, Wrap=True)  # disabled
unit_y = UnitY(Factor=number_4)  # disabled
loft = Loft(
    Curves=[list_item, list_item_2],
    Options={Adjust=False, Closed=False, LoftEnds=0, LoftSimp=0, LoftType=0, Rebuild=10, Refit=0.01})  # disabled
extrude = Extrude(Base=loft, Direction=graft(unit_y))  # disabled

stacks_append_pop = Script()  # -> out, a, b, c; disabled
# ---------- stacks_append_pop: Python ----------
import Rhino.Geometry as rg
import numpy as np

class Stack3D:
    def __init__(self):
        self.items = []

    def append(self, item):
        self.items.append(item)

    def pop(self):
        if self.items:
            return self.items.pop()
        else:
            return None

# Initialize our stack
curve_stack = Stack3D()

# Parameters
num_points = 100
num_curves = 5
amplitude = 5

# Create a stack of trigonometric curves
for j in range(num_curves):
    theta = np.linspace(0, 2 * np.pi, num_points)
    x = amplitude * np.sin(j * theta)
    y = amplitude * np.sin(j * theta + np.pi / 4)
    z = amplitude * np.cos(j * theta)

    points = [rg.Point3d(xi, yi, zi) for xi, yi, zi in zip(x, y, z)]
    curve = rg.Curve.CreateInterpolatedCurve(points, 3)
    
    curve_stack.append(curve)

# Pop the top curve, scale it, and then push it back onto the stack
scaled_curve = curve_stack.pop()
if scaled_curve:
    transform = rg.Transform.Scale(rg.Plane.WorldXY, 1.2, 1.2, 1.2)
    scaled_curve.Transform(transform)
    curve_stack.append(scaled_curve)

# Pop another curve, move it, and push it back
translated_curve = curve_stack.pop()
if translated_curve:
    transform = rg.Transform.Translation(10, 10, 0)
    translated_curve.Transform(transform)
    curve_stack.append(translated_curve)

# Set outputs for Grasshopper
all_curves_output = curve_stack.items
scaled_curve_output = scaled_curve
translated_curve_output = translated_curve

# ... [rest of the code remains unchanged]

# Set outputs for Grasshopper
a = curve_stack.items
b = scaled_curve
c = translated_curve
# ---------- end stacks_append_pop ----------
# gpt-4 Initial Response
stacks_append_pop_2 = Script(z_num=number_slider)  # -> out, outputs, popped_output; inputs z_num: Int32
# ---------- stacks_append_pop_2: Python ----------
import Rhino.Geometry as rg

class Stack3D:
    def __init__(self):
        self.items = []

    def isEmpty(self):
        return len(self.items) == 0

    def append(self, item):
        self.items.append(item)

    def pop(self):
        if not self.isEmpty():
            return self.items.pop()
        else:
            return None

    def peek(self):
        if not self.isEmpty():
            return self.items[-1]
        else:
            return None

    def size(self):
        return len(self.items)

# Create a stack instance
stack = Stack3D()

# Add 5 disks to our stack with a base point, radius, and height
for i in range(5):
    base_point = rg.Point3d(0, 0, i*z_num)  # moving up in the Z direction for every new disk
    disk = rg.Cylinder(rg.Circle(base_point, 10), 5).ToBrep(False, True)  # False = no bottom, True = has top
    stack.append(disk)

# Pop a disk off our stack (removing the topmost disk)
removed_disk = stack.pop()

# Set outputs for Grasshopper
outputs = stack.items  # this will output all the disks currently in our stack
popped_output = removed_disk  # this will output the disk we just removed from the stack
# ---------- end stacks_append_pop_2 ----------
geometry = Geometry(stacks_append_pop.b)  # disabled
geometry_2 = Geometry(stacks_append_pop.c)  # disabled
geometry_3 = Geometry(stacks_append_pop.a)  # disabled
panel_8 = Panel(stacks_append_pop.out)  # disabled
panel_9 = Panel(stacks_append_pop_2.out)
geometry_4 = Geometry(stacks_append_pop_2.popped_output)
geometry_5 = Geometry(stacks_append_pop_2.outputs)
stacks_append_pop_3 = Script(
    num_points=Slider(24, range=0..100),
    num_curves=Slider(12, range=0..20),
    amplitude=Slider(10, range=0..10),
    rotation_increment=multiplication_4)  # -> out, a, b, c; inputs num_points: Int32, num_curves: Int32, amplitude: Double, rotation_increment: Double
# ---------- stacks_append_pop_3: Python ----------
import Rhino.Geometry as rg
import numpy as np
import math

class Stack3D:
    def __init__(self):
        self.items = []

    def append(self, item):
        self.items.append(item)

    def pop(self):
        if self.items:
            return self.items.pop()
        else:
            return None

# Initialize our stack
geo_stack = Stack3D()

# Parameters
"""
num_points = 100
num_curves = 10
amplitude = 5
rotation_increment = 36  # degrees
"""

print("Starting curve creation loop")
for j in range(1, num_curves + 1):
    print("Loop iteration:", j)
    
    print("About to calculate theta")
    theta = np.linspace(0, 2 * np.pi, num_points)
    
    print("About to calculate x, y, and z")
    j_array = j * np.ones_like(theta)
    x = amplitude * np.sin(j_array * theta) * np.cos(j_array * theta)
    y = amplitude * np.sin(j_array * theta) * np.sin(j_array * theta)
    z = np.full_like(x, j * 5)  # This will stack the curves vertically

    points = [rg.Point3d(xi, yi, zi) for xi, yi, zi in zip(x, y, z)]

    
    points = [rg.Point3d(xi, yi, zi) for xi, yi, zi in zip(x, y, z)]
    curve = rg.Curve.CreateInterpolatedCurve(points, 3)
    
    # Spiral effect
    import math
    rotation_angle = math.radians(j * rotation_increment)
    transform = rg.Transform.Rotation(rotation_angle, rg.Vector3d.ZAxis, rg.Point3d(0, 0, z[0]))
    curve.Transform(transform)


    geo_stack.append(curve)

print("Starting loft creation loop")
for i in range(len(geo_stack.items) - 1):
    print("Loft iteration:", i)
    
    curve1 = geo_stack.items[i]
    curve2 = geo_stack.items[i + 1]
    loft_surfaces = rg.Brep.CreateFromLoft([curve1, curve2], rg.Point3d.Unset, rg.Point3d.Unset, rg.LoftType.Normal, False)
    if loft_surfaces:
        geo_stack.append(loft_surfaces[0])

print("Transforming geometries")
# Pop a surface, scale it, and push it back onto the stack
scaled_surface = geo_stack.pop()
if scaled_surface:
    transform = rg.Transform.Scale(rg.Plane.WorldXY, 0.9, 0.9, 0.9)
    scaled_surface.Transform(transform)
    geo_stack.append(scaled_surface)

# Pop another surface, translate it, and push it back
translated_surface = geo_stack.pop()
if translated_surface:
    transform = rg.Transform.Translation(0, 0, 10)
    translated_surface.Transform(transform)
    geo_stack.append(translated_surface)

print("Setting outputs")
# Set outputs for Grasshopper
a = [item for item in geo_stack.items if isinstance(item, rg.Curve)]
b = scaled_surface
c = translated_surface
# ---------- end stacks_append_pop_3 ----------
entwine = Entwine(Branch00=geometry_3, Branch01=geometry, Branch02=geometry_2, FlattenInputs=True)  # disabled
entwine_2 = Entwine(Branch00=geometry_5, Branch01=geometry_4, FlattenInputs=True)
panel_10 = Panel(entwine)  # disabled
panel_11 = Panel(entwine_2)
panel_12 = Panel(stacks_append_pop_3.out)
geometry_6 = Geometry(stacks_append_pop_3.a)
geometry_7 = Geometry(stacks_append_pop_3.b)
geometry_8 = Geometry(stacks_append_pop_3.c)
entwine_3 = Entwine(Branch00=geometry_6, Branch01=geometry_7, Branch02=geometry_8, FlattenInputs=True)
panel_13 = Panel(entwine_3)
