# Grasshopper definition 017_Sets_collection_of_elements.gh (Grasshopper 1.0.7)
# plug-ins: RhinoCodePluginGH

# ----
# Oscillation Algorithm
# The oscillation algorithm can be use to animate
# any geometry that is driven by a number sliders.
# Simply swap out the number sliders at the
# multiplication node in the oscillation script.
panel = Panel("1")
trigger = Trigger(Interval=20, TimerInterval=20, Target=data_recorder)
data_recorder = DataRecorder(panel, DataLimit=-10, RecordData=False)
list_length = ListLength(List=data_recorder)
division = Division(A=list_length, B=Slider(126, range=0..1000))
cosine = Cosine(Value=division)
sine = Sine(Value=division)
panel_2 = Panel([sine, cosine])
multiplication = Multiplication(A=sine)
multiplication_2 = Multiplication(A=cosine)
multiplication_3 = Multiplication(A=cosine)
multiplication_4 = Multiplication(A=sine)

# ----
# gpt-4 Initial Response
# Alright, I'll create a Python script for a
# Grasshopper node in Rhino 8 WIP that will
# generate a simple 3D geometric model using
# Rhino's common API. This script will utilize
# Python's built-in data structure set (which only
# contains unique and hashable elements) to
# create unique points for our 3D model.
# 
# For simplicity, let's create a collection of points
# and then connect those points to form a 3D
# polygon (a mesh).
# 
# The script will generate random points.
# It will ensure the points are unique using the set
# data structure.
# It will use these unique points to form a 3D
# mesh in Rhino.
number_slider = Slider(-10, range=-10..10)
# 2nd gpt-4 Text Prompt
# Great, now create a much more complex model
# with complex trigonometric polynomials and the
# NUMPY python library. And be sure to use the
# Sets collection of hashable elements  several times.
# gpt-4 2nd Response
# Certainly! Let's create a complex 3D model
# using trigonometric polynomials and the numpy
# library, while also utilizing Python's set data
# structure to ensure unique elements at various
# stages of our script.
# 
# This script will:
# 
# Generate a grid of points using trigonometric
# polynomials.
# Use a set to ensure unique z-values for each
# (x,y) coordinate pair.
# Generate another set of points in space based
# on some trigonometric criteria.
# Connect these unique points to create a 3D
# mesh.
number_slider_2 = Slider(6, range=0..10)
number_slider_3 = Slider(12, range=0..100)

# ----
# #The Numpy Array:
# A Multidimensional Array Object
# test_random
number_slider_4 = Slider(4, range=0..4)  # disabled
number_slider_5 = Slider(5, range=0..20)  # disabled
numpy = Script(rows=number_slider_4, columns=number_slider_5)  # -> out, a, arr0_OUT, arr1_OUT, arr2_OUT, arr3_OUT; inputs rows: Int32, columns: Int32; disabled
# ---------- numpy: Python ----------
"""Grasshopper Script"""
#! python 3
a = "Welcome to Wickerson Studios!"
print(a)

# r: numpy

import numpy

arr = numpy.random.rand(rows, columns)

print(arr)
print(type(arr))
arr = arr.tolist()
print(arr)

arr_OUT = [arr[i] if i < rows else False for i in range(4)]
arr0_OUT, arr1_OUT, arr2_OUT, arr3_OUT = arr_OUT
# ---------- end numpy ----------
panel_3 = Panel(numpy.a)  # disabled
number = Number(numpy.arr0_OUT)  # disabled
# 002 Python Refresher
# Container Data Structures
# Sets Collection of Elements
# gpt-4 Text Prompt
# Create a geometric 3D model with
# 
# Container Data Structures
# with
# Sets Collection of Hashable Elements
# 
# in python 3 code for the python 3 script
# node in grasshopper for Rhino8WIP using the
# 
# Rhino Common API.
# 
# Output the parts of the model in different
# variable outputs in the python 3 node in
# grasshopper.
panel_4 = Panel(number)  # disabled
number_2 = Number(numpy.arr1_OUT)  # disabled
panel_5 = Panel(number_2)  # disabled
number_3 = Number(numpy.arr2_OUT)  # disabled
panel_6 = Panel(number_3)  # disabled
number_4 = Number(numpy.arr3_OUT)  # disabled
number_slider_6 = Slider(10, range=0..100)  # disabled
panel_7 = Panel(number_4)  # disabled
multiplication_5 = Multiplication(A=number, B=number_slider_6)  # disabled
multiplication_6 = Multiplication(A=number_2, B=number_slider_6)  # disabled
construct_point = ConstructPoint(XCoordinate=multiplication_5, YCoordinate=graft(multiplication_5), ZCoordinate=0)  # disabled
construct_point_2 = ConstructPoint(XCoordinate=multiplication_5, YCoordinate=graft(multiplication_5), ZCoordinate=multiplication_6)  # disabled
unit_x = UnitX(Factor=number_3)  # disabled
line = Line(StartPoint=construct_point, EndPoint=construct_point_2)  # disabled
move = Move(Geometry=line, Motion=unit_x)  # -> Geometry, Transform; disabled
list_item = ListItem(List=graft(line), Index=0, Wrap=True)  # disabled
list_item_2 = ListItem(List=graft(move.Geometry), Index=0, Wrap=True)  # disabled
unit_y = UnitY(Factor=number_4)  # disabled
loft = Loft(
    Curves=[list_item, list_item_2],
    Options={Adjust=False, Closed=False, LoftEnds=0, LoftSimp=0, LoftType=0, Rebuild=10, Refit=0.01})  # disabled
extrude = Extrude(Base=loft, Direction=graft(unit_y))  # disabled

sets_collection_hashable = Script()  # -> out, a, b; disabled
# ---------- sets_collection_hashable: Python ----------
import Rhino.Geometry as rg
import numpy as np
import random

def generate_grid_points(nx, ny):
    # Define the x and y range for our grid
    x = np.linspace(-10, 10, nx)
    y = np.linspace(-10, 10, ny)

    # Create a dictionary to store (x,y): z mapping and ensure unique z-values using a set
    z_values = set()
    z_dict = {}

    for xi in x:
        for yi in y:
            # Trigonometric polynomial to determine z-value
            zi = np.sin(xi) * np.cos(yi) + np.sin(yi) * np.cos(xi)
            while zi in z_values:  # Ensure unique z-values
                zi += random.uniform(-0.5, 0.5)
            z_values.add(zi)
            z_dict[(xi, yi)] = zi

    points = [rg.Point3d(coord[0], coord[1], z_dict[coord]) for coord in z_dict.keys()]
    return points

def additional_trig_points():
    points_set = set()
    
    for _ in range(100):
        theta = random.uniform(0, 2 * np.pi)
        phi = random.uniform(0, np.pi)
        
        r = 10.0
        
        x = r * np.sin(theta) * np.cos(phi)
        y = r * np.sin(theta) * np.sin(phi)
        z = r * np.cos(theta)
        
        point = (x, y, z)
        points_set.add(point)
        
    return [rg.Point3d(p[0], p[1], p[2]) for p in points_set]

def create_mesh_from_points(points):
    mesh = rg.Mesh()

    for pt in points:
        mesh.Vertices.Add(pt)

    for i in range(len(points) - 2):
        mesh.Faces.AddFace(i, i + 1, i + 2)

    return mesh

if __name__ == "__main__":
    grid_points = generate_grid_points(20, 20)
    trig_points = additional_trig_points()
    
    combined_points = grid_points + trig_points
    mesh = create_mesh_from_points(combined_points)

    a = combined_points
    b = mesh
# ---------- end sets_collection_hashable ----------
geometry = Geometry(sets_collection_hashable.b)  # disabled
geometry_2 = Geometry(sets_collection_hashable.a)  # disabled
stacks_collections_hashable = Script(
    xMin=number_slider,
    xMax=Slider(10, range=-10..10),
    yMin=Slider(-10, range=-10..10),
    yMax=Slider(10, range=-10..10),
    zMin=Slider(-10, range=-10..10),
    zMax=Slider(10, range=-10..10),
    uniquePts=number_slider_2)  # -> out, a, b; inputs xMin: Double, xMax: Double, yMin: Double, yMax: Double, zMin: Double, zMax: Double, uniquePts: Int32
# ---------- stacks_collections_hashable: Python ----------
import Rhino.Geometry as rg
import random

def generate_unique_points(count):
    points_set = set()

    while len(points_set) < count:
        x = random.uniform(xMin, xMax)
        y = random.uniform(yMin, yMax)
        z = random.uniform(zMin, zMax)
        point = (x, y, z)
        points_set.add(point)

    return [rg.Point3d(p[0], p[1], p[2]) for p in points_set]

def create_mesh_from_points(points):
    mesh = rg.Mesh()

    for pt in points:
        mesh.Vertices.Add(pt)

    # Assuming points are in a roughly planar configuration for simplicity. 
    # This is just a simple example and won't cover all cases.
    for i in range(len(points) - 2):
        mesh.Faces.AddFace(i, i + 1, i + 2)

    return mesh

if __name__ == "__main__":
    unique_points = generate_unique_points(uniquePts)
    mesh = create_mesh_from_points(unique_points)

    # Output the points and mesh
    a = unique_points
    b = mesh
# ---------- end stacks_collections_hashable ----------
panel_8 = Panel(sets_collection_hashable.out)  # disabled
sets_collection_hashable_2 = Script(
    nx=number_slider_3,
    ny=number_slider_3,
    xMin=Slider(-10, range=-10..10),
    xMax=Slider(10, range=-10..10),
    yMin=Slider(-10, range=-10..10),
    yMax=Slider(10, range=-10..10),
    amplitude=Slider(3.95, range=0..10),
    trig_point_count=Slider(4, range=0..10),
    rMin=Slider(0, range=0..10),
    rMax=Slider(61.24, range=0..100))  # -> out, a, b, c, d; inputs nx: Int32, ny: Int32, xMin: Double, xMax: Double, yMin: Double, yMax: Double, amplitude: Int32, trig_point_count: Int32, rMin: Int32, rMax: Int32
# ---------- sets_collection_hashable_2: Python ----------
import Rhino.Geometry as rg
import numpy as np
import random

def generate_grid_points(nx, ny, x_range, y_range, amplitude):
    x = np.linspace(*x_range, nx)
    y = np.linspace(*y_range, ny)

    z_values = set()
    z_dict = {}

    for xi in x:
        for yi in y:
            zi = amplitude * (np.sin(xi) * np.cos(yi) + np.sin(yi) * np.cos(xi))
            while zi in z_values:  
                zi += random.uniform(-0.5, 0.5)
            z_values.add(zi)
            z_dict[(xi, yi)] = zi

    points = [rg.Point3d(coord[0], coord[1], z_dict[coord]) for coord in z_dict.keys()]
    return points

def additional_trig_points(count, r_range):
    points_set = set()

    for _ in range(count):
        theta = random.uniform(0, 2 * np.pi)
        phi = random.uniform(0, np.pi)
        
        r = random.uniform(*r_range)
        
        x = r * np.sin(theta) * np.cos(phi)
        y = r * np.sin(theta) * np.sin(phi)
        z = r * np.cos(theta)
        
        point = (x, y, z)
        points_set.add(point)

    return [rg.Point3d(p[0], p[1], p[2]) for p in points_set]

def create_mesh_from_points(points):
    mesh = rg.Mesh()

    for pt in points:
        mesh.Vertices.Add(pt)

    for i in range(len(points) - 2):
        mesh.Faces.AddFace(i, i + 1, i + 2)

    return mesh

# Parameters for controlling the model
#nx = 20 # Grid resolution in x
#ny = 20 # Grid resolution in y
x_range = (xMin, xMax) # Range of x values
y_range = (yMin, yMax) # Range of y values
amplitude = 10.0 # Amplitude for trigonometric polynomial

#trig_point_count = 100 # Number of trigonometric points
r_range = (rMin, rMax) # Range of radial distances for trigonometric points

# Generate and combine the points
grid_points = generate_grid_points(nx, ny, x_range, y_range, amplitude)
trig_points = additional_trig_points(trig_point_count, r_range)

combined_points = grid_points + trig_points
mesh = create_mesh_from_points(combined_points)

# Outputs
a = grid_points
b = trig_points
c = combined_points
d = mesh
# ---------- end sets_collection_hashable_2 ----------
point = Point(stacks_collections_hashable.a)
mesh = Mesh(stacks_collections_hashable.b)
entwine = Entwine(Branch00=geometry_2, Branch01=geometry, FlattenInputs=True)  # disabled
panel_9 = Panel(stacks_collections_hashable.out)
geometry_3 = Geometry(sets_collection_hashable_2.b)
geometry_4 = Geometry(sets_collection_hashable_2.c)
panel_10 = Panel(entwine)  # disabled
geometry_5 = Geometry(sets_collection_hashable_2.a)
geometry_6 = Geometry(sets_collection_hashable_2.d)
entwine_2 = Entwine(Branch00=point, Branch01=mesh, FlattenInputs=True)
panel_11 = Panel(sets_collection_hashable_2.out)
panel_12 = Panel(entwine_2)
line_2 = Line(StartPoint=geometry_5, EndPoint=geometry_3)
entwine_3 = Entwine(Branch00=geometry_5, Branch01=geometry_3, FlattenInputs=True)
panel_13 = Panel(entwine_3)
