# Grasshopper definition 018_Sets_collection_unordered_elements.gh (Grasshopper 1.0.7)
# plug-ins: RhinoCodePluginGH

# ----
# #The Numpy Array:
# A Multidimensional Array Object
# test_random
number_slider = Slider(4, range=0..4)  # disabled
number_slider_2 = Slider(5, range=0..20)  # disabled
numpy = Script(rows=number_slider, columns=number_slider_2)  # -> out, a, arr0_OUT, arr1_OUT, arr2_OUT, arr3_OUT; inputs rows: Int32, columns: Int32; disabled
# ---------- numpy: Python ----------
"""Grasshopper Script"""
#! python 3
a = "Welcome to Wickerson Studios!"
print(a)

# r: numpy

import numpy

arr = numpy.random.rand(rows, columns)

print(arr)
print(type(arr))
arr = arr.tolist()
print(arr)

arr_OUT = [arr[i] if i < rows else False for i in range(4)]
arr0_OUT, arr1_OUT, arr2_OUT, arr3_OUT = arr_OUT
# ---------- end numpy ----------
panel = Panel(numpy.a)  # disabled
number = Number(numpy.arr0_OUT)  # disabled
# 002 Python Refresher
# Container Data Structures
# Sets Collection of Unordered Elements
# gpt-4 Text Prompt
# Create a geometric 3D model with
# 
# Container Data Structures
# with
# Sets Collection of Unordered Elements
# 
# in python 3 code for the python 3 script
# node in grasshopper for Rhino8WIP using the
# 
# Rhino Common API.
# 
# Output the parts of the model in different
# variable outputs in the python 3 node in
# grasshopper.
panel_2 = Panel(number)  # disabled
number_2 = Number(numpy.arr1_OUT)  # disabled
panel_3 = Panel(number_2)  # disabled
number_3 = Number(numpy.arr2_OUT)  # disabled
panel_4 = Panel(number_3)  # disabled
number_4 = Number(numpy.arr3_OUT)  # disabled
number_slider_3 = Slider(10, range=0..100)  # disabled
panel_5 = Panel(number_4)  # disabled
multiplication = Multiplication(A=number, B=number_slider_3)  # disabled
multiplication_2 = Multiplication(A=number_2, B=number_slider_3)  # disabled
construct_point = ConstructPoint(XCoordinate=multiplication, YCoordinate=graft(multiplication), ZCoordinate=0)  # disabled
construct_point_2 = ConstructPoint(XCoordinate=multiplication, YCoordinate=graft(multiplication), ZCoordinate=multiplication_2)  # disabled
unit_x = UnitX(Factor=number_3)  # disabled
line = Line(StartPoint=construct_point, EndPoint=construct_point_2)  # disabled
move = Move(Geometry=line, Motion=unit_x)  # -> Geometry, Transform; disabled
list_item = ListItem(List=graft(line), Index=0, Wrap=True)  # disabled
list_item_2 = ListItem(List=graft(move.Geometry), Index=0, Wrap=True)  # disabled
unit_y = UnitY(Factor=number_4)  # disabled
loft = Loft(
    Curves=[list_item, list_item_2],
    Options={Adjust=False, Closed=False, LoftEnds=0, LoftSimp=0, LoftType=0, Rebuild=10, Refit=0.01})  # disabled
extrude = Extrude(Base=loft, Direction=graft(unit_y))  # disabled

# ----
# 2nd gpt-4 Text Prompt
# Great, now create a much more complex model
# with complex trigonometric polynomials and the
# NUMPY python library. And be sure to use the
# Sets collection of Unordered elements  several times.
# gpt-4 2nd Response
number_slider_4 = Slider(4, range=1..10)  # disabled
number_slider_5 = Slider(35, range=0..100)

# ----
# Oscillation Algorithm
# The oscillation algorithm can be use to animate
# any geometry that is driven by a number sliders.
# Simply swap out the number sliders at the
# multiplication node in the oscillation script.
panel_6 = Panel("1")
trigger = Trigger(Interval=20, TimerInterval=20, Target=data_recorder)
data_recorder = DataRecorder(panel_6, DataLimit=-10, RecordData=False)
list_length = ListLength(List=data_recorder)
division = Division(A=list_length, B=Slider(126, range=0..1000))
cosine = Cosine(Value=division)
sine = Sine(Value=division)
panel_7 = Panel([sine, cosine])
multiplication_3 = Multiplication(A=sine, B=Slider(3, range=0..3))
multiplication_4 = Multiplication(A=cosine, B=Slider(0, range=0..3))
multiplication_5 = Multiplication(A=cosine, B=Slider(1.61, range=0..3))
multiplication_6 = Multiplication(A=sine, B=Slider(1.3, range=0..3))

# ----
# Certainly! In this example, we'll create a
# geometric 3D model based on trigonometric
# polynomials using the numpy library. We'll make
# use of sets to store and manipulate data points.
# We'll then use these data points to create
# complex geometric patterns in Rhino.
# 
# This example creates a wavy mesh surface with
# undulating sinusoidal patterns. We'll employ
# both sine and cosine functions with varying
# frequencies and amplitudes.
sets_collection_unordered = Script()  # -> out, a; disabled
# ---------- sets_collection_unordered: Python ----------
import Rhino.Geometry as rg
import numpy as np

def generate_points_set(nx, ny, func):
    """Generate a set of 3D points based on a function."""
    x = np.linspace(0, 10, nx)
    y = np.linspace(0, 10, ny)
    X, Y = np.meshgrid(x, y)
    Z = func(X, Y)
    points = {(xi, yi, zi) for xi, yi, zi in zip(X.flatten(), Y.flatten(), Z.flatten())}
    return points

def trig_func(x, y):
    """A complex trigonometric polynomial function."""
    z = np.sin(x) * np.cos(y) + np.sin(2 * x + y) * np.cos(3 * y + x)
    return z

# Create a set of points using the complex trigonometric function
points_set = generate_points_set(50, 50, trig_func)

# Convert the set of points to a list and sort them for consistent usage
sorted_points_list = sorted(list(points_set), key=lambda pt: (pt[0], pt[1]))

# Create a mesh from points
mesh = rg.Mesh()

for pt in sorted_points_list:
    mesh.Vertices.Add(pt[0], pt[1], pt[2])

# Define mesh faces
for i in range(49):  # nx-1
    for j in range(49):  # ny-1
        mesh.Faces.AddFace(i + j * 50, i + 1 + j * 50, i + 1 + (j + 1) * 50, i + (j + 1) * 50)

# Output mesh for further use in Grasshopper
a = mesh
# ---------- end sets_collection_unordered ----------
geometry = Geometry(sets_collection_unordered.a)  # disabled
entwine = Entwine(Branch00=geometry, FlattenInputs=True)  # disabled
# gpt-4 Initial Response
# The following is a sample Python script that
# uses the Rhino Common API to create a
# geometric 3D model based on a "container"
# made up of sets (collections of unordered
# elements). This code is tailored for use in a
# Grasshopper Python node in Rhino 8 WIP:
# 
# We will generate three sets of points.
# Based on these sets, we'll create different
# geometric shapes.
# The script will output the parts of the model in
# different variable outputs for further use in
# Grasshopper.
stacks_collections_unordered = Script(numPts=number_slider_4)  # -> out, a, b, c; inputs numPts: Int32; disabled
# ---------- stacks_collections_unordered: Python ----------
import Rhino.Geometry as rg
import random

def generate_random_points(num_points=numPts, x_range=(0, 10), y_range=(0, 10), z_range=(0, 10)):
    """Generate a set of random 3D points."""
    points = set()
    while len(points) < num_points:
        x = random.uniform(*x_range)
        y = random.uniform(*y_range)
        z = random.uniform(*z_range)
        point = rg.Point3d(x, y, z)
        points.add(point)
    return points

# Generate three sets of random points
points_set1 = generate_random_points(10, (0, numPts), (0, numPts), (0, numPts))
points_set2 = generate_random_points(5, (5, numPts), (5, numPts), (0, numPts))
points_set3 = generate_random_points(7, (10, numPts), (0, numPts), (0, numPts))

# Using the sets of points to create different geometric objects:
# Set 1: Lines between each pair of points
lines = [rg.Line(pt1, pt2) for pt1 in points_set1 for pt2 in points_set1 if pt1 != pt2]

# Set 2: Spheres centered at each point with random radius
spheres = [rg.Sphere(pt, random.uniform(0.5, 1.5)) for pt in points_set2]

# Set 3: Boxes around each point with random dimensions
boxes = [rg.Box(rg.Plane.WorldXY, rg.Interval(pt.X - random.uniform(0.5, 1), pt.X + random.uniform(0.5, 1)), 
                rg.Interval(pt.Y - random.uniform(0.5, 1), pt.Y + random.uniform(0.5, 1)), 
                rg.Interval(pt.Z - random.uniform(0.5, 1), pt.Z + random.uniform(0.5, 1))) for pt in points_set3]

# Output the shapes for further use in Grasshopper
a = lines
b = spheres
c = boxes
# ---------- end stacks_collections_unordered ----------
panel_8 = Panel(sets_collection_unordered.out)  # disabled
sets_collection_unordered_2 = Script(
    x_start=Slider(0, range=0..10),
    x_end=Slider(10, range=0..10),
    y_start=Slider(0, range=0..10),
    y_end=Slider(10, range=0..10),
    nx=number_slider_5,
    ny=number_slider_5,
    freq1=multiplication_4,
    freq2=multiplication_3,
    amp1=multiplication_5,
    amp2=multiplication_6)  # -> out, a; inputs x_start: Int32, x_end: Int32, y_start: Int32, y_end: Int32, nx: Int32, ny: Int32, freq1: Double, freq2: Double, amp1: Double, amp2: Double
# ---------- sets_collection_unordered_2: Python ----------
import Rhino.Geometry as rg
import numpy as np

def generate_points_set(nx, ny, xrange, yrange, func):
    """Generate a set of 3D points based on a function."""
    x = np.linspace(*xrange, nx)
    y = np.linspace(*yrange, ny)
    X, Y = np.meshgrid(x, y)
    Z = func(X, Y)
    points = {(xi, yi, zi) for xi, yi, zi in zip(X.flatten(), Y.flatten(), Z.flatten())}
    return points

def trig_func(x, y, freq1, freq2, amp1, amp2):
    """A complex trigonometric polynomial function."""
    z = amp1 * np.sin(freq1 * x) * np.cos(freq1 * y) + amp2 * np.sin(freq2 * x + y) * np.cos(freq2 * y + x)
    return z

# Parameters exposed to Grasshopper
x_range = (x_start, x_end)  # Tuple like (0, 10)
y_range = (y_start, y_end)  # Tuple like (0, 10)
#nx = number_of_points_in_x  # Int like 50
#ny = number_of_points_in_y  # Int like 50
#freq1 = frequency_1  # Float like 1.0
#freq2 = frequency_2  # Float like 2.0
#amp1 = amplitude_1  # Float like 1.0
#amp2 = amplitude_2  # Float like 1.0

# Create a set of points using the complex trigonometric function
points_set = generate_points_set(nx, ny, x_range, y_range, lambda x, y: trig_func(x, y, freq1, freq2, amp1, amp2))

# Convert the set of points to a list and sort them for consistent usage
sorted_points_list = sorted(list(points_set), key=lambda pt: (pt[0], pt[1]))

# Create a mesh from points
mesh = rg.Mesh()

for pt in sorted_points_list:
    mesh.Vertices.Add(pt[0], pt[1], pt[2])

# Define mesh faces
for i in range(nx - 1):
    for j in range(ny - 1):
        mesh.Faces.AddFace(i + j * nx, i + 1 + j * nx, i + 1 + (j + 1) * nx, i + (j + 1) * nx)

# Output mesh for further use in Grasshopper
a = mesh
# ---------- end sets_collection_unordered_2 ----------
panel_9 = Panel(geometry)  # disabled
brep = Brep(stacks_collections_unordered.b)  # disabled
box = Box(stacks_collections_unordered.c)  # disabled
line_2 = Line(stacks_collections_unordered.a)  # disabled
panel_10 = Panel(stacks_collections_unordered.out)  # disabled
geometry_2 = Geometry(sets_collection_unordered_2.a)
entwine_2 = Entwine(Branch00=line_2, Branch01=brep, Branch02=box, FlattenInputs=True)  # disabled
entwine_3 = Entwine(Branch00=geometry_2, FlattenInputs=True)
panel_11 = Panel(entwine_2)  # disabled
panel_12 = Panel(sets_collection_unordered_2.out)
panel_13 = Panel(geometry_2)
