# Grasshopper definition 019_Sets_collection_unique_elements.gh (Grasshopper 1.0.7)
# plug-ins: RhinoCodePluginGH

# ----
# Oscillation Algorithm
# The oscillation algorithm can be use to animate
# any geometry that is driven by a number sliders.
# Simply swap out the number sliders at the
# multiplication node in the oscillation script.
panel = Panel("1")  # disabled
trigger = Trigger(Interval=20, TimerInterval=20, Target=data_recorder)  # disabled
data_recorder = DataRecorder(panel, DataLimit=-10, RecordData=False)  # disabled
number_slider = Slider(126, range=0..1000)  # disabled
list_length = ListLength(List=data_recorder)  # disabled
division = Division(A=list_length, B=number_slider)  # disabled
cosine = Cosine(Value=division)  # disabled
sine = Sine(Value=division)  # disabled
panel_2 = Panel([sine, cosine])  # disabled
multiplication = Multiplication(A=sine)  # disabled
multiplication_2 = Multiplication(A=cosine)  # disabled
multiplication_3 = Multiplication(A=cosine)  # disabled
multiplication_4 = Multiplication(A=sine)  # disabled

number_slider_2 = Slider(10, range=1..10)  # disabled
# 2nd gpt-4 Text Prompt
# Great, now create a much more complex model
# with complex trigonometric polynomials and the
# NUMPY python library. And be sure to use the
# Sets collection of Unique elements  several times.
# gpt-4 2nd Response
number_slider_3 = Slider(5.03, range=0..10)  # disabled

# ----
# #The Numpy Array:
# A Multidimensional Array Object
# test_random
number_slider_4 = Slider(4, range=0..4)  # disabled
number_slider_5 = Slider(5, range=0..20)  # disabled
numpy = Script(rows=number_slider_4, columns=number_slider_5)  # -> out, a, arr0_OUT, arr1_OUT, arr2_OUT, arr3_OUT; inputs rows: Int32, columns: Int32; disabled
# ---------- numpy: Python ----------
"""Grasshopper Script"""
#! python 3
a = "Welcome to Wickerson Studios!"
print(a)

# r: numpy

import numpy

arr = numpy.random.rand(rows, columns)

print(arr)
print(type(arr))
arr = arr.tolist()
print(arr)

arr_OUT = [arr[i] if i < rows else False for i in range(4)]
arr0_OUT, arr1_OUT, arr2_OUT, arr3_OUT = arr_OUT
# ---------- end numpy ----------
panel_3 = Panel(numpy.a)  # disabled
number = Number(numpy.arr0_OUT)  # disabled
# 002 Python Refresher
# Container Data Structures
# Sets Collection of Unique Elements
# gpt-4 Text Prompt
# Create a geometric 3D model with
# 
# Container Data Structures
# with
# Sets Collection of Unique Elements
# 
# in python 3 code for the python 3 script
# node in grasshopper for Rhino8WIP using the
# 
# Rhino Common API.
# 
# Output the parts of the model in different
# variable outputs in the python 3 node in
# grasshopper.
panel_4 = Panel(number)  # disabled
number_2 = Number(numpy.arr1_OUT)  # disabled
panel_5 = Panel(number_2)  # disabled
number_3 = Number(numpy.arr2_OUT)  # disabled
panel_6 = Panel(number_3)  # disabled
number_4 = Number(numpy.arr3_OUT)  # disabled
number_slider_6 = Slider(10, range=0..100)  # disabled
panel_7 = Panel(number_4)  # disabled
multiplication_5 = Multiplication(A=number, B=number_slider_6)  # disabled
multiplication_6 = Multiplication(A=number_2, B=number_slider_6)  # disabled
construct_point = ConstructPoint(XCoordinate=multiplication_5, YCoordinate=graft(multiplication_5), ZCoordinate=0)  # disabled
construct_point_2 = ConstructPoint(XCoordinate=multiplication_5, YCoordinate=graft(multiplication_5), ZCoordinate=multiplication_6)  # disabled
unit_x = UnitX(Factor=number_3)  # disabled
line = Line(StartPoint=construct_point, EndPoint=construct_point_2)  # disabled
move = Move(Geometry=line, Motion=unit_x)  # -> Geometry, Transform; disabled
list_item = ListItem(List=graft(line), Index=0, Wrap=True)  # disabled
list_item_2 = ListItem(List=graft(move.Geometry), Index=0, Wrap=True)  # disabled
unit_y = UnitY(Factor=number_4)  # disabled
loft = Loft(
    Curves=[list_item, list_item_2],
    Options={Adjust=False, Closed=False, LoftEnds=0, LoftSimp=0, LoftType=0, Rebuild=10, Refit=0.01})  # disabled
extrude = Extrude(Base=loft, Direction=graft(unit_y))  # disabled

number_slider_7 = Slider(35, range=0..100)
# Certainly! I'll create a more intricate 3D model
# based on trigonometric polynomials using the
# numpy library. This model will involve generating
# a series of unique points based on a
# trigonometric function, and then we'll use those
# points to create unique geometries.
# 
# This model will be a parametric wave pattern on
# a plane, where the amplitude and frequency of
# the wave are dictated by trigonometric polynomials.
sets_collection_unordered = Script()  # -> out, a
# ---------- sets_collection_unordered: Python ----------
import Rhino.Geometry as rg
import numpy as np

def generate_points_set(nx, ny, func):
    """Generate a set of 3D points based on a function."""
    x = np.linspace(0, 10, nx)
    y = np.linspace(0, 10, ny)
    X, Y = np.meshgrid(x, y)
    Z = func(X, Y)
    points = {(xi, yi, zi) for xi, yi, zi in zip(X.flatten(), Y.flatten(), Z.flatten())}
    return points

def trig_func(x, y):
    """A complex trigonometric polynomial function."""
    z = np.sin(x) * np.cos(y) + np.sin(2 * x + y) * np.cos(3 * y + x)
    return z

# Create a set of points using the complex trigonometric function
points_set = generate_points_set(50, 50, trig_func)

# Convert the set of points to a list and sort them for consistent usage
sorted_points_list = sorted(list(points_set), key=lambda pt: (pt[0], pt[1]))

# Create a mesh from points
mesh = rg.Mesh()

for pt in sorted_points_list:
    mesh.Vertices.Add(pt[0], pt[1], pt[2])

# Define mesh faces
for i in range(49):  # nx-1
    for j in range(49):  # ny-1
        mesh.Faces.AddFace(i + j * 50, i + 1 + j * 50, i + 1 + (j + 1) * 50, i + (j + 1) * 50)

# Output mesh for further use in Grasshopper
a = mesh
# ---------- end sets_collection_unordered ----------
geometry = Geometry(sets_collection_unordered.a)
# gpt-4 Initial Response
# Creating a 3D model based on the vague
# description you provided can be challenging.
# However, I'll create a basic example of a 3D
# model that uses Python, the Rhino Common
# API, and data structures to demonstrate the
# principles you mentioned.
# 
# Let's say you want to create a collection of
# unique 3D points within a bounding box and
# then generate spheres at each of those points.
# To ensure the points are unique, we'll use a set
# data structure. The bounding box will serve as
# our "container".
stacks_collections_unique = Script(numPts=number_slider_2, sphere_rad=number_slider_3)  # -> out, a, b; inputs numPts: Int32, sphere_rad: Double; disabled
# ---------- stacks_collections_unique: Python ----------
import Rhino.Geometry as rg
import random

def unique_points_in_bbox(number, bbox):
    """
    Generates a set of unique points within a bounding box.
    
    Args:
    number: the number of points to generate
    bbox: the bounding box within which to generate the points
    
    Returns:
    A set of unique points
    """
    points = set()

    while len(points) < number:
        x = random.uniform(bbox.Min.X, bbox.Max.X)
        y = random.uniform(bbox.Min.Y, bbox.Max.Y)
        z = random.uniform(bbox.Min.Z, bbox.Max.Z)
        pt = rg.Point3d(x, y, z)
        
        # Using a tuple representation for the set, since Point3d is not hashable.
        points.add((pt.X, pt.Y, pt.Z))
        
    # Convert back to Point3d objects for return.
    return [rg.Point3d(p[0], p[1], p[2]) for p in points]

def main(minPt, maxPt, numberOfPoints, sphereRadius):
    # Define the bounding box
    bbox = rg.BoundingBox(minPt, maxPt)
    
    # Generate unique points within the bounding box
    points = unique_points_in_bbox(numberOfPoints, bbox)

    # Convert the spheres to Breps so they're recognized as geometry in Grasshopper
    sphereBreps = [rg.Brep.CreateFromSphere(rg.Sphere(pt, sphereRadius)) for pt in points]

    # Output
    return points, sphereBreps

# Inputs from Grasshopper
# These will be connected from Grasshopper components to the Python script
minPt = rg.Point3d(0, 0, 0)  # Default value, replace with input from Grasshopper
maxPt = rg.Point3d(10, 10, 10)  # Default value, replace with input from Grasshopper
numberOfPoints = numPts  # Default value, replace with input from Grasshopper
sphereRadius = sphere_rad  # Default value, replace with input from Grasshopper

# Call the main function and set outputs
points, sphereBreps = main(minPt, maxPt, numberOfPoints, sphereRadius)
a = points
b = sphereBreps
# ---------- end stacks_collections_unique ----------
entwine = Entwine(Branch00=geometry, FlattenInputs=True)
panel_8 = Panel(sets_collection_unordered.out)
sets_collection_unique = Script(
    grid_size=Slider(18, range=0..30),
    x_start=Slider(0, range=0..10),
    x_end=Slider(10, range=0..10),
    y_start=Slider(0, range=0..10),
    y_end=Slider(10, range=0..10),
    nx=number_slider_7,
    ny=number_slider_7,
    freq1=Slider(0, range=0..3),
    freq2=Slider(3, range=0..3),
    amp1=Slider(1.61, range=0..3),
    amp2=Slider(1.3, range=0..3))  # -> out, a, b; inputs grid_size: Int32, x_start: Int32, x_end: Int32, y_start: Int32, y_end: Int32, nx: Int32, ny: Int32, freq1: Double, freq2: Double, amp1: Double, amp2: Double
# ---------- sets_collection_unique: Python ----------
import Rhino.Geometry as rg
import numpy as np

def trigonometric_polynomial(x, y, a=1, b=1, c=1, d=1):
    """
    A sample trigonometric polynomial for complexity.
    """
    return a * np.sin(b * x) + c * np.cos(d * y)

def unique_wave_crests(points, threshold=1.0):
    """
    Extracts unique wave crest points (Z-values greater than a threshold).
    """
    unique_crests = set()

    for pt in points:
        if pt.Z > threshold:
            # Store as tuple due to Point3d not being hashable
            unique_crests.add((pt.X, pt.Y, pt.Z))
    
    # Convert back to Point3d objects for return.
    return [rg.Point3d(p[0], p[1], p[2]) for p in unique_crests]

def main(grid_size, bounds, a, b, c, d, sphereRadius):
    x_vals = np.linspace(bounds[0], bounds[1], grid_size)
    y_vals = np.linspace(bounds[2], bounds[3], grid_size)

    points = []

    for x in x_vals:
        for y in y_vals:
            z = trigonometric_polynomial(x, y, a, b, c, d)
            points.append(rg.Point3d(x, y, z))
    
    crest_points = unique_wave_crests(points)
    sphereBreps = [rg.Brep.CreateFromSphere(rg.Sphere(pt, sphereRadius)) for pt in crest_points]

    return points, sphereBreps

# Define some parameters
#grid_size = 12
bounds = [0, 10, 0, 10]
a, b, c, d = 1, 2, 1, 3  # Coefficients for trigonometric polynomial
sphereRadius = 0.2

# Call the main function
points, sphereBreps = main(grid_size, bounds, a, b, c, d, sphereRadius)

# Outputs for Grasshopper
a = points
b = sphereBreps
import Rhino.Geometry as rg
import numpy as np

def generate_points_set(nx, ny, xrange, yrange, func):
    """Generate a set of 3D points based on a function."""
    x = np.linspace(*xrange, nx)
    y = np.linspace(*yrange, ny)
    X, Y = np.meshgrid(x, y)
    Z = func(X, Y)
    points = {(xi, yi, zi) for xi, yi, zi in zip(X.flatten(), Y.flatten(), Z.flatten())}
    return points

def trig_func(x, y, freq1, freq2, amp1, amp2):
    """A complex trigonometric polynomial function."""
    z = amp1 * np.sin(freq1 * x) * np.cos(freq1 * y) + amp2 * np.sin(freq2 * x + y) * np.cos(freq2 * y + x)
    return z

# Parameters exposed to Grasshopper
x_range = (x_start, x_end)  # Tuple like (0, 10)
y_range = (y_start, y_end)  # Tuple like (0, 10)
#nx = number_of_points_in_x  # Int like 50
#ny = number_of_points_in_y  # Int like 50
#freq1 = frequency_1  # Float like 1.0
#freq2 = frequency_2  # Float like 2.0
#amp1 = amplitude_1  # Float like 1.0
#amp2 = amplitude_2  # Float like 1.0

# Create a set of points using the complex trigonometric function
points_set = generate_points_set(nx, ny, x_range, y_range, lambda x, y: trig_func(x, y, freq1, freq2, amp1, amp2))

# Convert the set of points to a list and sort them for consistent usage
sorted_points_list = sorted(list(points_set), key=lambda pt: (pt[0], pt[1]))

# Create a mesh from points
mesh = rg.Mesh()

for pt in sorted_points_list:
    mesh.Vertices.Add(pt[0], pt[1], pt[2])

# Define mesh faces
for i in range(nx - 1):
    for j in range(ny - 1):
        mesh.Faces.AddFace(i + j * nx, i + 1 + j * nx, i + 1 + (j + 1) * nx, i + (j + 1) * nx)

# Output mesh for further use in Grasshopper
a = mesh
# ---------- end sets_collection_unique ----------
panel_9 = Panel(geometry)
point = Point(stacks_collections_unique.a)  # disabled
geometry_2 = Geometry(stacks_collections_unique.b)  # disabled
panel_10 = Panel(stacks_collections_unique.out)  # disabled
geometry_3 = Geometry(sets_collection_unique.b)
geometry_4 = Geometry(sets_collection_unique.a)
entwine_2 = Entwine(Branch00=point, Branch01=geometry_2, FlattenInputs=True)  # disabled
entwine_3 = Entwine(Branch00=geometry_4, Branch01=geometry_3, FlattenInputs=True)
panel_11 = Panel(entwine_2)  # disabled
panel_12 = Panel(sets_collection_unique.out)
panel_13 = Panel(entwine_3)
