# Grasshopper definition 020_Dicts_Value_Keys.gh (Grasshopper 1.0.7)
# plug-ins: RhinoCodePluginGH

# ----
# Oscillation Algorithm
# The oscillation algorithm can be use to animate
# any geometry that is driven by a number sliders.
# Simply swap out the number sliders at the
# multiplication node in the oscillation script.
panel = Panel("1")
trigger = Trigger(Interval=20, TimerInterval=20, Target=data_recorder)
data_recorder = DataRecorder(panel, DataLimit=-10, RecordData=True)
oscillation = Oscillation(list=data_recorder, B=Slider(126, range=0..1000))  # -> result, result_2
panel_2 = Panel([oscillation.result, oscillation.result_2])
multiplication = Multiplication(A=oscillation.result)
multiplication_2 = Multiplication(A=oscillation.result)

# ----
# #The Numpy Array:
# A Multidimensional Array Object
# test_random
number_slider = Slider(4, range=0..4)  # disabled
number_slider_2 = Slider(5, range=0..20)  # disabled
numpy = Script(rows=number_slider, columns=number_slider_2)  # -> out, a, arr0_OUT, arr1_OUT, arr2_OUT, arr3_OUT; inputs rows: Int32, columns: Int32; disabled
# ---------- numpy: Python ----------
"""Grasshopper Script"""
#! python 3
a = "Welcome to Wickerson Studios!"
print(a)

# r: numpy

import numpy

arr = numpy.random.rand(rows, columns)

print(arr)
print(type(arr))
arr = arr.tolist()
print(arr)

arr_OUT = [arr[i] if i < rows else False for i in range(4)]
arr0_OUT, arr1_OUT, arr2_OUT, arr3_OUT = arr_OUT
# ---------- end numpy ----------
panel_3 = Panel(numpy.a)  # disabled
number = Number(numpy.arr0_OUT)  # disabled
# 002 Python Refresher
# Container Data Structures
# Dictionaries Values and Keys
# gpt-4 Text Prompt
# Create a geometric 3D model with
# 
# Container Data Structures
# with
# Dictionaries Values and Keys
# 
# in python 3 code for the python 3 script
# node in grasshopper for Rhino8WIP using the
# 
# Rhino Common API.
# 
# Output the parts of the model in different
# variable outputs in the python 3 node in
# grasshopper.
panel_4 = Panel(number)  # disabled
number_2 = Number(numpy.arr1_OUT)  # disabled
panel_5 = Panel(number_2)  # disabled
number_3 = Number(numpy.arr2_OUT)  # disabled
panel_6 = Panel(number_3)  # disabled
number_4 = Number(numpy.arr3_OUT)  # disabled
number_slider_3 = Slider(10, range=0..100)  # disabled
panel_7 = Panel(number_4)  # disabled
multiplication_3 = Multiplication(A=number, B=number_slider_3)  # disabled
multiplication_4 = Multiplication(A=number_2, B=number_slider_3)  # disabled
construct_point = ConstructPoint(XCoordinate=multiplication_3, YCoordinate=graft(multiplication_3), ZCoordinate=0)  # disabled
construct_point_2 = ConstructPoint(XCoordinate=multiplication_3, YCoordinate=graft(multiplication_3), ZCoordinate=multiplication_4)  # disabled
unit_x = UnitX(Factor=number_3)  # disabled
line = Line(StartPoint=construct_point, EndPoint=construct_point_2)  # disabled
move = Move(Geometry=line, Motion=unit_x)  # -> Geometry, Transform; disabled
list_item = ListItem(List=graft(line), Index=0, Wrap=True)  # disabled
list_item_2 = ListItem(List=graft(move.Geometry), Index=0, Wrap=True)  # disabled
unit_y = UnitY(Factor=number_4)  # disabled
loft = Loft(
    Curves=[list_item, list_item_2],
    Options={Adjust=False, Closed=False, LoftEnds=0, LoftSimp=0, LoftType=0, Rebuild=10, Refit=0.01})  # disabled
extrude = Extrude(Base=loft, Direction=graft(unit_y))  # disabled

# ----
# gpt-4 Initial Response
# Certainly! Let's design a simple geometric 3D
# model using the Rhino Common API in a Python
#  script for a node in Grasshopper for Rhino8WIP.
# 
# For simplicity, I'm going to create a 3D
# geometric model of a set of cubes with various
# sizes, organized by a dictionary where the keys
# are cube names and the values are cube sizes.
dicts_values_and_keys = Script()  # -> out, a, b, c; disabled
# ---------- dicts_values_and_keys: Python ----------
import Rhino.Geometry as rg

def generate_cubes(data):
    """Generates a set of cubes based on the provided dictionary data.
    
    Args:
    - data (dict): A dictionary where keys are cube names and values are cube sizes.
    
    Returns:
    - dict: A dictionary where keys are cube names and values are the corresponding cube geometry.
    """
    cubes = {}
    offset = 0  # To position cubes in a row
    for key, size in data.items():
        base_point = rg.Point3d(offset, 0, 0)
        base_plane = rg.Plane(base_point, rg.Vector3d.ZAxis)
        
        x_interval = rg.Interval(0, size)
        y_interval = rg.Interval(0, size)
        z_interval = rg.Interval(0, size)
        
        cube = rg.Box(base_plane, x_interval, y_interval, z_interval)
        if cube.IsValid:
            cubes[key] = cube.ToBrep()
        
        offset += size + 5  # Move to the next position with a gap of 5 units
    return cubes

# Define the cubes and their sizes
cubes_data = {
    'small_cube': 5,
    'medium_cube': 10,
    'large_cube': 15
}

# Generate the cubes
resulting_cubes = generate_cubes(cubes_data)

# Output the cubes for Grasshopper
a = resulting_cubes.get('small_cube')
b = resulting_cubes.get('medium_cube')
c = resulting_cubes.get('large_cube')
# ---------- end dicts_values_and_keys ----------
dicts_values_and_keys_2 = Script()  # -> out, a, b, c; disabled
# ---------- dicts_values_and_keys_2: Python ----------
import Rhino.Geometry as rg
import numpy as np

def trigonometric_surface(freq_components, x_vals, y_vals):
    """
    Evaluates Z values for a grid defined by x_vals and y_vals using the provided trigonometric polynomial.
    
    Args:
    - freq_components (dict): Dictionary with keys as 'sin' or 'cos' and values as frequencies.
    - x_vals, y_vals (np.array): X and Y grid values.
    
    Returns:
    - np.array: 2D grid of Z values.
    """
    Z = np.zeros((len(x_vals), len(y_vals)))
    
    for i, x in enumerate(x_vals):
        for j, y in enumerate(y_vals):
            z_val = 0
            for func, freq in freq_components.items():
                if func == 'sin':
                    z_val += np.sin(freq * x) * np.sin(freq * y)
                elif func == 'cos':
                    z_val += np.cos(freq * x) * np.cos(freq * y)
            Z[i, j] = z_val
            
    return Z

def generate_surfaces(data, x_range, y_range, resolution=100):
    """
    Generate surfaces based on the provided frequency data.
    
    Args:
    - data (dict): A dictionary with surface names and their frequency components.
    
    Returns:
    - dict: A dictionary with surface names and their corresponding Rhino.Geometry surface.
    """
    surfaces = {}
    
    x_vals = np.linspace(x_range[0], x_range[1], resolution)
    y_vals = np.linspace(y_range[0], y_range[1], resolution)
    
    for name, freq_components in data.items():
        Z = trigonometric_surface(freq_components, x_vals, y_vals)
        
        curves = []
        for j, y in enumerate(y_vals):
            points = [rg.Point3d(x, y, Z[i, j]) for i, x in enumerate(x_vals)]
            curve = rg.Curve.CreateInterpolatedCurve(points, 3)
            curves.append(curve)
        
        surface = rg.Brep.CreateFromLoft(curves, rg.Point3d.Unset, rg.Point3d.Unset, rg.LoftType.Normal, False)[0]
        surfaces[name] = surface
        
    return surfaces

# Define the surfaces and their frequency components
surface_data = {
    'surface_1': {'sin': 1, 'cos': 2},
    'surface_2': {'sin': 3, 'cos': 1},
    'surface_3': {'sin': 2, 'cos': 3}
}

# Generate the surfaces
resulting_surfaces = generate_surfaces(surface_data, [0, 10], [0, 10], resolution=50)

# Output the surfaces for Grasshopper
a = resulting_surfaces.get('surface_1')
b = resulting_surfaces.get('surface_2')
c = resulting_surfaces.get('surface_3')
# ---------- end dicts_values_and_keys_2 ----------
geometry = Geometry(dicts_values_and_keys_2.a)  # disabled
geometry_2 = Geometry(dicts_values_and_keys_2.b)  # disabled
geometry_3 = Geometry(dicts_values_and_keys_2.c)  # disabled
geometry_4 = Geometry(dicts_values_and_keys.a)  # disabled
geometry_5 = Geometry(dicts_values_and_keys.b)  # disabled
# 2nd gpt-4 Text Prompt
# Great, now create a much more complex model
# with complex trigonometric polynomials and the
# NUMPY python library. And be sure to use the
# Dictionaries Values and Keys  several times.
# gpt-4 2nd Response
# Alright, let's dive deeper.
# 
# Consider a scenario where we wish to create a
# 3D landscape of surfaces defined by
# trigonometric polynomials. Each surface will be
# defined by its frequency components. This is an
#  abstract way to incorporate complex
# trigonometric polynomials into our geometry creation.
# 
# Using numpy will facilitate our calculations.
# 
# Here's the idea:
# 
# We define a dictionary where keys are surface
# names and values are frequency components.
# For each surface, we evaluate a 2D grid of Z
# values using the trigonometric polynomial.
# Create a surface from the point grid.
geometry_6 = Geometry(dicts_values_and_keys.c)  # disabled
panel_8 = Panel(dicts_values_and_keys.out)  # disabled
entwine = Entwine(Branch00=geometry, Branch01=geometry_2, Branch02=geometry_3, FlattenInputs=True)  # disabled
panel_9 = Panel(dicts_values_and_keys_2.out)  # disabled
entwine_2 = Entwine(Branch00=geometry_4, Branch01=geometry_5, Branch02=geometry_6, FlattenInputs=True)  # disabled
dicts_values_and_keys_3 = Script(sin=Slider(-3.47, range=-5..5), cos=Slider(5, range=-5..5), res=Slider(13, range=0..50))  # -> out, a; inputs sin: Double, cos: Double, res: Int32
# ---------- dicts_values_and_keys_3: Python ----------
import Rhino.Geometry as rg
import numpy as np

def trigonometric_surface(freq_components, x_vals, y_vals):
    Z = np.zeros((len(x_vals), len(y_vals)))
    for i, x in enumerate(x_vals):
        for j, y in enumerate(y_vals):
            z_val = 0
            for func, freq in freq_components.items():
                if func == 'sin':
                    z_val += np.sin(freq * x) * np.sin(freq * y)
                elif func == 'cos':
                    z_val += np.cos(freq * x) * np.cos(freq * y)
            Z[i, j] = z_val
    return Z

def generate_surface(freq_components, x_range, y_range, resolution, loft_type):
    x_vals = np.linspace(x_range[0], x_range[1], resolution)
    y_vals = np.linspace(y_range[0], y_range[1], resolution)
    
    Z = trigonometric_surface(freq_components, x_vals, y_vals)
    
    curves = []
    for j, y in enumerate(y_vals):
        points = [rg.Point3d(x, y, Z[i, j]) for i, x in enumerate(x_vals)]
        curve = rg.Curve.CreateInterpolatedCurve(points, 3)
        curves.append(curve)
        
    surface = rg.Brep.CreateFromLoft(curves, rg.Point3d.Unset, rg.Point3d.Unset, loft_type, False)[0]
    return surface

# Input parameters from Grasshopper
freq_components_sin = _sin  # Example: Adjust this via a slider from 0 to 5
freq_components_cos = _cos  # Example: Adjust this via a slider from 0 to 5
x_range = [0, 10]  # Example: Use two number sliders to define the min and max
y_range = [0, 10]  # Example: Use two number sliders to define the min and max
resolution = res   # Example: Adjust this via a slider from 10 to 200
loft_type = rg.LoftType.Normal  # Example: Use a dropdown list to choose between different loft types

# Define frequency data based on inputs
freq_data = {'sin': freq_components_sin, 'cos': freq_components_cos}

# Generate the surface
resulting_surface = generate_surface(freq_data, x_range, y_range, resolution, loft_type)

# Output for Grasshopper
a = resulting_surface
# ---------- end dicts_values_and_keys_3 ----------
panel_10 = Panel(entwine)  # disabled
panel_11 = Panel(dicts_values_and_keys_3.out)
geometry_7 = Geometry(dicts_values_and_keys_3.a)
panel_12 = Panel(entwine_2)  # disabled
entwine_3 = Entwine(FlattenInputs=True)
panel_13 = Panel(geometry_7)

# ==== cluster Oscillation
list = ClusterInput()
list_length = ListLength(List=list)
B = ClusterInput()
division = Division(A=list_length, B=B)
cosine = Cosine(Value=division)
sine = Sine(Value=division)
result = ClusterOutput(sine)
result_2 = ClusterOutput(cosine)
