# Grasshopper definition 021_Membership_in.gh (Grasshopper 1.0.7)
# plug-ins: RhinoCodePluginGH

# 2nd gpt-4 Text Prompt
# Great, now create a much more complex model
# with complex trigonometric polynomials and the
# NUMPY python library. And be sure to use the
# Membership with Keyword "in" in Python 3. And
# be sure to use the Rhino common api to output
# geometries for data visualization.
# gpt-4 2nd Response
# Certainly! I'll provide a script that uses numpy to
# evaluate a complex trigonometric polynomial
# and then utilizes Rhino's API to visualize the
# results. The polynomial will be constructed using
# Fourier series components, which will represent complex sinusoids.
# 
# To keep things simple, I will:
# 
# Create a complex trigonometric polynomial in the form:
# P(t)=Σc k ⋅e ^ikωt
# where
# c k
# are complex coefficients and
# ω is the base frequency.
# Evaluate this polynomial over a range of
# 
# t values.
# Visualize the real and imaginary parts as curves in Rhino.
number_slider = Slider(20, range=-20..20.01)  # disabled
# gpt-4 Initial Response
# Certainly! To create a geometric 3D model in
# Grasshopper for Rhino8WIP using Python, we'll
#  use the Rhino Common API. Given your
# prompt, let's create a simple 3D geometric
# model comprising of a few basic shapes: a box,
# a sphere, and a cylinder. We'll then test for the
# membership of points inside these shapes.
# 
# Certainly! The keyword in is commonly used with
# lists, strings, and dictionaries to check for
# membership. In the context of geometry, we can
#  use it to test if a point is in a list of points or if a
# curve is in a list of curves, etc.
number_slider_2 = Slider(20, range=-20..20.01)  # disabled
number_slider_3 = Slider(20, range=-20..20.01)  # disabled

# ----
# #The Numpy Array:
# A Multidimensional Array Object
# test_random
number_slider_4 = Slider(4, range=0..4)  # disabled
number_slider_5 = Slider(5, range=0..20)  # disabled
numpy = Script(rows=number_slider_4, columns=number_slider_5)  # -> out, a, arr0_OUT, arr1_OUT, arr2_OUT, arr3_OUT; inputs rows: Int32, columns: Int32; disabled
# ---------- numpy: Python ----------
"""Grasshopper Script"""
#! python 3
a = "Welcome to Wickerson Studios!"
print(a)

# r: numpy

import numpy

arr = numpy.random.rand(rows, columns)

print(arr)
print(type(arr))
arr = arr.tolist()
print(arr)

arr_OUT = [arr[i] if i < rows else False for i in range(4)]
arr0_OUT, arr1_OUT, arr2_OUT, arr3_OUT = arr_OUT
# ---------- end numpy ----------
panel = Panel(numpy.a)  # disabled
number = Number(numpy.arr0_OUT)  # disabled
# 002 Python Refresher
# Container Data Structures
# Membership Keyword in
# gpt-4 Text Prompt
# Create a geometric 3D model with
# 
# Container Data Structures
# with
# Membership Keyword in,
# 
# in python 3 code for the python 3 script
# node in grasshopper for Rhino8WIP using the
# 
# Rhino Common API.
# 
# Output the parts of the model in different
# variable outputs in the python 3 node in
# grasshopper.
panel_2 = Panel(number)  # disabled
number_2 = Number(numpy.arr1_OUT)  # disabled
panel_3 = Panel(number_2)  # disabled
number_3 = Number(numpy.arr2_OUT)  # disabled
panel_4 = Panel(number_3)  # disabled
number_4 = Number(numpy.arr3_OUT)  # disabled
number_slider_6 = Slider(10, range=0..100)  # disabled
panel_5 = Panel(number_4)  # disabled
multiplication = Multiplication(A=number, B=number_slider_6)  # disabled
multiplication_2 = Multiplication(A=number_2, B=number_slider_6)  # disabled
construct_point = ConstructPoint(XCoordinate=multiplication, YCoordinate=graft(multiplication), ZCoordinate=0)  # disabled
construct_point_2 = ConstructPoint(XCoordinate=multiplication, YCoordinate=graft(multiplication), ZCoordinate=multiplication_2)  # disabled
unit_x = UnitX(Factor=number_3)  # disabled
line = Line(StartPoint=construct_point, EndPoint=construct_point_2)  # disabled
move = Move(Geometry=line, Motion=unit_x)  # -> Geometry, Transform; disabled
list_item = ListItem(List=graft(line), Index=0, Wrap=True)  # disabled
list_item_2 = ListItem(List=graft(move.Geometry), Index=0, Wrap=True)  # disabled
unit_y = UnitY(Factor=number_4)  # disabled
loft = Loft(
    Curves=[list_item, list_item_2],
    Options={Adjust=False, Closed=False, LoftEnds=0, LoftSimp=0, LoftType=0, Rebuild=10, Refit=0.01})  # disabled
extrude = Extrude(Base=loft, Direction=graft(unit_y))  # disabled

# ----
# Oscillation Algorithm
# The oscillation algorithm can be use to animate
# any geometry that is driven by a number sliders.
# Simply swap out the number sliders at the
# multiplication node in the oscillation script.
panel_6 = Panel("1")
trigger = Trigger(Interval=20, TimerInterval=20, Target=data_recorder)
data_recorder = DataRecorder(panel_6, DataLimit=-10, RecordData=False)
oscillation = Oscillation(list=data_recorder, B=Slider(126, range=0..1000))  # -> result, result_2
panel_7 = Panel([oscillation.result, oscillation.result_2])
multiplication_3 = Multiplication(A=oscillation.result)
multiplication_4 = Multiplication(A=oscillation.result, B=Slider(1.92, range=0.1..10))

membership_keyword_in = Script(xPt=number_slider_2, yPt=number_slider_3, zPt=number_slider)  # -> out, Box, Sphere, Cylinder, InBox, InSphere, InCylinder, point; inputs xPt: Double, yPt: Double, zPt: Double; disabled
# ---------- membership_keyword_in: Python ----------
import Rhino.Geometry as rg

def create_shapes():
    """Creates a box, a sphere, and a cylinder."""
    # Create a Box
    box = rg.Box(rg.Plane.WorldXY, rg.Interval(-10, 10), rg.Interval(-10, 10), rg.Interval(0, 20))
    
    # Create a Sphere
    center = rg.Point3d(0, 0, 10)
    sphere = rg.Sphere(center, 5)
    sphere_brep = rg.Brep.CreateFromSphere(sphere)
    
    # Create a Cylinder
    base_circle = rg.Circle(rg.Plane.WorldXY, 5)
    cyl = rg.Cylinder(base_circle, 20)
    
    return box, sphere_brep, cyl

def is_point_inside_cylinder(cyl, point):
    """Checks if a point is inside a cylinder."""
    # Create a circle for the base of the cylinder
    base_circle = rg.Circle(cyl.BasePlane, cyl.Radius)
    
    # Convert the circle to a curve
    base_curve = base_circle.ToNurbsCurve()
    
    # Create a surface by extruding the base curve
    extrusion = rg.Surface.CreateExtrusion(base_curve, rg.Vector3d(cyl.BasePlane.ZAxis) * cyl.TotalHeight)
    
    # Convert the surface to its Brep representation
    cyl_brep = extrusion.ToBrep()
    
    # Compute bounding box for the cylinder
    bounding_box = cyl_brep.GetBoundingBox(False)
    height = bounding_box.Max.Z - bounding_box.Min.Z
    
    # Check the height
    height_check = bounding_box.Min.Z <= point.Z <= bounding_box.Max.Z
    
    # Check radial distance
    distance = point.DistanceTo(cyl.BasePlane.Origin)
    radial_check = distance <= cyl.Radius
    
    return height_check and radial_check



def test_membership(shapes, point):
    """Tests if a point is inside the given shapes."""
    box, sphere_brep, cyl = shapes
    in_box = box.Contains(point)
    
    # Get bounding box of the sphere Brep to calculate center
    bounding_box = sphere_brep.GetBoundingBox(False)
    center = bounding_box.Center
    radius = (bounding_box.Max - center).Length
    
    # Check if the point is inside the sphere
    dist_to_sphere_center = point.DistanceTo(center)
    in_sphere = dist_to_sphere_center <= radius
    
    in_cyl = is_point_inside_cylinder(cyl, point)
    
    return in_box, in_sphere, in_cyl

# Create the geometric shapes
shapes = create_shapes()

# Test the point's membership in the shapes
point = rg.Point3d(xPt, yPt, zPt)
in_box, in_sphere, in_cyl = test_membership(shapes, point)

# Outputs
Box, Sphere, Cylinder = shapes
InBox, InSphere, InCylinder = in_box, in_sphere, in_cyl
# ---------- end membership_keyword_in ----------
membership_keyword_in_2 = Script(
    omega=multiplication_4,
    r1=Slider(4.5, range=-10..10.01),
    c1j=Slider(-3.78, range=-10..10.01),
    r2=Slider(4.15, range=-10..10.01),
    c2j=Slider(-3.47, range=-10..10.01),
    r3=Slider(0.75, range=-10..10.01),
    c3j=Slider(1.7, range=-10..10.01),
    r4=Slider(6.32, range=-10..10.01),
    c4j=Slider(4.14, range=-10..10.01))  # -> out, a, b, P_values; inputs omega: Double, r1: Double, c1j: Double, r2: Double, c2j: Double, r3: Double, c3j: Double, r4: Double, c4j: Double
# ---------- membership_keyword_in_2: Python ----------
import numpy as np
import Rhino.Geometry as rg

# Parameters
t_values = np.linspace(0, 2 * np.pi, 1000)  # t values
#omega = 2.0  # base frequency
coefficients = [r1+c1j, r2-c2j, r3+c3j, r4-c4j]  # example complex coefficients

# Evaluate the complex trigonometric polynomial
def evaluate_trig_poly(t, coeffs, omega):
    result = 0
    for k, coeff in enumerate(coeffs):
        result += coeff * np.exp(1j * k * omega * t)
    return result

P_values = [evaluate_trig_poly(t, coefficients, omega) for t in t_values]

# Convert to Rhino curves for visualization
real_pts = [rg.Point3d(t, P.real, 0) for t, P in zip(t_values, P_values)]
imaginary_pts = [rg.Point3d(t, P.imag, 0) for t, P in zip(t_values, P_values)]

real_curve = rg.Curve.CreateInterpolatedCurve(real_pts, 3)
imaginary_curve = rg.Curve.CreateInterpolatedCurve(imaginary_pts, 3)

# Check membership
test_value = -4.3297802811774646e-17
is_in_real = test_value in [pt.Y for pt in real_pts]
is_in_imaginary = test_value in [pt.Y for pt in imaginary_pts]

print(f"Test value in real curve points: {is_in_real}")
print(f"Test value in imaginary curve points: {is_in_imaginary}")

# Output for Grasshopper
a = real_curve
b = imaginary_curve
# ---------- end membership_keyword_in_2 ----------
point = Point(membership_keyword_in.point)  # disabled
panel_8 = Panel([membership_keyword_in.InBox, membership_keyword_in.InSphere, membership_keyword_in.InCylinder])  # disabled
geometry = Geometry(membership_keyword_in.Box)  # disabled
geometry_2 = Geometry(membership_keyword_in.Cylinder)  # disabled
geometry_3 = Geometry(membership_keyword_in.Sphere)  # disabled
geometry_4 = Geometry(membership_keyword_in_2.a)
geometry_5 = Geometry(membership_keyword_in_2.b)
panel_9 = Panel(membership_keyword_in.out)  # disabled
panel_10 = Panel(membership_keyword_in_2.P_values)
panel_11 = Panel(membership_keyword_in_2.out)
entwine = Entwine(Branch00=geometry, Branch01=geometry_3, Branch02=geometry_2, Branch03=point, FlattenInputs=True)  # disabled
entwine_2 = Entwine(Branch00=geometry_4, Branch01=geometry_5, FlattenInputs=True)
panel_12 = Panel(entwine)  # disabled
panel_13 = Panel(entwine_2)

# ==== cluster Oscillation
list = ClusterInput()
list_length = ListLength(List=list)
B = ClusterInput()
division = Division(A=list_length, B=B)
cosine = Cosine(Value=division)
sine = Sine(Value=division)
result = ClusterOutput(sine)
result_2 = ClusterOutput(cosine)
