# Grasshopper definition 022_List_Set_Comprehension.gh (Grasshopper 1.0.7)
# plug-ins: RhinoCodePluginGH

number_slider = Slider(2, range=1..5)  # disabled
number_slider_2 = Slider(2, range=1..5)  # disabled
# 2nd gpt-4 Text Prompt
# Great, now create a much more complex model
# with complex trigonometric polynomials and the
# NUMPY python library. And be sure to use the
# 
# List and Set Comprehension
# 
# in Python 3.
# 
# And be sure to use the Rhino common api to output
# geometries for data visualization.
number_slider_3 = Slider(3, range=1..5)  # disabled

# ----
# Oscillation Algorithm
# The oscillation algorithm can be use to animate
# any geometry that is driven by a number sliders.
# Simply swap out the number sliders at the
# multiplication node in the oscillation script.
panel = Panel("1")
trigger = Trigger(Interval=20, TimerInterval=20, Target=data_recorder)
data_recorder = DataRecorder(panel, DataLimit=-10, RecordData=False)
oscillation = Oscillation(list=data_recorder, B=Slider(126, range=0..1000))  # -> result, result_2
panel_2 = Panel([oscillation.result, oscillation.result_2])
multiplication = Multiplication(A=oscillation.result, B=Slider(5.37, range=0..10))
multiplication_2 = Multiplication(A=oscillation.result, B=Slider(6.2, range=0..10))

# ----
# #The Numpy Array:
# A Multidimensional Array Object
# test_random
number_slider_4 = Slider(4, range=0..4)  # disabled
number_slider_5 = Slider(5, range=0..20)  # disabled
numpy = Script(rows=number_slider_4, columns=number_slider_5)  # -> out, a, arr0_OUT, arr1_OUT, arr2_OUT, arr3_OUT; inputs rows: Int32, columns: Int32; disabled
# ---------- numpy: Python ----------
"""Grasshopper Script"""
#! python 3
a = "Welcome to Wickerson Studios!"
print(a)

# r: numpy

import numpy

arr = numpy.random.rand(rows, columns)

print(arr)
print(type(arr))
arr = arr.tolist()
print(arr)

arr_OUT = [arr[i] if i < rows else False for i in range(4)]
arr0_OUT, arr1_OUT, arr2_OUT, arr3_OUT = arr_OUT
# ---------- end numpy ----------
panel_3 = Panel(numpy.a)  # disabled
number = Number(numpy.arr0_OUT)  # disabled
# 002 Python Refresher
# Container Data Structures
# List and Set Comprehension
# gpt-4 Text Prompt
# Create a geometric 3D model with
# 
# Container Data Structures
# with
# List and Set Comprehension
# 
# in python 3 code for the python 3 script
# node in grasshopper for Rhino8WIP using the
# 
# Rhino Common API.
# 
# Output the parts of the model in different
# variable outputs in the python 3 node in
# grasshopper.
panel_4 = Panel(number)  # disabled
number_2 = Number(numpy.arr1_OUT)  # disabled
panel_5 = Panel(number_2)  # disabled
number_3 = Number(numpy.arr2_OUT)  # disabled
panel_6 = Panel(number_3)  # disabled
number_4 = Number(numpy.arr3_OUT)  # disabled
number_slider_6 = Slider(10, range=0..100)  # disabled
panel_7 = Panel(number_4)  # disabled
multiplication_3 = Multiplication(A=number, B=number_slider_6)  # disabled
multiplication_4 = Multiplication(A=number_2, B=number_slider_6)  # disabled
construct_point = ConstructPoint(XCoordinate=multiplication_3, YCoordinate=graft(multiplication_3), ZCoordinate=0)  # disabled
construct_point_2 = ConstructPoint(XCoordinate=multiplication_3, YCoordinate=graft(multiplication_3), ZCoordinate=multiplication_4)  # disabled
unit_x = UnitX(Factor=number_3)  # disabled
line = Line(StartPoint=construct_point, EndPoint=construct_point_2)  # disabled
move = Move(Geometry=line, Motion=unit_x)  # -> Geometry, Transform; disabled
list_item = ListItem(List=graft(line), Index=0, Wrap=True)  # disabled
list_item_2 = ListItem(List=graft(move.Geometry), Index=0, Wrap=True)  # disabled
unit_y = UnitY(Factor=number_4)  # disabled
loft = Loft(
    Curves=[list_item, list_item_2],
    Options={Adjust=False, Closed=False, LoftEnds=0, LoftSimp=0, LoftType=0, Rebuild=10, Refit=0.01})  # disabled
extrude = Extrude(Base=loft, Direction=graft(unit_y))  # disabled

# ----
# gpt-4 2nd Response
# Sure, let's create a more complex geometric
# model using trigonometric polynomials and the
# numpy library. We'll design a sine wave across
# the x-axis that varies its amplitude based on a
# cosine wave on the y-axis. This will give a kind of
# undulating wave appearance when visualized.
list_and_set_comprehension = Script()  # -> out, A, B; inputs c4j: Double; disabled
# ---------- list_and_set_comprehension: Python ----------
import Rhino.Geometry as rg
import numpy as np

def generate_points(x_range, y_range, step=1.0):
    """Generate a set of points based on complex trigonometric polynomials."""
    x_values = np.arange(-x_range, x_range, step)
    y_values = np.arange(-y_range, y_range, step)
    
    points = [rg.Point3d(x, y, np.sin(x) * np.cos(y)) for x in x_values for y in y_values]
    return points

def create_surfaces_from_points(points, x_range, y_range, step):
    """Generate surfaces from a list of points using set comprehension."""
    surfaces = set()
    for x in np.arange(-x_range, x_range - step, step):
        for y in np.arange(-y_range, y_range - step, step):
            pt1 = rg.Point3d(x, y, np.sin(x) * np.cos(y))
            pt2 = rg.Point3d(x + step, y, np.sin(x + step) * np.cos(y))
            pt3 = rg.Point3d(x + step, y + step, np.sin(x + step) * np.cos(y + step))
            pt4 = rg.Point3d(x, y + step, np.sin(x) * np.cos(y + step))
            
            surfaces.add(rg.NurbsSurface.CreateFromCorners(pt1, pt2, pt3, pt4))
    return surfaces

# Parameters
x_range = 10.0
y_range = 10.0
step = 0.5

# Generate points based on complex trigonometric polynomials
points = generate_points(x_range, y_range, step)

# Create surfaces from the generated points
surfaces = create_surfaces_from_points(points, x_range, y_range, step)

# Output the points and surfaces
A = points
B = list(surfaces)
# ---------- end list_and_set_comprehension ----------
# gpt-4 Initial Response
# Certainly! Creating a geometric 3D model
# requires deciding on the form or structure you
# want to create. For demonstration purposes, I'll
# create a simple model where a grid of points in
# 3D space represents spheres. We'll use list
# comprehension to create these points, and then
#  we'll create a set of spheres at these points
# using set comprehension (although using set
# comprehension for creating objects like this is
# unconventional).
list_and_set_comprehension_2 = Script(x=number_slider, y=number_slider_2, z=number_slider_3)  # -> out, A, B; inputs x: Int32, y: Int32, z: Int32; disabled
# ---------- list_and_set_comprehension_2: Python ----------
import Rhino.Geometry as rg

def create_3d_grid_points(x_count, y_count, z_count, spacing):
    """Generate a 3D grid of points using list comprehension."""
    return [rg.Point3d(i * spacing, j * spacing, k * spacing) for i in range(x_count) for j in range(y_count) for k in range(z_count)]

def create_spheres_from_points(points, radius):
    """Generate spheres from a list of points using set comprehension."""
    return {rg.Sphere(point, radius).ToBrep() for point in points}

# Parameters
x_count = x
y_count = y
z_count = z
spacing = 5.0
radius = 2.0

# Create a 3D grid of points
points = create_3d_grid_points(x_count, y_count, z_count, spacing)

# Create spheres at each of the grid points
spheres = create_spheres_from_points(points, radius)

# Output the points and spheres
A = points
B = list(spheres)
# ---------- end list_and_set_comprehension_2 ----------
geometry = Geometry(list_and_set_comprehension.A)  # disabled
geometry_2 = Geometry(list_and_set_comprehension.B)  # disabled
geometry_3 = Geometry(list_and_set_comprehension_2.B)  # disabled
point = Point(list_and_set_comprehension_2.A)  # disabled
panel_8 = Panel(list_and_set_comprehension.out)  # disabled
panel_9 = Panel(list_and_set_comprehension_2.out)  # disabled
entwine = Entwine(Branch00=geometry, Branch01=geometry_2, FlattenInputs=True)  # disabled
list_and_set_comprehension_3 = Script(x_range=multiplication_2, y_range=multiplication, step=Slider(1, range=0.5..1))  # -> out, A, B; inputs x_range: Double, y_range: Double, step: Double
# ---------- list_and_set_comprehension_3: Python ----------
import Rhino.Geometry as rg
import numpy as np

def generate_points(x_range, y_range, step=1.0):
    """Generate a set of points based on complex trigonometric polynomials."""
    x_values = np.arange(-x_range, x_range, step)
    y_values = np.arange(-y_range, y_range, step)
    
    points = [rg.Point3d(x, y, np.sin(x) * np.cos(y)) for x in x_values for y in y_values]
    return points

def create_surfaces_from_points(points, x_range, y_range, step):
    """Generate surfaces from a list of points using set comprehension."""
    surfaces = set()
    for x in np.arange(-x_range, x_range - step, step):
        for y in np.arange(-y_range, y_range - step, step):
            pt1 = rg.Point3d(x, y, np.sin(x) * np.cos(y))
            pt2 = rg.Point3d(x + step, y, np.sin(x + step) * np.cos(y))
            pt3 = rg.Point3d(x + step, y + step, np.sin(x + step) * np.cos(y + step))
            pt4 = rg.Point3d(x, y + step, np.sin(x) * np.cos(y + step))
            
            surfaces.add(rg.NurbsSurface.CreateFromCorners(pt1, pt2, pt3, pt4))
    return surfaces

# Parameters
#x_range = 10.0
#y_range = 10.0
#step = 0.5

# Generate points based on complex trigonometric polynomials
points = generate_points(x_range, y_range, step)

# Create surfaces from the generated points
surfaces = create_surfaces_from_points(points, x_range, y_range, step)

# Output the points and surfaces
A = points
B = list(surfaces)
# ---------- end list_and_set_comprehension_3 ----------
entwine_2 = Entwine(Branch00=point, Branch01=geometry_3, FlattenInputs=True)  # disabled
panel_10 = Panel(entwine)  # disabled
geometry_4 = Geometry(list_and_set_comprehension_3.A)
geometry_5 = Geometry(list_and_set_comprehension_3.B)
panel_11 = Panel(entwine_2)  # disabled
panel_12 = Panel(list_and_set_comprehension_3.out)
entwine_3 = Entwine(Branch00=geometry_4, Branch01=geometry_5, FlattenInputs=True)
panel_13 = Panel(entwine_3)

# ==== cluster Oscillation
list = ClusterInput()
list_length = ListLength(List=list)
B = ClusterInput()
division = Division(A=list_length, B=B)
cosine = Cosine(Value=division)
sine = Sine(Value=division)
result = ClusterOutput(sine)
result_2 = ClusterOutput(cosine)
