# Grasshopper definition 023_if_elif_else.gh (Grasshopper 1.0.7)
# plug-ins: RhinoCodePluginGH

# ----
# Oscillation Algorithm
# The oscillation algorithm can be use to animate
# any geometry that is driven by a number sliders.
# Simply swap out the number sliders at the
# multiplication node in the oscillation script.
panel = Panel("1")
trigger = Trigger(Interval=20, TimerInterval=20, Target=data_recorder)
data_recorder = DataRecorder(panel, DataLimit=-10, RecordData=False)
oscillation = Oscillation(list=data_recorder, B=Slider(118, range=0..1000))  # -> result, result_2
panel_2 = Panel([oscillation.result, oscillation.result_2])
multiplication = Multiplication(A=oscillation.result)
multiplication_2 = Multiplication(A=oscillation.result)

# ----
# gpt-4 Initial Response
# Certainly! Below is an example of a Python 3
# script that uses container data structures (lists
# in this case), control flow (if, elif, and else), and
# the Rhino Common API to create simple 3D
# geometric shapes (a box, sphere, and cylinder)
# based on an input parameter. This script is
# intended for use with the Python 3 script node in
#  Grasshopper for Rhino 8 WIP.
number_slider = Slider(1, range=0..2)  # disabled

# ----
# #The Numpy Array:
# A Multidimensional Array Object
# test_random
number_slider_2 = Slider(4, range=0..4)  # disabled
number_slider_3 = Slider(5, range=0..20)  # disabled
numpy = Script(rows=number_slider_2, columns=number_slider_3)  # -> out, a, arr0_OUT, arr1_OUT, arr2_OUT, arr3_OUT; inputs rows: Int32, columns: Int32; disabled
# ---------- numpy: Python ----------
"""Grasshopper Script"""
#! python 3
a = "Welcome to Wickerson Studios!"
print(a)

# r: numpy

import numpy

arr = numpy.random.rand(rows, columns)

print(arr)
print(type(arr))
arr = arr.tolist()
print(arr)

arr_OUT = [arr[i] if i < rows else False for i in range(4)]
arr0_OUT, arr1_OUT, arr2_OUT, arr3_OUT = arr_OUT
# ---------- end numpy ----------
panel_3 = Panel(numpy.a)  # disabled
number = Number(numpy.arr0_OUT)  # disabled
# 002 Python Refresher
# Control Flow
# Control Flow: if, elif, else
# gpt-4 Text Prompt
# Create a geometric 3D model with
# 
# Container Data Structures
# with
# Control Flow: if, elif, else
# 
# in python 3 code for the python 3 script
# node in grasshopper for Rhino8WIP using the
# 
# Rhino Common API.
# 
# Output the parts of the model in different
# variable outputs in the python 3 node in
# grasshopper.
panel_4 = Panel(number)  # disabled
number_2 = Number(numpy.arr1_OUT)  # disabled
panel_5 = Panel(number_2)  # disabled
number_3 = Number(numpy.arr2_OUT)  # disabled
panel_6 = Panel(number_3)  # disabled
number_4 = Number(numpy.arr3_OUT)  # disabled
number_slider_4 = Slider(10, range=0..100)  # disabled
panel_7 = Panel(number_4)  # disabled
multiplication_3 = Multiplication(A=number, B=number_slider_4)  # disabled
multiplication_4 = Multiplication(A=number_2, B=number_slider_4)  # disabled
construct_point = ConstructPoint(XCoordinate=multiplication_3, YCoordinate=graft(multiplication_3), ZCoordinate=0)  # disabled
construct_point_2 = ConstructPoint(XCoordinate=multiplication_3, YCoordinate=graft(multiplication_3), ZCoordinate=multiplication_4)  # disabled
unit_x = UnitX(Factor=number_3)  # disabled
line = Line(StartPoint=construct_point, EndPoint=construct_point_2)  # disabled
move = Move(Geometry=line, Motion=unit_x)  # -> Geometry, Transform; disabled
list_item = ListItem(List=graft(line), Index=0, Wrap=True)  # disabled
list_item_2 = ListItem(List=graft(move.Geometry), Index=0, Wrap=True)  # disabled
unit_y = UnitY(Factor=number_4)  # disabled
loft = Loft(
    Curves=[list_item, list_item_2],
    Options={Adjust=False, Closed=False, LoftEnds=0, LoftSimp=0, LoftType=0, Rebuild=10, Refit=0.01})  # disabled
extrude = Extrude(Base=loft, Direction=graft(unit_y))  # disabled

multiplication_5 = Multiplication(A=oscillation.result, B=Slider(1.32, range=-3..3))
number_slider_5 = Slider(19, range=0..100)
# Alright, let's approach this differently.
# 
# We'll create a grid of points, just like before. For each point,
# based on the trigonometric polynomial, we'll determine which
# type of geometric shape to generate. The control flow with
# if, elif, and else will be used to decide the shape.
# 
# If the trig value is between -0.5 and 0.5, a small sphere will be created.
# If the trig value is less than -0.5, a cone will be generated.
# For all other values (greater than 0.5), a cylinder will be constructed.
multiplication_6 = Multiplication(A=oscillation.result, B=number_slider_5)
multiplication_7 = Multiplication(A=oscillation.result, B=Slider(1.03, range=-3..3))
multiplication_8 = Multiplication(A=oscillation.result, B=Slider(0.65, range=-3..3))
multiplication_9 = Multiplication(A=oscillation.result, B=Slider(0.31, range=-3..3))
multiplication_10 = Multiplication(A=oscillation.result, B=Slider(0.79, range=-3..3))
multiplication_11 = Multiplication(A=oscillation.result, B=Slider(0.36, range=-3..3))
multiplication_12 = Multiplication(A=oscillation.result, B=Slider(1.99, range=-3..3))
panel_8 = Panel("box")  # disabled
panel_9 = Panel("sphere")  # disabled
# 2nd gpt-4 Text Prompt
# Great, now create a much more complex model
# with complex trigonometric polynomials and the
# NUMPY python library. And be sure to use the
# 
# Control Flow with if, elif, and else
# 
# in Python 3.
# 
# And be sure to use the Rhino common api to output
# geometries for data visualization.
# gpt-4 2nd Response
panel_10 = Panel("cylinder")  # disabled
stream_filter = StreamFilter(Gate=number_slider, Stream0=panel_8, Stream1=panel_9, Stream2=panel_10)  # disabled
if_elif_else = Script(
    res=number_slider_5,
    cone_h=multiplication_7,
    cone_r=multiplication_8,
    cyl_h=multiplication_9,
    cyl_r=multiplication_10,
    box_h=multiplication_5,
    box_l=multiplication_11,
    box_w=multiplication_12)  # -> out, output_geometry; inputs res: Int32, cone_h: Double, cone_r: Double, cyl_h: Double, cyl_r: Double, box_h: Double, box_l: Double, box_w: Double
# ---------- if_elif_else: Python ----------
import Rhino.Geometry as rg
import numpy as np

# Define our trigonometric polynomial function
def trig_function(x, y):
    val = np.sin(x) + np.cos(y)  # Modify this to your desired complex trig function
    if val > 0.5:
        return 'cone'
    elif val < -0.5:
        return 'cylinder'
    else:
        return 'box'

def generate_geometries(domain=(-10,10), resolution=10, cone_height=2, cone_radius=1, cyl_height=2, cyl_radius=1, box_height=2, box_length=1, box_width=1):
    # Create a grid of points in the XY-plane
    x = np.linspace(domain[0], domain[1], resolution)
    y = np.linspace(domain[0], domain[1], resolution)

    geometries = []

    for i in x:
        for j in y:
            shape = trig_function(i, j)
            base_pt = rg.Point3d(i, j, 0)
            base_plane = rg.Plane(base_pt, rg.Vector3d.ZAxis)  # Establishing a vertical plane at the base point

            if shape == 'cone':
                cone = rg.Cone(base_plane, cone_height, cone_radius)
                srf = cone.ToRevSurface()
                if srf:
                    brep = srf.ToBrep()
                    geometries.append(brep)

            elif shape == 'cylinder':
                circle = rg.Circle(base_pt, cyl_r)
                cylinder = rg.Cylinder(circle, cyl_h)
                srf = cylinder.ToRevSurface()
                if srf:
                    brep = srf.ToBrep()
                    geometries.append(brep)

            else:  # box
                corner1 = rg.Point3d(i-box_length/2, j-box_width/2, 0)
                corner2 = rg.Point3d(i+box_length/2, j+box_width/2, box_height)
                bbox = rg.BoundingBox(corner1, corner2)
                box = rg.Box(bbox)
                geometries.append(box.ToBrep())

    return geometries

# Example usage
output_geometry = generate_geometries(domain=(-5,5), resolution=res, cone_height=cone_h, cone_radius=cone_r, box_height=box_h, box_length=box_l, box_width=box_w)
# ---------- end if_elif_else ----------
if_elif_else_2 = Script()  # -> out, output_geometry; disabled
# ---------- if_elif_else_2: Python ----------
import Rhino.Geometry as rg
import numpy as np

# Define our trigonometric polynomial function
def trig_function(x, y):
    val = np.sin(x) + np.cos(y)  # Change this to your desired complex trig function
    if val > 0.5:
        return 'cone'
    elif val < -0.5:
        return 'cylinder'
    else:
        return 'box'

# Create a grid of points in the XY-plane
x = np.linspace(-10, 10, 10)
y = np.linspace(-10, 10, 10)

geometries = []

for i in x:
    for j in y:
        shape = trig_function(i, j)
        base_pt = rg.Point3d(i, j, 0)
        base_plane = rg.Plane(base_pt, rg.Vector3d.ZAxis)  # Establishing a vertical plane at the base point

        if shape == 'cone':
            cone = rg.Cone(base_plane, 2, 1)  # Height = 2, Radius = 1
            srf = cone.ToRevSurface()
            if srf:
                brep = srf.ToBrep()
                geometries.append(brep)

        elif shape == 'cylinder':
            circle = rg.Circle(base_pt, 1)  # Radius = 1
            cylinder = rg.Cylinder(circle, 2)  # Height = 2
            srf = cylinder.ToRevSurface()
            if srf:
                brep = srf.ToBrep()
                geometries.append(brep)

        else:  # box
            corner1 = rg.Point3d(i-0.5, j-0.5, 0)
            corner2 = rg.Point3d(i+0.5, j+0.5, 2)  # Height = 2
            bbox = rg.BoundingBox(corner1, corner2)
            box = rg.Box(bbox)
            geometries.append(box.ToBrep())

output_geometry = geometries
# ---------- end if_elif_else_2 ----------
if_elif_else_3 = Script(x=stream_filter)  # -> out, box_out, sphere_out, cylinder_out; inputs x: String; disabled
# ---------- if_elif_else_3: Python ----------
import Rhino.Geometry as rg

def create_geometry(shape_type):
    # Define a base point for creating geometry
    origin = rg.Point3d(0, 0, 0)
    
    # Check the type of shape and create accordingly
    if shape_type == "box":
        # Creating a box of dimensions 10x10x10 using BoundingBox
        corner1 = rg.Point3d(0, 0, 0)
        corner2 = rg.Point3d(10, 10, 10)
        bbox = rg.BoundingBox(corner1, corner2)
        return rg.Box(bbox)
    
    elif shape_type == "sphere":
        # Creating a sphere with radius 5
        sphere = rg.Sphere(origin, 5)
        return sphere.ToBrep()  # Convert the sphere to a Brep for Grasshopper
    

    elif shape_type == "cylinder":
        # Creating a cylinder with radius 4 and height 8
        circle = rg.Circle(origin, 4)
        cylinder = rg.Cylinder(circle, 8)
        cylinder_surface = cylinder.ToRevSurface()
        return cylinder_surface.ToBrep()
    else:
        print("Invalid shape type!")
        return None

# Input: shape_type (str) - one of "box", "sphere", "cylinder"
shape_type = x  # Replace with desired input from Grasshopper

# Get the geometry
geometry = create_geometry(shape_type)

# Initialize outputs to None (no geometry)
box_out = None
sphere_out = None
cylinder_out = None

# Determine which output to assign based on geometry created
if geometry:
    if shape_type == "box":
        box_out = geometry
    elif shape_type == "sphere":
        sphere_out = geometry
    elif shape_type == "cylinder":
        cylinder_out = geometry
# ---------- end if_elif_else_3 ----------
geometry = Geometry(if_elif_else_2.output_geometry)  # disabled
geometry_2 = Geometry(if_elif_else.output_geometry)
panel_11 = Panel(if_elif_else_2.out)  # disabled
panel_12 = Panel(if_elif_else.out)
geometry_3 = Geometry(if_elif_else_3.sphere_out)  # disabled
geometry_4 = Geometry(if_elif_else_3.cylinder_out)  # disabled
geometry_5 = Geometry(if_elif_else_3.box_out)  # disabled
entwine = Entwine(FlattenInputs=True)  # disabled
entwine_2 = Entwine(FlattenInputs=True)
panel_13 = Panel(if_elif_else_3.out)  # disabled
entwine_3 = Entwine(Branch00=geometry_5, Branch01=geometry_3, Branch02=geometry_4, FlattenInputs=True)  # disabled
panel_14 = Panel(geometry)  # disabled
panel_15 = Panel(geometry_2)
panel_16 = Panel(entwine_3)  # disabled

# ==== cluster Oscillation
list = ClusterInput()
list_length = ListLength(List=list)
B = ClusterInput()
division = Division(A=list_length, B=B)
cosine = Cosine(Value=division)
sine = Sine(Value=division)
result = ClusterOutput(sine)
result_2 = ClusterOutput(cosine)
