# Grasshopper definition 024_Control_Flow_Loops.gh (Grasshopper 1.0.7)
# plug-ins: RhinoCodePluginGH

# ----
# Oscillation Algorithm
# The oscillation algorithm can be use to animate
# any geometry that is driven by a number sliders.
# Simply swap out the number sliders at the
# multiplication node in the oscillation script.
panel = Panel("1")
trigger = Trigger(Interval=20, TimerInterval=20, Target=data_recorder)
data_recorder = DataRecorder(panel, DataLimit=-10, RecordData=False)
oscillation = Oscillation(list=data_recorder, B=Slider(118, range=0..1000))  # -> result, result_2
panel_2 = Panel([oscillation.result, oscillation.result_2])
multiplication = Multiplication(A=oscillation.result)
multiplication_2 = Multiplication(A=oscillation.result)

multiplication_3 = Multiplication(A=oscillation.result, B=Slider(1, range=0..1))
multiplication_4 = Multiplication(A=oscillation.result, B=Slider(1, range=0..1))
multiplication_5 = Multiplication(A=oscillation.result, B=Slider(10, range=0..10))

# ----
# #The Numpy Array:
# A Multidimensional Array Object
# test_random
number_slider = Slider(4, range=0..4)  # disabled
number_slider_2 = Slider(5, range=0..20)  # disabled
numpy = Script(rows=number_slider, columns=number_slider_2)  # -> out, a, arr0_OUT, arr1_OUT, arr2_OUT, arr3_OUT; inputs rows: Int32, columns: Int32; disabled
# ---------- numpy: Python ----------
"""Grasshopper Script"""
#! python 3
a = "Welcome to Wickerson Studios!"
print(a)

# r: numpy

import numpy

arr = numpy.random.rand(rows, columns)

print(arr)
print(type(arr))
arr = arr.tolist()
print(arr)

arr_OUT = [arr[i] if i < rows else False for i in range(4)]
arr0_OUT, arr1_OUT, arr2_OUT, arr3_OUT = arr_OUT
# ---------- end numpy ----------
panel_3 = Panel(numpy.a)  # disabled
number = Number(numpy.arr0_OUT)  # disabled
# 002 Python Refresher
# Control Flow
# Control Flow: For Loop
# gpt-4 Text Prompt
# Create a geometric 3D model with
# 
# Container Data Structures
# with
# Control Flow: For Loop
# 
# in python 3 code for the python 3 script
# node in grasshopper for Rhino8WIP using the
# 
# Rhino Common API.
# 
# Output the parts of the model in different
# variable outputs in the python 3 node in
# grasshopper.
panel_4 = Panel(number)  # disabled
number_2 = Number(numpy.arr1_OUT)  # disabled
panel_5 = Panel(number_2)  # disabled
number_3 = Number(numpy.arr2_OUT)  # disabled
panel_6 = Panel(number_3)  # disabled
number_4 = Number(numpy.arr3_OUT)  # disabled
number_slider_3 = Slider(10, range=0..100)  # disabled
panel_7 = Panel(number_4)  # disabled
multiplication_6 = Multiplication(A=number, B=number_slider_3)  # disabled
multiplication_7 = Multiplication(A=number_2, B=number_slider_3)  # disabled
construct_point = ConstructPoint(XCoordinate=multiplication_6, YCoordinate=graft(multiplication_6), ZCoordinate=0)  # disabled
construct_point_2 = ConstructPoint(XCoordinate=multiplication_6, YCoordinate=graft(multiplication_6), ZCoordinate=multiplication_7)  # disabled
unit_x = UnitX(Factor=number_3)  # disabled
line = Line(StartPoint=construct_point, EndPoint=construct_point_2)  # disabled
move = Move(Geometry=line, Motion=unit_x)  # -> Geometry, Transform; disabled
list_item = ListItem(List=graft(line), Index=0, Wrap=True)  # disabled
list_item_2 = ListItem(List=graft(move.Geometry), Index=0, Wrap=True)  # disabled
unit_y = UnitY(Factor=number_4)  # disabled
loft = Loft(
    Curves=[list_item, list_item_2],
    Options={Adjust=False, Closed=False, LoftEnds=0, LoftSimp=0, LoftType=0, Rebuild=10, Refit=0.01})  # disabled
extrude = Extrude(Base=loft, Direction=graft(unit_y))  # disabled

# ----
# gpt-4 Initial Response
# Certainly! Let's create a simple geometric 3D model
# using the Rhino Common API.
# 
# In this example, we'll generate a grid of spheres in
# Rhino using Python. The size of the grid and the
# distance between the spheres will be dictated
# by input parameters.
number_slider_4 = Slider(4, range=1..5)  # disabled
# 2nd gpt-4 Text Prompt
# Great, now create a much more complex model
# with complex trigonometric polynomials and the
# NUMPY python library. And be sure to use the
# 
# Control Flow with For Loops
# 
# in Python 3.
# 
# And be sure to use the Rhino common api to output
# geometries for data visualization.
number_slider_5 = Slider(3, range=1..5)  # disabled
number_slider_6 = Slider(2, range=1..5)  # disabled
# gpt-4 2nd Response
# All right, let's create a complex geometric pattern using trigonometric
# polynomials with the numpy library, and then visualize it in Grasshopper
# with the help of Rhino's common API. For this example, I will create a
# wave pattern on a grid of points whose Z-coordinates are determined
# by a trigonometric function.
for_loop = Script(
    x_count=Slider(31, range=0..100),
    y_count=Slider(50, range=0..100),
    freq_x=multiplication_3,
    freq_y=multiplication_4,
    amplitude=multiplication_5)  # -> out, a; inputs x_count: Int32, y_count: Int32, freq_x: Double, freq_y: Double, amplitude: Double
# ---------- for_loop: Python ----------
import Rhino.Geometry as rg
import numpy as np

def trigonometric_pattern(x_count, y_count, freq_x, freq_y, amplitude):
    """
    Create a grid of points affected by a trigonometric polynomial.
    
    Parameters:
    - x_count, y_count: Dimensions of the grid.
    - freq_x, freq_y: Frequency of the trigonometric polynomial in the X and Y directions.
    - amplitude: Amplitude of the trigonometric polynomial.
    
    Returns:
    - A list of Point3d objects with their Z-coordinates modified by the polynomial.
    """
    points = []

    x_vals = np.linspace(0, x_count-1, x_count)
    y_vals = np.linspace(0, y_count-1, y_count)

    for x in x_vals:
        for y in y_vals:
            z = amplitude * (np.sin(freq_x * x) * np.cos(freq_y * y))
            point = rg.Point3d(x, y, z)
            points.append(point)
    
    return points

# Inputs
"""
x_count = 50  # Connect sliders in Grasshopper
y_count = 50
freq_x = 0.5
freq_y = 0.5
amplitude = 10.0
"""

# Process
points = trigonometric_pattern(x_count, y_count, freq_x, freq_y, amplitude)

# Outputs
a = points  # This output can be directly visualized in Grasshopper
# ---------- end for_loop ----------
for_loop_2 = Script(x=number_slider_4, y=number_slider_6, z=number_slider_5)  # -> out, a; inputs x: Int32, y: Int32, z: Int32; disabled
# ---------- for_loop_2: Python ----------
import Rhino.Geometry as rg

def create_spheres_grid(x_count, y_count, z_count, distance):
    breps = []

    for x in range(x_count):
        for y in range(y_count):
            for z in range(z_count):
                center = rg.Point3d(x * distance, y * distance, z * distance)
                sphere = rg.Sphere(center, distance * 0.4)  # Create spheres with a radius of 40% of the distance.
                brep = sphere.ToBrep()  # Convert the sphere to a Brep for direct visualization in Grasshopper
                breps.append(brep)

    return breps

# Inputs
x_count = x  # Connect a slider in Grasshopper
y_count = y
z_count = z
distance = 5.0

# Process
breps = create_spheres_grid(x_count, y_count, z_count, distance)

# Outputs
a = breps  # This output can be directly visualized in Grasshopper
# ---------- end for_loop_2 ----------
geometry = Geometry(for_loop.a)
panel_8 = Panel(for_loop.out)
geometry_2 = Geometry(for_loop_2.a)  # disabled
interpolate = Interpolate(Vertices=geometry, Degree=3, Periodic=False, KnotStyle=1)  # -> Curve, Length, Domain
entwine = Entwine(Branch00=geometry_2, FlattenInputs=True)  # disabled
panel_9 = Panel(for_loop_2.out)  # disabled
panel_10 = Panel(geometry)
panel_11 = Panel(geometry_2)  # disabled

# ==== cluster Oscillation
list = ClusterInput()
list_length = ListLength(List=list)
B = ClusterInput()
division = Division(A=list_length, B=B)
cosine = Cosine(Value=division)
sine = Sine(Value=division)
result = ClusterOutput(sine)
result_2 = ClusterOutput(cosine)
