# Grasshopper definition 025_Control_While_Loops.gh (Grasshopper 1.0.7)
# plug-ins: RhinoCodePluginGH

number_slider = Slider(3, range=0..10)  # disabled
number_slider_2 = Slider(10, range=0..10)  # disabled
number_slider_3 = Slider(43, range=0..100)  # disabled
number_slider_4 = Slider(10, range=0..10)  # disabled

# ----
# Oscillation Algorithm
# The oscillation algorithm can be use to animate
# any geometry that is driven by a number sliders.
# Simply swap out the number sliders at the
# multiplication node in the oscillation script.
panel = Panel("1")  # disabled
number_slider_5 = Slider(118, range=0..1000)  # disabled
trigger = Trigger(Interval=20, TimerInterval=20, Target=data_recorder)  # disabled
data_recorder = DataRecorder(panel, DataLimit=-10, RecordData=True)  # disabled
oscillation = Oscillation(list=data_recorder, B=number_slider_5)  # -> result, result_2; disabled
panel_2 = Panel([oscillation.result, oscillation.result_2])  # disabled
# Alright, let's make this more interesting!
# 
# We'll generate a 3D curve using a trigonometric polynomial.
# The curve will be defined using:
# y(t)=Asin(ωt+ϕ)+Bcos(ωt+δ)
# 
# Where:
# 
# A and B are amplitude coefficients.
# ω is the angular frequency.
# ϕ and δ are phase shifts.
# We'll evaluate this for
# t in a while loop, moving upwards in the Z-direction and
# calculating X and Y using our trigonometric polynomial.
# Using numpy will allow us to efficiently calculate these values.
multiplication = Multiplication(A=oscillation.result)  # disabled
multiplication_2 = Multiplication(A=oscillation.result, B=number_slider_4)  # disabled

number_slider_6 = Slider(2, range=0..10)  # disabled
number_slider_7 = Slider(100, range=0..100)  # disabled
number_slider_8 = Slider(0.4, range=0..1)  # disabled

# ----
# #The Numpy Array:
# A Multidimensional Array Object
# test_random
number_slider_9 = Slider(4, range=0..4)  # disabled
number_slider_10 = Slider(5, range=0..20)  # disabled
numpy = Script(rows=number_slider_9, columns=number_slider_10)  # -> out, a, arr0_OUT, arr1_OUT, arr2_OUT, arr3_OUT; inputs rows: Int32, columns: Int32; disabled
# ---------- numpy: Python ----------
"""Grasshopper Script"""
#! python 3
a = "Welcome to Wickerson Studios!"
print(a)

# r: numpy

import numpy

arr = numpy.random.rand(rows, columns)

print(arr)
print(type(arr))
arr = arr.tolist()
print(arr)

arr_OUT = [arr[i] if i < rows else False for i in range(4)]
arr0_OUT, arr1_OUT, arr2_OUT, arr3_OUT = arr_OUT
# ---------- end numpy ----------
panel_3 = Panel(numpy.a)  # disabled
number = Number(numpy.arr0_OUT)  # disabled
# 002 Python Refresher
# Control Flow
# Control Flow: While Loop
# gpt-4 Text Prompt
# Create a geometric 3D model with
# 
# Container Data Structures
# with
# Control Flow: While Loop
# 
# in python 3 code for the python 3 script
# node in grasshopper for Rhino8WIP using the
# 
# Rhino Common API.
# 
# Output the parts of the model in different
# variable outputs in the python 3 node in
# grasshopper.
panel_4 = Panel(number)  # disabled
number_2 = Number(numpy.arr1_OUT)  # disabled
panel_5 = Panel(number_2)  # disabled
number_3 = Number(numpy.arr2_OUT)  # disabled
panel_6 = Panel(number_3)  # disabled
number_4 = Number(numpy.arr3_OUT)  # disabled
number_slider_11 = Slider(10, range=0..100)  # disabled
panel_7 = Panel(number_4)  # disabled
multiplication_3 = Multiplication(A=number, B=number_slider_11)  # disabled
multiplication_4 = Multiplication(A=number_2, B=number_slider_11)  # disabled
construct_point = ConstructPoint(XCoordinate=multiplication_3, YCoordinate=graft(multiplication_3), ZCoordinate=0)  # disabled
construct_point_2 = ConstructPoint(XCoordinate=multiplication_3, YCoordinate=graft(multiplication_3), ZCoordinate=multiplication_4)  # disabled
unit_x = UnitX(Factor=number_3)  # disabled
line = Line(StartPoint=construct_point, EndPoint=construct_point_2)  # disabled
move = Move(Geometry=line, Motion=unit_x)  # -> Geometry, Transform; disabled
list_item = ListItem(List=graft(line), Index=0, Wrap=True)  # disabled
list_item_2 = ListItem(List=graft(move.Geometry), Index=0, Wrap=True)  # disabled
unit_y = UnitY(Factor=number_4)  # disabled
loft = Loft(
    Curves=[list_item, list_item_2],
    Options={Adjust=False, Closed=False, LoftEnds=0, LoftSimp=0, LoftType=0, Rebuild=10, Refit=0.01})  # disabled
extrude = Extrude(Base=loft, Direction=graft(unit_y))  # disabled

# ----
# gpt-4 Initial Response
# To create a simple geometric 3D model in a
# Python script for Grasshopper in Rhino using
# the Rhino Common API, we can create a
# parametric model based on a while loop.
# As a basic example, let's create a spiraling
# stack of circles that increase in diameter as they go up:
# 
# We'll start at a point.
# Create a circle at that point with a given radius.
# Move up and increase the radius.
# Repeat until a given limit is reached.
# 2nd gpt-4 Text Prompt
# Great, now create a much more complex model
# with complex trigonometric polynomials and the
# NUMPY python library. And be sure to use the
# 
# Control Flow with While Loops
# 
# in Python 3.
# 
# And be sure to use the Rhino common api to output
# geometries for data visualization.
# gpt-4 2nd Response
number_slider_12 = Slider(12, range=1..25)  # disabled
while_loop = Script(
    A=number_slider,
    B=number_slider_2,
    cycle=number_slider_3,
    phi=multiplication_2,
    delta_Divide=number_slider_6,
    height_incr=number_slider_8,
    numPts=number_slider_7)  # -> out, a; inputs A: Int32, B: Int32, cycle: Int32, phi: Double, delta_Divide: Int32, height_incr: Double, numPts: Int32; disabled
# ---------- while_loop: Python ----------
import Rhino.Geometry as rg
import numpy as np

def trigonometric_curve(start_point, A, B, omega, phi, delta, height_increment, count):
    points = []  # This will store our points
    
    current_point = start_point
    t = 0

    i = 0
    while i < count:
        x = A * np.sin(omega * t + phi)
        y = B * np.cos(omega * t + delta)
        
        point = rg.Point3d(current_point.X + x, current_point.Y + y, current_point.Z)
        points.append(point)

        # Move the point up 
        current_point += rg.Vector3d(0, 0, height_increment)

        t += height_increment  # increase t based on height_increment
        i += 1

    # Create a polyline from our points
    polyline = rg.Polyline(points)
    
    return polyline

# Test the function
start_pt = rg.Point3d(0, 0, 0)
#A = 5
#B = 3
omega = 2 * np.pi / cycle  # 10 units for a full cycle
#phi = 0
delta = np.pi / delta_Divide  # 45-degree phase shift for cosine
#height_incr = 0.5
num_points = numPts

polyline_result = trigonometric_curve(start_pt, A, B, omega, phi, delta, height_incr, num_points)

# This will be your output in Grasshopper.
a = polyline_result
# ---------- end while_loop ----------
while_loop_2 = Script(num_circles=number_slider_12)  # -> out, a; inputs num_circles: Int32; disabled
# ---------- while_loop_2: Python ----------
import Rhino.Geometry as rg

def spiraling_circles(start_point, initial_radius, height_increment, radius_increment, count):
    circles = []  # This will store our circles

    current_point = start_point
    current_radius = initial_radius

    i = 0
    while i < count:
        circle = rg.Circle(current_point, current_radius)
        circles.append(circle)

        # Move the point up and increase the radius
        current_point += rg.Vector3d(0, 0, height_increment)
        current_radius += radius_increment

        i += 1

    return circles

# Test the function
start_pt = rg.Point3d(0, 0, 0)
initial_rad = 1
height_incr = 1
radius_incr = 0.5
#num_circles = 10

circles_result = spiraling_circles(start_pt, initial_rad, height_incr, radius_incr, num_circles)

# This will be your output in Grasshopper.
a = circles_result
# ---------- end while_loop_2 ----------
geometry = Geometry(while_loop.a)  # disabled
geometry_2 = Geometry(while_loop_2.a)  # disabled
panel_8 = Panel(while_loop.out)  # disabled
interpolate = Interpolate(Vertices=geometry, Degree=3, Periodic=False, KnotStyle=1)  # -> Curve, Length, Domain; disabled
panel_9 = Panel(while_loop_2.out)  # disabled
entwine = Entwine(Branch00=geometry_2, FlattenInputs=True)  # disabled
panel_10 = Panel(geometry)  # disabled
panel_11 = Panel(geometry_2)  # disabled

# ==== cluster Oscillation
list = ClusterInput()
list_length = ListLength(List=list)
B = ClusterInput()
division = Division(A=list_length, B=B)
cosine = Cosine(Value=division)
sine = Sine(Value=division)
result = ClusterOutput(sine)
result_2 = ClusterOutput(cosine)
