# Grasshopper definition 026_Control_While_Loops_Break.gh (Grasshopper 1.0.7)
# plug-ins: RhinoCodePluginGH

# ----
# Oscillation Algorithm
# The oscillation algorithm can be use to animate
# any geometry that is driven by a number sliders.
# Simply swap out the number sliders at the
# multiplication node in the oscillation script.
panel = Panel("1")  # disabled
trigger = Trigger(Interval=20, TimerInterval=20, Target=data_recorder)  # disabled
number_slider = Slider(118, range=0..1000)  # disabled
data_recorder = DataRecorder(panel, DataLimit=-10, RecordData=False)  # disabled
oscillation = Oscillation(list=data_recorder, B=number_slider)  # -> result_2, result; disabled
panel_2 = Panel([oscillation.result_2, oscillation.result])  # disabled
multiplication = Multiplication(A=oscillation.result_2)  # disabled
multiplication_2 = Multiplication(A=oscillation.result)  # disabled

# ----
# #The Numpy Array:
# A Multidimensional Array Object
# test_random
number_slider_2 = Slider(4, range=0..4)  # disabled
number_slider_3 = Slider(5, range=0..20)  # disabled
numpy = Script(rows=number_slider_2, columns=number_slider_3)  # -> out, a, arr0_OUT, arr1_OUT, arr2_OUT, arr3_OUT; inputs rows: Int32, columns: Int32; disabled
# ---------- numpy: Python ----------
"""Grasshopper Script"""
#! python 3
a = "Welcome to Wickerson Studios!"
print(a)

# r: numpy

import numpy

arr = numpy.random.rand(rows, columns)

print(arr)
print(type(arr))
arr = arr.tolist()
print(arr)

arr_OUT = [arr[i] if i < rows else False for i in range(4)]
arr0_OUT, arr1_OUT, arr2_OUT, arr3_OUT = arr_OUT
# ---------- end numpy ----------
panel_3 = Panel(numpy.a)  # disabled
number = Number(numpy.arr0_OUT)  # disabled
# 002 Python Refresher
# Control Flow
# Control Flow: While Loop with Break
# gpt-4 Text Prompt
# Create a geometric 3D model with
# 
# Container Data Structures
# with
# Control Flow: While Loop with Break
# 
# in python 3 code for the python 3 script
# node in grasshopper for Rhino8WIP using the
# 
# Rhino Common API.
# 
# Output the parts of the model in different
# variable outputs in the python 3 node in
# grasshopper.
panel_4 = Panel(number)  # disabled
number_2 = Number(numpy.arr1_OUT)  # disabled
panel_5 = Panel(number_2)  # disabled
number_3 = Number(numpy.arr2_OUT)  # disabled
panel_6 = Panel(number_3)  # disabled
number_4 = Number(numpy.arr3_OUT)  # disabled
number_slider_4 = Slider(10, range=0..100)  # disabled
panel_7 = Panel(number_4)  # disabled
multiplication_3 = Multiplication(A=number, B=number_slider_4)  # disabled
multiplication_4 = Multiplication(A=number_2, B=number_slider_4)  # disabled
construct_point = ConstructPoint(XCoordinate=multiplication_3, YCoordinate=graft(multiplication_3), ZCoordinate=0)  # disabled
construct_point_2 = ConstructPoint(XCoordinate=multiplication_3, YCoordinate=graft(multiplication_3), ZCoordinate=multiplication_4)  # disabled
unit_x = UnitX(Factor=number_3)  # disabled
line = Line(StartPoint=construct_point, EndPoint=construct_point_2)  # disabled
move = Move(Geometry=line, Motion=unit_x)  # -> Geometry, Transform; disabled
list_item = ListItem(List=graft(line), Index=0, Wrap=True)  # disabled
list_item_2 = ListItem(List=graft(move.Geometry), Index=0, Wrap=True)  # disabled
unit_y = UnitY(Factor=number_4)  # disabled
loft = Loft(
    Curves=[list_item, list_item_2],
    Options={Adjust=False, Closed=False, LoftEnds=0, LoftSimp=0, LoftType=0, Rebuild=10, Refit=0.01})  # disabled
extrude = Extrude(Base=loft, Direction=graft(unit_y))  # disabled

# ----
# gpt-4 Initial Response
# Sure! Let's design a simple 3D model using Python
# within the Grasshopper context for Rhino 8 WIP.
# I'll describe the scenario and then provide the
# Python code.
# 
# Scenario:
# 
# We'll create a series of 3D boxes stacked vertically.
# The boxes will have a decreasing width as they rise,
# so the model will look like a stepped pyramid.
# We'll use a while loop with a break condition to
# stop when the width of the boxes goes below
# a certain threshold.
# 2nd gpt-4 Text Prompt
# Great, now create a much more complex model
# with complex trigonometric polynomials and the
# NUMPY python library. And be sure to use the
# 
# Control Flow with While Loops with Break
# 
# in Python 3.
# 
# And be sure to use the Rhino common api to output
# geometries for data visualization.
# gpt-4 2nd Response
# Alright, let's step it up a notch!
# 
# Scenario:
# We're going to create a series of twisted columns
# made up of circles whose radii change according
# to a trigonometric polynomial. The heights of these
# columns and their initial radii will reduce each time
# until a threshold, at which point we'll break out of the loop.
# 
# Here's the strategy:
# 
# Begin with an initial circle at the origin.
# For a certain height h, create a series of
# circles whose radii are determined by a
#  trigonometric polynomial.
# Use these circles to create a lofted surface
#  (a column).
# Move the base point upwards and reduce
#  the initial radius.
# Repeat until the radius drops below a threshold.
number_slider_5 = Slider(2.42, range=0..10)  # disabled
multiplication_5 = Multiplication(A=oscillation.result_2, B=Slider(3.7, range=0..10))
multiplication_6 = Multiplication(A=oscillation.result, B=Slider(10, range=0..10))
while_break_loop = Script(
    initial_radius=Slider(4.22, range=0..10),
    height_increment=Slider(1.72, range=0..10),
    num_circles_per_column=Slider(8, range=0..20),
    radius_decrement=Slider(0.57, range=0..1),
    threshold=Slider(1.76, range=0..10),
    coef1=multiplication_5,
    coef2=multiplication_6)  # -> out, a; inputs initial_radius: Double, height_increment: Double, num_circles_per_column: Int32, radius_decrement: Double, threshold: Double, coef1: Double, coef2: Double
# ---------- while_break_loop: Python ----------
import Rhino.Geometry as rg
import numpy as np

# Initialize base data
"""
initial_radius = 5.0  # starting radius for the first column
height_increment = 2.0  # height between circles in a column
num_circles_per_column = 10  # number of circles in a column
radius_decrement = 0.5  # decremental radius for each new column
threshold = 1.5  # minimum radius to stop creating columns
"""
columns = []  # Container to store all columns

# Initial point
base_point = rg.Point3d(0, 0, 0)

while initial_radius > threshold:
    circle_planes = []  # Planes to position circles
    circle_radii = []  # Radii for the circles
    
    # Calculate circle radii using a trigonometric polynomial
    angles = np.linspace(0, 2 * np.pi, num_circles_per_column)
    radii = initial_radius + np.sin(coef1 * angles) + np.cos(coef2 * angles)  # Change the coefficients for a different polynomial
    
    for i, r in enumerate(radii):
        # Create planes for circles and store radii
        plane = rg.Plane(rg.Point3d(base_point.X, base_point.Y, base_point.Z + i * height_increment), rg.Vector3d.ZAxis)
        circle_planes.append(plane)
        circle_radii.append(r)
    
    # Create circles using these planes and radii
    circles = [rg.Circle(p, r) for p, r in zip(circle_planes, circle_radii)]
    
    # Convert circles to curves
    curve_list = [c.ToNurbsCurve() for c in circles]
    
    # Loft these curves to create a column
    columnList = rg.Brep.CreateFromLoft(curve_list, rg.Point3d.Unset, rg.Point3d.Unset, rg.LoftType.Normal, False)
    if columnList:
        columns.extend(columnList)

    
    # Update initial_radius and base_point for the next column
    initial_radius -= radius_decrement
    base_point.Z += num_circles_per_column * height_increment

    # If radius drops below threshold, break the loop
    if initial_radius <= threshold:
        break

# Output the columns
a = columns
# ---------- end while_break_loop ----------
while_break_loop_2 = Script(threshold=number_slider_5)  # -> out, a; inputs threshold: Double; disabled
# ---------- while_break_loop_2: Python ----------
import Rhino.Geometry as rg

# Initialize some base data for our boxes
initial_width = 10.0  # initial width of the base box
height = 1.0  # height of each box
decrement = 1.0  # decremental width for each box above
#threshold = 3.0  # minimum width to stop creating boxes

boxes = []  # Container to store all the boxes

# Initial point
base_point = rg.Point3d(0, 0, 0)

while initial_width > threshold:
    # Define two corner points for the box
    corner_1 = base_point
    corner_2 = rg.Point3d(corner_1.X + initial_width, corner_1.Y + initial_width, corner_1.Z + height)
    
    # Create the box using BoundingBox
    bounding_box = rg.BoundingBox(corner_1, corner_2)
    box = rg.Box(bounding_box)
    
    boxes.append(box)
    
    # Update initial_width and base_point for next iteration
    initial_width -= decrement
    base_point.Z += height

    # If width drops below threshold, break the loop
    if initial_width <= threshold:
        break

# Output the boxes
a = boxes
# ---------- end while_break_loop_2 ----------
geometry = Geometry(while_break_loop_2.a)  # disabled
panel_8 = Panel(while_break_loop_2.out)  # disabled
entwine = Entwine(Branch00=geometry, FlattenInputs=True)  # disabled
panel_9 = Panel(while_break_loop.out)
geometry_2 = Geometry(while_break_loop.a)
panel_10 = Panel(geometry)  # disabled
panel_11 = Panel(geometry_2)

# ==== cluster Oscillation
list = ClusterInput()
list_length = ListLength(List=list)
B = ClusterInput()
division = Division(A=list_length, B=B)
cosine = Cosine(Value=division)
sine = Sine(Value=division)
result = ClusterOutput(cosine)
result_2 = ClusterOutput(sine)
