# Grasshopper definition 027_Control_While_Loops_Continue.gh (Grasshopper 1.0.7)
# plug-ins: RhinoCodePluginGH

# ----
# Oscillation Algorithm
# The oscillation algorithm can be use to animate
# any geometry that is driven by a number sliders.
# Simply swap out the number sliders at the
# multiplication node in the oscillation script.
panel = Panel("1")  # disabled
trigger = Trigger(Interval=20, TimerInterval=20, Target=data_recorder)  # disabled
number_slider = Slider(118, range=0..1000)  # disabled
data_recorder = DataRecorder(panel, DataLimit=-10, RecordData=False)  # disabled
oscillation = Oscillation(list=data_recorder, B=number_slider)  # -> result_2, result; disabled
panel_2 = Panel([oscillation.result_2, oscillation.result])  # disabled
multiplication = Multiplication(A=oscillation.result_2)  # disabled
multiplication_2 = Multiplication(A=oscillation.result)  # disabled

# ----
# gpt-4 2nd Response
# Alright, I'll create a more complex geometric model using
# numpy to generate values based on trigonometric polynomials,
# and use this data to create 3D geometries with the Rhino
# Common API.
# 
# For this example, we'll use a trigonometric polynomial to
#  create the heights for a series of vertical spikes that
# vary in size and position. This will give us a visual
# representation of our trigonometric function.
number_slider_2 = Slider(93, range=0..100)
multiplication_3 = Multiplication(A=oscillation.result_2, B=Slider(3.67, range=0..10))
multiplication_4 = Multiplication(A=oscillation.result, B=Slider(2.17, range=0..10))
multiplication_5 = Multiplication(A=oscillation.result_2, B=Slider(5.3, range=0..10))
multiplication_6 = Multiplication(A=oscillation.result, B=Slider(6.66, range=0..10))
multiplication_7 = Multiplication(A=oscillation.result_2, B=Slider(1.94, range=0..10))

# ----
# #The Numpy Array:
# A Multidimensional Array Object
# test_random
number_slider_3 = Slider(4, range=0..4)  # disabled
number_slider_4 = Slider(5, range=0..20)  # disabled
numpy = Script(rows=number_slider_3, columns=number_slider_4)  # -> out, a, arr0_OUT, arr1_OUT, arr2_OUT, arr3_OUT; inputs rows: Int32, columns: Int32; disabled
# ---------- numpy: Python ----------
"""Grasshopper Script"""
#! python 3
a = "Welcome to Wickerson Studios!"
print(a)

# r: numpy

import numpy

arr = numpy.random.rand(rows, columns)

print(arr)
print(type(arr))
arr = arr.tolist()
print(arr)

arr_OUT = [arr[i] if i < rows else False for i in range(4)]
arr0_OUT, arr1_OUT, arr2_OUT, arr3_OUT = arr_OUT
# ---------- end numpy ----------
panel_3 = Panel(numpy.a)  # disabled
number = Number(numpy.arr0_OUT)  # disabled
# 002 Python Refresher
# Control Flow
# Control Flow: While Loop with Continue
# gpt-4 Text Prompt
# Create a geometric 3D model with
# 
# Container Data Structures
# with
# Control Flow: While Loop with Continue
# 
# in python 3 code for the python 3 script
# node in grasshopper for Rhino8WIP using the
# 
# Rhino Common API.
# 
# Output the parts of the model in different
# variable outputs in the python 3 node in
# grasshopper.
panel_4 = Panel(number)  # disabled
number_2 = Number(numpy.arr1_OUT)  # disabled
panel_5 = Panel(number_2)  # disabled
number_3 = Number(numpy.arr2_OUT)  # disabled
panel_6 = Panel(number_3)  # disabled
number_4 = Number(numpy.arr3_OUT)  # disabled
number_slider_5 = Slider(10, range=0..100)  # disabled
panel_7 = Panel(number_4)  # disabled
multiplication_8 = Multiplication(A=number, B=number_slider_5)  # disabled
multiplication_9 = Multiplication(A=number_2, B=number_slider_5)  # disabled
construct_point = ConstructPoint(XCoordinate=multiplication_8, YCoordinate=graft(multiplication_8), ZCoordinate=0)  # disabled
construct_point_2 = ConstructPoint(XCoordinate=multiplication_8, YCoordinate=graft(multiplication_8), ZCoordinate=multiplication_9)  # disabled
unit_x = UnitX(Factor=number_3)  # disabled
line = Line(StartPoint=construct_point, EndPoint=construct_point_2)  # disabled
move = Move(Geometry=line, Motion=unit_x)  # -> Geometry, Transform; disabled
list_item = ListItem(List=graft(line), Index=0, Wrap=True)  # disabled
list_item_2 = ListItem(List=graft(move.Geometry), Index=0, Wrap=True)  # disabled
unit_y = UnitY(Factor=number_4)  # disabled
loft = Loft(
    Curves=[list_item, list_item_2],
    Options={Adjust=False, Closed=False, LoftEnds=0, LoftSimp=0, LoftType=0, Rebuild=10, Refit=0.01})  # disabled
extrude = Extrude(Base=loft, Direction=graft(unit_y))  # disabled

# ----
# gpt-4 Initial Response
# Certainly! Creating a simple geometric 3D model using
# the Rhino Common API can be achieved by following
# these steps:
# 
# We'll make a container data structure (like a list) to
#  store our 3D geometries.
# We'll use a while loop with the continue statement
# to iterate and generate geometries.
# We'll then add these geometries to Rhino's active
# document and output them in different variable outputs.
while_continue_loop = Script()  # -> out, a; disabled
# ---------- while_continue_loop: Python ----------
import rhinoscriptsyntax as rs
import Rhino.Geometry as rg

def create_cylinders():
    # Container data structure to store cylinders
    cylinders = []

    # Start position
    x = 0
    y = 0
    z = 0
    count = 0

    # While loop with continue
    while count < 10:
        if count % 3 == 0:  # Skipping every third cylinder for demo purposes
            count += 1
            continue

        # Create a cylinder from base circle and height
        base_circle = rg.Circle(rg.Point3d(x, y, z), 2)  # Circle with radius 2
        cylinder_surface = rg.Cylinder(base_circle, 5).ToRevSurface()  # Convert to revolved surface
        cylinder_brep = cylinder_surface.ToBrep()  # Convert the surface to Brep
        cylinders.append(cylinder_brep)

        x += 5  # Shift the x position for the next cylinder
        count += 1

    return cylinders

# Execute and get the result
cylinder_breps = create_cylinders()

# Output the result
if cylinder_breps:
    a = cylinder_breps
# ---------- end while_continue_loop ----------
# 2nd gpt-4 Text Prompt
# Great, now create a much more complex model
# with complex trigonometric polynomials and the
# NUMPY python library. And be sure to use the
# 
# Control Flow with While Loops with Continue
# 
# in Python 3.
# 
# And be sure to use the Rhino common api to output
# geometries for data visualization.
geometry = Geometry(while_continue_loop.a)  # disabled
panel_8 = Panel(while_continue_loop.out)  # disabled
entwine = Entwine(Branch00=geometry, FlattenInputs=True)  # disabled
while_continue_loop_2 = Script(
    numPts=number_slider_2,
    coef1=multiplication_3,
    coef2=multiplication_4,
    coef3=multiplication_5,
    coef4=multiplication_6,
    fact=multiplication_7)  # -> out, a; inputs numPts: Int32, coef1: Double, coef2: Double, coef3: Double, coef4: Double, fact: Double
# ---------- while_continue_loop_2: Python ----------
import numpy as np
import Rhino.Geometry as rg

def generate_heights(x_values):
    # A complex trigonometric polynomial
    return np.sin(x_values) + coef1 * np.sin(coef2*x_values) + coef3 * np.cos(coef4*x_values)

def create_spikes():
    spikes = []

    x = 0
    count = 0

    # Generate x values
    x_values = np.linspace(0, fact*np.pi, numPts)  # numPts points from 0 to fact*pi

    # Get the y values from our trigonometric function
    y_values = generate_heights(x_values)

    # While loop with continue
    while count < len(x_values):
        if count % 20 == 0:  # Skipping every 20th spike for demo purposes
            count += 1
            continue

        height = y_values[count]
        
        # Create a cylinder for the spike
        base_circle = rg.Circle(rg.Point3d(x, 0, 0), 0.5)  # Circle with radius 0.5
        spike_surface = rg.Cylinder(base_circle, height).ToRevSurface()  # Convert to revolved surface
        spike_brep = spike_surface.ToBrep()  # Convert the surface to Brep
        spikes.append(spike_brep)

        x += 1  # Shift the x position for the next spike
        count += 1

    return spikes

# Execute and get the result
spike_breps = create_spikes()

# Output the result
if spike_breps:
    a = spike_breps
# ---------- end while_continue_loop_2 ----------
panel_9 = Panel(geometry)  # disabled
geometry_2 = Geometry(while_continue_loop_2.a)
panel_10 = Panel(while_continue_loop_2.out)
panel_11 = Panel(geometry_2)

# ==== cluster Oscillation
list = ClusterInput()
list_length = ListLength(List=list)
B = ClusterInput()
division = Division(A=list_length, B=B)
cosine = Cosine(Value=division)
sine = Sine(Value=division)
result = ClusterOutput(cosine)
result_2 = ClusterOutput(sine)
