# Grasshopper definition 028_Functions.gh (Grasshopper 1.0.7)
# plug-ins: RhinoCodePluginGH

# ----
# Oscillation Algorithm
# The oscillation algorithm can be use to animate
# any geometry that is driven by a number sliders.
# Simply swap out the number sliders at the
# multiplication node in the oscillation script.
panel = Panel("1")  # disabled
trigger = Trigger(Interval=20, TimerInterval=20, Target=data_recorder)  # disabled
number_slider = Slider(118, range=0..1000)  # disabled
data_recorder = DataRecorder(panel, DataLimit=-10, RecordData=False)  # disabled
oscillation = Oscillation(list=data_recorder, B=number_slider)  # -> result_2, result; disabled
panel_2 = Panel([oscillation.result_2, oscillation.result])  # disabled
multiplication = Multiplication(A=oscillation.result_2)  # disabled
multiplication_2 = Multiplication(A=oscillation.result)  # disabled

# ----
# #The Numpy Array:
# A Multidimensional Array Object
# test_random
number_slider_2 = Slider(4, range=0..4)  # disabled
number_slider_3 = Slider(5, range=0..20)  # disabled
numpy = Script(rows=number_slider_2, columns=number_slider_3)  # -> out, a, arr0_OUT, arr1_OUT, arr2_OUT, arr3_OUT; inputs rows: Int32, columns: Int32; disabled
# ---------- numpy: Python ----------
"""Grasshopper Script"""
#! python 3
a = "Welcome to Wickerson Studios!"
print(a)

# r: numpy

import numpy

arr = numpy.random.rand(rows, columns)

print(arr)
print(type(arr))
arr = arr.tolist()
print(arr)

arr_OUT = [arr[i] if i < rows else False for i in range(4)]
arr0_OUT, arr1_OUT, arr2_OUT, arr3_OUT = arr_OUT
# ---------- end numpy ----------
panel_3 = Panel(numpy.a)  # disabled
number = Number(numpy.arr0_OUT)  # disabled
# 002 Python Refresher
# Functions
# Functions: Keyword def square
# gpt-4 Text Prompt
# Create a geometric 3D model with
# 
# Container Data Structures
# with
# Functions: Keyword def square
# 
# in python 3 code for the python 3 script
# node in grasshopper for Rhino8WIP using the
# 
# Rhino Common API.
# 
# Output the parts of the model in different
# variable outputs in the python 3 node in
# grasshopper.
panel_4 = Panel(number)  # disabled
number_2 = Number(numpy.arr1_OUT)  # disabled
panel_5 = Panel(number_2)  # disabled
number_3 = Number(numpy.arr2_OUT)  # disabled
panel_6 = Panel(number_3)  # disabled
number_4 = Number(numpy.arr3_OUT)  # disabled
number_slider_4 = Slider(10, range=0..100)  # disabled
panel_7 = Panel(number_4)  # disabled
multiplication_3 = Multiplication(A=number, B=number_slider_4)  # disabled
multiplication_4 = Multiplication(A=number_2, B=number_slider_4)  # disabled
construct_point = ConstructPoint(XCoordinate=multiplication_3, YCoordinate=graft(multiplication_3), ZCoordinate=0)  # disabled
construct_point_2 = ConstructPoint(XCoordinate=multiplication_3, YCoordinate=graft(multiplication_3), ZCoordinate=multiplication_4)  # disabled
unit_x = UnitX(Factor=number_3)  # disabled
line = Line(StartPoint=construct_point, EndPoint=construct_point_2)  # disabled
move = Move(Geometry=line, Motion=unit_x)  # -> Geometry, Transform; disabled
list_item = ListItem(List=graft(line), Index=0, Wrap=True)  # disabled
list_item_2 = ListItem(List=graft(move.Geometry), Index=0, Wrap=True)  # disabled
unit_y = UnitY(Factor=number_4)  # disabled
loft = Loft(
    Curves=[list_item, list_item_2],
    Options={Adjust=False, Closed=False, LoftEnds=0, LoftSimp=0, LoftType=0, Rebuild=10, Refit=0.01})  # disabled
extrude = Extrude(Base=loft, Direction=graft(unit_y))  # disabled

# ----
# Sure! Let's create a more intricate model based on
# trigonometric polynomials using NumPy. We'll create
# a wavy surface, which is controlled by a trigonometric
# polynomial function.
# 
# Given that NumPy is not included by default in
# Rhino's Python environment, you need to make
# sure you have it installed and accessible.
# 
# The following code outlines the approach:
# 
# Define a function to compute the height value
#  of the surface based on trigonometric polynomials.
# Use a grid of points to sample the height values.
# Convert this grid of points to a Rhino surface
# using RhinoCommon API.
number_slider_5 = Slider(31, range=0..50)
# gpt-4 Initial Response
# Creating a 3D geometric model in Grasshopper for
# Rhino 8 WIP using the Rhino Common API requires
# a bit of understanding of both Grasshopper and
# the Rhino Common API.
# 
# For the sake of this example, let's create a simple
# square-based pyramid model. The function square
# will generate the base square of the pyramid.
functions_square = Script()  # -> out, a, b; disabled
# ---------- functions_square: Python ----------
import Rhino.Geometry as rg

def square(size):
    """
    Generate a square with a given size.
    
    Parameters:
    size (float): The side length of the square.
    
    Returns:
    list: Four corner points of the square.
    """
    p1 = rg.Point3d(0, 0, 0)
    p2 = rg.Point3d(size, 0, 0)
    p3 = rg.Point3d(size, size, 0)
    p4 = rg.Point3d(0, size, 0)
    
    return [p1, p2, p3, p4]

def create_pyramid(base_size, height):
    """
    Create a pyramid based on a square base and a given height.
    
    Parameters:
    base_size (float): The side length of the base square.
    height (float): The height of the pyramid.
    
    Returns:
    tuple: (Base square, List of pyramid faces)
    """
    base_points = square(base_size)
    apex = rg.Point3d(base_size/2, base_size/2, height)
    
    # Create the base square
    base = rg.Polyline(base_points + [base_points[0]]).ToNurbsCurve()
    
    # Create the pyramid faces
    faces = []
    for i in range(4):
        mesh = rg.Mesh()
        mesh.Vertices.Add(base_points[i])
        mesh.Vertices.Add(base_points[(i+1)%4])
        mesh.Vertices.Add(apex)
        mesh.Faces.AddFace(0, 1, 2)
        faces.append(mesh)
    
    return base, faces

# Example usage
base_size = 10
height = 15

base, faces = create_pyramid(base_size, height)

# Output the parts of the model to different variable outputs
# In Grasshopper's Python Script component:
# a = Base
# b = Faces

a = base
b = faces
# ---------- end functions_square ----------
geometry = Geometry(functions_square.a)  # disabled
# 2nd gpt-4 Text Prompt
# Great, now create a much more complex model
# with complex trigonometric polynomials and the
# NUMPY python library. And be sure to use the
# 
# Function Keyword def for a square function
# 
# in Python 3.
# 
# And be sure to use the Rhino common api to output
# geometries for data visualization.
# gpt-4 2nd Response
geometry_2 = Geometry(functions_square.b)  # disabled
panel_8 = Panel(functions_square.out)  # disabled
entwine = Entwine(Branch00=geometry, Branch01=geometry_2, FlattenInputs=True)  # disabled
function_square = Script(
    grid_size=number_slider_5,
    coef1=Slider(1.22, range=0..10),
    coef2=Slider(7.67, range=0..10),
    span=Slider(10, range=0..10))  # -> out, a; inputs grid_size: Int32, coef1: Double, coef2: Double, span: Double
# ---------- function_square: Python ----------
import Rhino.Geometry as rg
import numpy as np

def square(size):
    """
    Generate a square with a given size.
    
    Parameters:
    size (float): The side length of the square.
    
    Returns:
    list: Four corner points of the square.
    """
    p1 = rg.Point3d(0, 0, 0)
    p2 = rg.Point3d(size, 0, 0)
    p3 = rg.Point3d(size, size, 0)
    p4 = rg.Point3d(0, size, 0)
    
    return [p1, p2, p3, p4]

def trig_poly_function(x, y):
    """Compute height using a trigonometric polynomial function."""
    z = np.sin(x) * np.cos(y) + np.sin(coef1*x) * np.cos(coef2*y)
    return z

def create_wavy_mesh(grid_size, span):
    """
    Create a wavy mesh using trigonometric polynomials.
    
    Parameters:
    grid_size (int): Number of points in the X and Y axis.
    span (float): Size of the square surface.
    
    Returns:
    Rhino.Geometry.Mesh: The resulting wavy mesh.
    """
    # Generate grid points and evaluate the function
    x = np.linspace(0, span, grid_size)
    y = np.linspace(0, span, grid_size)
    X, Y = np.meshgrid(x, y)
    Z = trig_poly_function(X, Y)
    
    mesh = rg.Mesh()

    for i in range(grid_size):
        for j in range(grid_size):
            mesh.Vertices.Add(X[i,j], Y[i,j], Z[i,j])

    for i in range(grid_size-1):
        for j in range(grid_size-1):
            mesh.Faces.AddFace(i * grid_size + j,
                               i * grid_size + j + 1,
                               (i + 1) * grid_size + j + 1,
                               (i + 1) * grid_size + j)
    
    return mesh

# Example usage
#grid_size = 50  # Number of points along X and Y
#span = 10  # Span or size of the surface

wavy_mesh = create_wavy_mesh(grid_size, span)

# Output the wavy mesh to Grasshopper
a = wavy_mesh
# ---------- end function_square ----------
panel_9 = Panel(entwine)  # disabled
geometry_3 = Geometry(function_square.a)
panel_10 = Panel(function_square.out)
panel_11 = Panel(geometry_3)

# ==== cluster Oscillation
list = ClusterInput()
list_length = ListLength(List=list)
B = ClusterInput()
division = Division(A=list_length, B=B)
cosine = Cosine(Value=division)
sine = Sine(Value=division)
result = ClusterOutput(cosine)
result_2 = ClusterOutput(sine)
