# Grasshopper definition 029_Functions_appreciation_percentage.gh (Grasshopper 1.0.7)
# plug-ins: RhinoCodePluginGH

# ----
# Oscillation Algorithm
# The oscillation algorithm can be use to animate
# any geometry that is driven by a number sliders.
# Simply swap out the number sliders at the
# multiplication node in the oscillation script.
panel = Panel("1")  # disabled
trigger = Trigger(Interval=20, TimerInterval=20, Target=data_recorder)  # disabled
number_slider = Slider(118, range=0..1000)  # disabled
data_recorder = DataRecorder(panel, DataLimit=-10, RecordData=False)  # disabled
oscillation = Oscillation(list=data_recorder, B=number_slider)  # -> result_2, result; disabled
panel_2 = Panel([oscillation.result_2, oscillation.result])  # disabled
multiplication = Multiplication(A=oscillation.result_2)  # disabled
multiplication_2 = Multiplication(A=oscillation.result)  # disabled

# ----
# gpt-4 2nd Response
# Great, now create a much more complex model
# with complex trigonometric polynomials and the
# NUMPY python library. And be sure to use the
# 
# Function Keyword def for a appreciation and percentage rate
# function
# 
# in Python 3.
number_slider_2 = Slider(10, range=0..10)

# ----
# #The Numpy Array:
# A Multidimensional Array Object
# test_random
number_slider_3 = Slider(4, range=0..4)  # disabled
number_slider_4 = Slider(5, range=0..20)  # disabled
numpy = Script(rows=number_slider_3, columns=number_slider_4)  # -> out, a, arr0_OUT, arr1_OUT, arr2_OUT, arr3_OUT; inputs rows: Int32, columns: Int32; disabled
# ---------- numpy: Python ----------
"""Grasshopper Script"""
#! python 3
a = "Welcome to Wickerson Studios!"
print(a)

# r: numpy

import numpy

arr = numpy.random.rand(rows, columns)

print(arr)
print(type(arr))
arr = arr.tolist()
print(arr)

arr_OUT = [arr[i] if i < rows else False for i in range(4)]
arr0_OUT, arr1_OUT, arr2_OUT, arr3_OUT = arr_OUT
# ---------- end numpy ----------
panel_3 = Panel(numpy.a)  # disabled
number = Number(numpy.arr0_OUT)  # disabled
# 002 Python Refresher
# Functions
# Functions: Keyword def appreciation and percentage of return
# gpt-4 Text Prompt
# Create a geometric 3D model with
# 
# Container Data Structures
# with
# Function: Keyword def appreciation and percentage of return
# 
# in python 3 code for the python 3 script
# node in grasshopper for Rhino8WIP using the
# 
# Rhino Common API.
# 
# Output the parts of the model in different
# variable outputs in the python 3 node in
# grasshopper.
panel_4 = Panel(number)  # disabled
number_2 = Number(numpy.arr1_OUT)  # disabled
panel_5 = Panel(number_2)  # disabled
number_3 = Number(numpy.arr2_OUT)  # disabled
panel_6 = Panel(number_3)  # disabled
number_4 = Number(numpy.arr3_OUT)  # disabled
number_slider_5 = Slider(10, range=0..100)  # disabled
panel_7 = Panel(number_4)  # disabled
multiplication_3 = Multiplication(A=number, B=number_slider_5)  # disabled
multiplication_4 = Multiplication(A=number_2, B=number_slider_5)  # disabled
construct_point = ConstructPoint(XCoordinate=multiplication_3, YCoordinate=graft(multiplication_3), ZCoordinate=0)  # disabled
construct_point_2 = ConstructPoint(XCoordinate=multiplication_3, YCoordinate=graft(multiplication_3), ZCoordinate=multiplication_4)  # disabled
unit_x = UnitX(Factor=number_3)  # disabled
line = Line(StartPoint=construct_point, EndPoint=construct_point_2)  # disabled
move = Move(Geometry=line, Motion=unit_x)  # -> Geometry, Transform; disabled
list_item = ListItem(List=graft(line), Index=0, Wrap=True)  # disabled
list_item_2 = ListItem(List=graft(move.Geometry), Index=0, Wrap=True)  # disabled
unit_y = UnitY(Factor=number_4)  # disabled
loft = Loft(
    Curves=[list_item, list_item_2],
    Options={Adjust=False, Closed=False, LoftEnds=0, LoftSimp=0, LoftType=0, Rebuild=10, Refit=0.01})  # disabled
extrude = Extrude(Base=loft, Direction=graft(unit_y))  # disabled

number_slider_6 = Slider(12.45, range=0..100)  # disabled
# 2nd gpt-4 Text Prompt
# Great, now create a much more complex model
# with complex trigonometric polynomials and the
# NUMPY python library. And be sure to use the
# 
# Function Keyword def for a appreciation and percentage rate function
# 
# in Python 3.
# 
# And be sure to use the Rhino common api to output
# geometries for data visualization.
number_slider_7 = Slider(100, range=0..100)  # disabled
# gpt-4 Initial Response
# Creating a geometric 3D model in Rhino via the RhinoCommon
# API based on the requirements provided can be quite extensive.
# Here's a Python script you could use as a base, but you may
# need to expand on it to meet all of your specific needs.
# 
# The script below will use Python 3 syntax and the RhinoCommon
# API to create a 3D box (as a basic example of a geometric 3D model).
# The script will also contain a function appreciation which will
# compute a new value based on an input value and a given percentage.
number_slider_8 = Slider(15.27, range=0..100)  # disabled
number_slider_9 = Slider(67.04, range=0..100)  # disabled
function_appreciation = Script(width=number_slider_8, depth=number_slider_6, height=number_slider_9, appreciation_pct=number_slider_7)  # -> out, A, B; inputs width: Double, depth: Double, height: Double, appreciation_pct: Double; disabled
# ---------- function_appreciation: Python ----------
import Rhino.Geometry as rg

# Define the function to compute appreciation
def appreciation(value, percentage):
    """
    Calculate the appreciated value.

    Args:
    value (float): Original value.
    percentage (float): Percentage of appreciation.

    Returns:
    float: New appreciated value.
    """
    return value * (1 + (percentage / 100))

# Create a basic 3D box model in Rhino
def create_box_model(width, depth, height):
    """
    Create a 3D box in Rhino.

    Args:
    width (float): Width of the box.
    depth (float): Depth of the box.
    height (float): Height of the box.

    Returns:
    Rhino.Geometry.Brep: A 3D box.
    """
    base_point = rg.Point3d(0, 0, 0)
    opposite_corner = rg.Point3d(base_point.X + width, base_point.Y + depth, base_point.Z + height)
    box = rg.Brep.CreateFromBox(rg.BoundingBox(base_point, opposite_corner))
    return box

# Assuming the following variables are provided by Grasshopper:
# width, depth, height, appreciation_pct

# Create a 3D box model based on provided dimensions
box_model = create_box_model(width, depth, height)

# Appreciate the width and create a new box
new_width = appreciation(width, appreciation_pct)
new_box_model = create_box_model(new_width, depth, height)

# Outputs for the Grasshopper Python component
# (assuming you have two outputs named 'A' and 'B' in Grasshopper)
A = box_model
B = new_box_model
# ---------- end function_appreciation ----------
function_appreciation_2 = Script(percentage=number_slider_2, length=Slider(10, range=0..10), width=Slider(10, range=0..10), freq=Slider(0.45, range=0..2))  # -> out, A, B; inputs percentage: Double, length: Double, width: Double, freq: Double
# ---------- function_appreciation_2: Python ----------
import Rhino.Geometry as rg
import numpy as np

# Define the function to compute appreciation
def appreciation(value, percentage):
    """
    Calculate the appreciated value.

    Args:
    value (float): Original value.
    percentage (float): Percentage of appreciation.

    Returns:
    float: New appreciated value.
    """
    return value * (1 + (percentage / 100))

def create_trig_surface(length, width, freq, phase_shift=0):
    """
    Create a mesh in Rhino based on trigonometric polynomials.

    Args:
    length (float): Length of the mesh.
    width (float): Width of the mesh.
    freq (float): Frequency for trigonometric oscillation.
    phase_shift (float): Phase shift for the oscillation.

    Returns:
    Rhino.Geometry.Mesh: A trigonometric mesh.
    """
    
    u_count = 100  # Number of points in the u-direction
    v_count = 100  # Number of points in the v-direction

    # Generate a grid of (u, v) parameters
    u = np.linspace(0, 1, u_count)
    v = np.linspace(0, 1, v_count)
    u, v = np.meshgrid(u, v)

    # Trigonometric polynomial function
    z = np.sin(freq * 2 * np.pi * u + phase_shift) * np.cos(freq * 2 * np.pi * v)

    # Create the mesh
    mesh = rg.Mesh()

    for i in range(u_count):
        for j in range(v_count):
            pt = rg.Point3d(length * u[i, j], width * v[i, j], z[i, j] * 10)  # Multiplying z by 10 for amplification
            mesh.Vertices.Add(pt)

    for i in range(u_count-1):
        for j in range(v_count-1):
            mesh.Faces.AddFace(i * v_count + j, i * v_count + j + 1, (i + 1) * v_count + j + 1, (i + 1) * v_count + j)

    return mesh

# Assuming the following variables are provided by Grasshopper:
# length, width, freq, appreciation_pct

# Check if variables are defined, otherwise set defaults
try: length
except NameError: length = 10

try: width
except NameError: width = 10

try: freq
except NameError: freq = 1

try: appreciation_pct
except NameError: appreciation_pct = 10

# Create a trigonometric surface based on provided parameters
surface_model = create_trig_surface(length, width, freq)

# Appreciate the length and create a new mesh
new_length = appreciation(length, appreciation_pct)
appreciated_surface_model = create_trig_surface(new_length, width, freq)

# Output the appreciated model to A
A = surface_model
B = appreciated_surface_model
# ---------- end function_appreciation_2 ----------
geometry = Geometry(function_appreciation_2.A)
geometry_2 = Geometry(function_appreciation_2.B)
geometry_3 = Geometry(function_appreciation.A)  # disabled
geometry_4 = Geometry(function_appreciation.B)  # disabled
panel_8 = Panel(function_appreciation_2.out)
panel_9 = Panel([geometry, geometry_2])
panel_10 = Panel(function_appreciation.out)  # disabled
entwine = Entwine(Branch00=geometry_3, Branch01=geometry_4, FlattenInputs=True)  # disabled
panel_11 = Panel(entwine)  # disabled

# ==== cluster Oscillation
list = ClusterInput()
list_length = ListLength(List=list)
B = ClusterInput()
division = Division(A=list_length, B=B)
cosine = Cosine(Value=division)
sine = Sine(Value=division)
result = ClusterOutput(cosine)
result_2 = ClusterOutput(sine)
