# Grasshopper definition 030_Lambdas_function.gh (Grasshopper 1.0.7)
# plug-ins: RhinoCodePluginGH

# gpt-4 Initial Response
# To create a 3D geometric model using the Rhino Common
# API in a Python script node for Grasshopper in Rhino8WIP,
# follow the steps below.
# 
# Define your goals. For this example, we'll generate a set of 3D
# points within a bounding box and filter them using a lambda function.
# Use container data structures (e.g., lists) to store and manipulate this data.
# Use the Rhino Common API to handle geometric tasks.
number_slider = Slider(10, range=0..10)  # disabled

# ----
# Oscillation Algorithm
# The oscillation algorithm can be use to animate
# any geometry that is driven by a number sliders.
# Simply swap out the number sliders at the
# multiplication node in the oscillation script.
panel = Panel("1")  # disabled
trigger = Trigger(Interval=20, TimerInterval=20, Target=data_recorder)  # disabled
number_slider_2 = Slider(86, range=0..1000)  # disabled
data_recorder = DataRecorder(panel, DataLimit=-10, RecordData=False)  # disabled
oscillation = Oscillation(list=data_recorder, B=number_slider_2)  # -> result_2, result; disabled
panel_2 = Panel([oscillation.result_2, oscillation.result])  # disabled
multiplication = Multiplication(A=oscillation.result_2, B=number_slider)  # disabled
multiplication_2 = Multiplication(A=oscillation.result, B=number_slider)  # disabled

number_slider_3 = Slider(2, range=0..2)

# ----
# Oscillation Algorithm
# The oscillation algorithm can be use to animate
# any geometry that is driven by a number sliders.
# Simply swap out the number sliders at the
# multiplication node in the oscillation script.
panel_3 = Panel("1")  # disabled
trigger_2 = Trigger(Interval=20, TimerInterval=20, Target=data_recorder_2)  # disabled
number_slider_4 = Slider(157, range=0..1000)  # disabled
data_recorder_2 = DataRecorder(panel_3, DataLimit=-10, RecordData=False)  # disabled
oscillation_2 = Oscillation(list=data_recorder_2, B=number_slider_4)  # -> result_2, result; disabled
panel_4 = Panel([oscillation_2.result_2, oscillation_2.result])  # disabled
# Okay, let's try a different approach:
# 
# Let's visualize a complex trigonometric spiral in 3D
# space using Python, Numpy, and Rhino Common API.
# We'll be using lambda functions as well to increase the
# complexity of our model:
# 
# Generate a series of 3D points following a spiral pattern.
# The spiral's radial distance from the origin at each step
# will be modified by a complex trigonometric function.
# The height will be determined by another trigonometric function.
# We'll use Rhino's API to create a polyline from these points for visualization.
multiplication_3 = Multiplication(A=oscillation_2.result_2)  # disabled
multiplication_4 = Multiplication(A=oscillation_2.result, B=number_slider_3)  # disabled

# ----
# #The Numpy Array:
# A Multidimensional Array Object
# test_random
number_slider_5 = Slider(4, range=0..4)  # disabled
number_slider_6 = Slider(5, range=0..20)  # disabled
numpy = Script(rows=number_slider_5, columns=number_slider_6)  # -> out, a, arr0_OUT, arr1_OUT, arr2_OUT, arr3_OUT; inputs rows: Int32, columns: Int32; disabled
# ---------- numpy: Python ----------
"""Grasshopper Script"""
#! python 3
a = "Welcome to Wickerson Studios!"
print(a)

# r: numpy

import numpy

arr = numpy.random.rand(rows, columns)

print(arr)
print(type(arr))
arr = arr.tolist()
print(arr)

arr_OUT = [arr[i] if i < rows else False for i in range(4)]
arr0_OUT, arr1_OUT, arr2_OUT, arr3_OUT = arr_OUT
# ---------- end numpy ----------
panel_5 = Panel(numpy.a)  # disabled
number = Number(numpy.arr0_OUT)  # disabled
# 002 Python Refresher
# Lambdas
# Lambdas Functions
# gpt-4 Text Prompt
# Create a geometric 3D model with
# 
# Container Data Structures
# with
# Lambdas Function
# 
# in python 3 code for the python 3 script
# node in grasshopper for Rhino8WIP using the
# 
# Rhino Common API.
# 
# Output the parts of the model in different
# variable outputs in the python 3 node in
# grasshopper.
panel_6 = Panel(number)  # disabled
number_2 = Number(numpy.arr1_OUT)  # disabled
panel_7 = Panel(number_2)  # disabled
number_3 = Number(numpy.arr2_OUT)  # disabled
panel_8 = Panel(number_3)  # disabled
number_4 = Number(numpy.arr3_OUT)  # disabled
number_slider_7 = Slider(10, range=0..100)  # disabled
panel_9 = Panel(number_4)  # disabled
multiplication_5 = Multiplication(A=number, B=number_slider_7)  # disabled
multiplication_6 = Multiplication(A=number_2, B=number_slider_7)  # disabled
construct_point = ConstructPoint(XCoordinate=multiplication_5, YCoordinate=graft(multiplication_5), ZCoordinate=0)  # disabled
construct_point_2 = ConstructPoint(XCoordinate=multiplication_5, YCoordinate=graft(multiplication_5), ZCoordinate=multiplication_6)  # disabled
unit_x = UnitX(Factor=number_3)  # disabled
line = Line(StartPoint=construct_point, EndPoint=construct_point_2)  # disabled
move = Move(Geometry=line, Motion=unit_x)  # -> Geometry, Transform; disabled
list_item = ListItem(List=graft(line), Index=0, Wrap=True)  # disabled
list_item_2 = ListItem(List=graft(move.Geometry), Index=0, Wrap=True)  # disabled
unit_y = UnitY(Factor=number_4)  # disabled
loft = Loft(
    Curves=[list_item, list_item_2],
    Options={Adjust=False, Closed=False, LoftEnds=0, LoftSimp=0, LoftType=0, Rebuild=10, Refit=0.01})  # disabled
extrude = Extrude(Base=loft, Direction=graft(unit_y))  # disabled

# ----
# 2nd gpt-4 Text Prompt
# Great, now create a much more complex model
# with complex trigonometric polynomials and the
# NUMPY python library. And be sure to use the
# 
# Lambdas Function
# 
# in Python 3.
# 
# And be sure to use the Rhino common api to output
# geometries for data visualization.
# gpt-4 2nd Response
absolute = Absolute(Value=multiplication_2)  # disabled
lambdas_function = Script(
    N=Slider(6, range=0..10),
    turns=Slider(100, range=0..100),
    resolution=Slider(17.136, range=0..100),
    intensity=number_slider_3)  # -> out, a; inputs N: Int32, turns: Int32, resolution: Double, intensity: Double
# ---------- lambdas_function: Python ----------
import Rhino.Geometry as rg
import numpy as np

# Constants for our trigonometric function
#N = 10
coefficients = [(np.random.rand() - 0.5) + 1j * (np.random.rand() - 0.5) for _ in range(2 * N + 1)]

# Lambda function to compute our complex trigonometric function
trig_func = lambda theta: sum([(coefficients[n + N] * np.exp(1j * n * theta)) for n in range(-N, N + 1)])

# Parameters for the spiral
#turns = 10  # Number of turns in the spiral
#resolution = 100  # Number of points per turn
#intensity = 1  # Scales the radial effect of our trigonometric polynomial

# Generate our spiral
theta_values = np.linspace(0, turns * 2 * np.pi, int(turns * resolution))  
points = []

for theta in theta_values:
    complex_val = trig_func(theta)
    
    r = intensity * abs(complex_val)  # Radial distance is the magnitude of our complex value
    z = theta / (2 * np.pi)  # Height increases linearly with theta, creating a spiral
    
    x = r * np.cos(theta)
    y = r * np.sin(theta)
    
    points.append(rg.Point3d(x, y, z))

# Create a Rhino polyline from our points
spiral_polyline = rg.Polyline(points).ToNurbsCurve()

# Output
a = spiral_polyline
# ---------- end lambdas_function ----------
lambdas_function_2 = Script(zDivide=absolute)  # -> out, a, b, c; inputs zDivide: Double; disabled
# ---------- lambdas_function_2: Python ----------
import Rhino.Geometry as rg
import random

def generate_points_in_box(box, count):
    """Generate random points within a bounding box."""
    points = []
    for _ in range(count):
        x = random.uniform(box.Min.X, box.Max.X)
        y = random.uniform(box.Min.Y, box.Max.Y)
        z = random.uniform(box.Min.Z, box.Max.Z)
        points.append(rg.Point3d(x, y, z))
    return points

# Define a bounding box
bounding_box = rg.BoundingBox(rg.Point3d(0, 0, 0), rg.Point3d(10, 10, 10))

# Generate a list of points inside the bounding box
points = generate_points_in_box(bounding_box, 100)

# Use a lambda function to filter points that are above the Z=5 plane
filtered_points = list(filter(lambda pt: pt.Z > zDivide, points))

# Output the results
a = bounding_box
b = points
c = filtered_points
# ---------- end lambdas_function_2 ----------
number_slider_8 = Slider(1.11, range=0..10)  # disabled
geometry = Geometry(lambdas_function.a)
geometry_2 = Geometry(lambdas_function_2.a)  # disabled
geometry_3 = Geometry(lambdas_function_2.b)  # disabled
geometry_4 = Geometry(lambdas_function_2.c)  # disabled
panel_10 = Panel(lambdas_function.out)
panel_11 = Panel(lambdas_function_2.out)  # disabled
panel_12 = Panel(geometry)
entwine = Entwine(Branch00=geometry_2, Branch01=geometry_3, Branch02=geometry_4, FlattenInputs=True)  # disabled
center_box = CenterBox(Base=geometry_4, X=number_slider_8, Y=number_slider_8, Z=number_slider_8)  # disabled
panel_13 = Panel(entwine)  # disabled

# ==== cluster Oscillation
list = ClusterInput()
list_length = ListLength(List=list)
B = ClusterInput()
division = Division(A=list_length, B=B)
cosine = Cosine(Value=division)
sine = Sine(Value=division)
result = ClusterOutput(cosine)
result_2 = ClusterOutput(sine)
