# Grasshopper definition 031_List_Comprehension_Find_Top_Earners.gh (Grasshopper 1.0.7)
# plug-ins: RhinoCodePluginGH

# ----
# Oscillation Algorithm
# The oscillation algorithm can be use to animate
# any geometry that is driven by a number sliders.
# Simply swap out the number sliders at the
# multiplication node in the oscillation script.
panel = Panel("1")  # disabled
trigger = Trigger(Interval=20, TimerInterval=20, Target=data_recorder)  # disabled
number_slider = Slider(157, range=0..1000)  # disabled
data_recorder = DataRecorder(panel, DataLimit=-10, RecordData=False)  # disabled
oscillation = Oscillation(list=data_recorder, B=number_slider)  # -> result_2, result; disabled
panel_2 = Panel([oscillation.result_2, oscillation.result])  # disabled
multiplication = Multiplication(A=oscillation.result_2)  # disabled
multiplication_2 = Multiplication(A=oscillation.result)  # disabled

# ----
# gpt-4 2nd Response
# Certainly! Let's build a more complex model using trigonometric functions
# and the numpy library, visualizing the results with the Rhino Common API.
# 
# In this example, we will visualize the surface defined by a trigonometric function:
# 
# z=sin(x ^2+y ^2)
number_slider_2 = Slider(11, range=0..100)
# gpt-4 Initial Response
# Creating a geometric 3D model using the Rhino Common
# API and Python can be a broad subject, but I'll create a
# simple example based on the given constraints.
# We'll create a set of points in a 3D grid using list
# comprehension and container data structures.
number_slider_3 = Slider(10, range=0..10)  # disabled
number_slider_4 = Slider(10, range=0..10)  # disabled
number_slider_5 = Slider(10, range=0..10)  # disabled
# 2nd gpt-4 Text Prompt
# Great, now create a much more complex model
# with complex trigonometric polynomials and the
# NUMPY python library. And be sure to use the
# 
# List Comprehension
# 
# in Python 3.
# 
# And be sure to use the Rhino common api to output
# geometries for data visualization.
number_slider_6 = Slider(3, range=0..10)  # disabled

# ----
# #The Numpy Array:
# A Multidimensional Array Object
# test_random
number_slider_7 = Slider(4, range=0..4)  # disabled
number_slider_8 = Slider(5, range=0..20)  # disabled
numpy = Script(rows=number_slider_7, columns=number_slider_8)  # -> out, a, arr0_OUT, arr1_OUT, arr2_OUT, arr3_OUT; inputs rows: Int32, columns: Int32; disabled
# ---------- numpy: Python ----------
"""Grasshopper Script"""
#! python 3
a = "Welcome to Wickerson Studios!"
print(a)

# r: numpy

import numpy

arr = numpy.random.rand(rows, columns)

print(arr)
print(type(arr))
arr = arr.tolist()
print(arr)

arr_OUT = [arr[i] if i < rows else False for i in range(4)]
arr0_OUT, arr1_OUT, arr2_OUT, arr3_OUT = arr_OUT
# ---------- end numpy ----------
panel_3 = Panel(numpy.a)  # disabled
number = Number(numpy.arr0_OUT)  # disabled
# 003 Python Tips
# List Comprehension
# The Basics
# gpt-4 Text Prompt
# Create a geometric 3D model with
# 
# Container Data Structures
# with
# List Comprehension and the Basics
# 
# in python 3 code for the python 3 script
# node in grasshopper for Rhino8WIP using the
# 
# Rhino Common API.
# 
# Output the parts of the model in different
# variable outputs in the python 3 node in
# grasshopper.
panel_4 = Panel(number)  # disabled
number_2 = Number(numpy.arr1_OUT)  # disabled
panel_5 = Panel(number_2)  # disabled
number_3 = Number(numpy.arr2_OUT)  # disabled
panel_6 = Panel(number_3)  # disabled
number_4 = Number(numpy.arr3_OUT)  # disabled
number_slider_9 = Slider(10, range=0..100)  # disabled
panel_7 = Panel(number_4)  # disabled
multiplication_3 = Multiplication(A=number, B=number_slider_9)  # disabled
multiplication_4 = Multiplication(A=number_2, B=number_slider_9)  # disabled
construct_point = ConstructPoint(XCoordinate=multiplication_3, YCoordinate=graft(multiplication_3), ZCoordinate=0)  # disabled
construct_point_2 = ConstructPoint(XCoordinate=multiplication_3, YCoordinate=graft(multiplication_3), ZCoordinate=multiplication_4)  # disabled
unit_x = UnitX(Factor=number_3)  # disabled
line = Line(StartPoint=construct_point, EndPoint=construct_point_2)  # disabled
move = Move(Geometry=line, Motion=unit_x)  # -> Geometry, Transform; disabled
list_item = ListItem(List=graft(line), Index=0, Wrap=True)  # disabled
list_item_2 = ListItem(List=graft(move.Geometry), Index=0, Wrap=True)  # disabled
unit_y = UnitY(Factor=number_4)  # disabled
loft = Loft(
    Curves=[list_item, list_item_2],
    Options={Adjust=False, Closed=False, LoftEnds=0, LoftSimp=0, LoftType=0, Rebuild=10, Refit=0.01})  # disabled
extrude = Extrude(Base=loft, Direction=graft(unit_y))  # disabled

list_comprehension = Script(x_ran=number_slider_3, y_ran=number_slider_4, z_ran=number_slider_5, space=number_slider_6)  # -> out, a; inputs x_ran: Int32, y_ran: Int32, z_ran: Int32, space: Int32; disabled
# ---------- list_comprehension: Python ----------
import Rhino
import rhinoscriptsyntax as rs

def create_3d_grid(x_range, y_range, z_range, spacing):
    """Create a 3D grid of points using list comprehension."""
    return [(x, y, z) for x in range(x_range) for y in range(y_range) for z in range(z_range) if x % spacing == 0 and y % spacing == 0 and z % spacing == 0]

# Use the function to create a 3D grid
points = create_3d_grid(x_ran, y_ran, z_ran, space)

# Convert the tuples to Rhino Point3d objects
rhino_points = [Rhino.Geometry.Point3d(pt[0], pt[1], pt[2]) for pt in points]

# Output the points
a = rhino_points
# ---------- end list_comprehension ----------
list_comprehension_2 = Script(res=number_slider_2, x_ran=Slider(2, range=0..10), y_ran=Slider(1, range=0..10))  # -> out, a; inputs res: Int32, x_ran: Int32, y_ran: Int32, intensity: Double
# ---------- list_comprehension_2: Python ----------
import Rhino
import numpy as np

def trigonometric_surface(x_range, y_range, resolution):
    """Generate a surface based on a trigonometric polynomial."""
    # Generate x and y arrays using numpy's linspace
    x = np.linspace(-x_range, x_range, resolution)
    y = np.linspace(-y_range, y_range, resolution)
    
    # Use numpy's meshgrid to create 2D grids of x and y
    X, Y = np.meshgrid(x, y)
    
    # Compute Z values based on our trigonometric polynomial
    Z = np.sin(X**2 + Y**2)
    
    return X, Y, Z

# Generate the surface data
X, Y, Z = trigonometric_surface(x_ran, y_ran, res)

# Convert the numpy arrays to Rhino points using list comprehension
rhino_points = [Rhino.Geometry.Point3d(X[i, j], Y[i, j], Z[i, j]) for i in range(X.shape[0]) for j in range(X.shape[1])]

# Output the points for visualization
a = rhino_points
# ---------- end list_comprehension_2 ----------
geometry = Geometry(list_comprehension.a)  # disabled
geometry_2 = Geometry(list_comprehension_2.a)
panel_8 = Panel(list_comprehension_2.out)
panel_9 = Panel(list_comprehension.out)  # disabled
entwine = Entwine(Branch00=geometry, FlattenInputs=True)  # disabled
interpolate = Interpolate(Vertices=geometry_2, Degree=3, Periodic=False, KnotStyle=1)  # -> Curve, Length, Domain
panel_10 = Panel(entwine)  # disabled
panel_11 = Panel(geometry_2)

# ==== cluster Oscillation
list = ClusterInput()
list_length = ListLength(List=list)
B = ClusterInput()
division = Division(A=list_length, B=B)
cosine = Cosine(Value=division)
sine = Sine(Value=division)
result = ClusterOutput(cosine)
result_2 = ClusterOutput(sine)
