# Grasshopper definition 032_List_Comprehension_Find_Top_Earners.gh (Grasshopper 1.0.7)
# plug-ins: RhinoCodePluginGH

# ----
# Oscillation Algorithm
# The oscillation algorithm can be use to animate
# any geometry that is driven by a number sliders.
# Simply swap out the number sliders at the
# multiplication node in the oscillation script.
panel = Panel("1")  # disabled
trigger = Trigger(Interval=20, TimerInterval=20, Target=data_recorder)  # disabled
number_slider = Slider(157, range=0..1000)  # disabled
data_recorder = DataRecorder(panel, DataLimit=-10, RecordData=False)  # disabled
oscillation = Oscillation(list=data_recorder, B=number_slider)  # -> result_2, result; disabled
panel_2 = Panel([oscillation.result_2, oscillation.result])  # disabled
multiplication = Multiplication(A=oscillation.result_2)  # disabled
multiplication_2 = Multiplication(A=oscillation.result)  # disabled

# ----
# #The Numpy Array:
# A Multidimensional Array Object
# test_random
number_slider_2 = Slider(4, range=0..4)  # disabled
number_slider_3 = Slider(5, range=0..20)  # disabled
numpy = Script(rows=number_slider_2, columns=number_slider_3)  # -> out, a, arr0_OUT, arr1_OUT, arr2_OUT, arr3_OUT; inputs rows: Int32, columns: Int32; disabled
# ---------- numpy: Python ----------
"""Grasshopper Script"""
#! python 3
a = "Welcome to Wickerson Studios!"
print(a)

# r: numpy

import numpy

arr = numpy.random.rand(rows, columns)

print(arr)
print(type(arr))
arr = arr.tolist()
print(arr)

arr_OUT = [arr[i] if i < rows else False for i in range(4)]
arr0_OUT, arr1_OUT, arr2_OUT, arr3_OUT = arr_OUT
# ---------- end numpy ----------
panel_3 = Panel(numpy.a)  # disabled
number = Number(numpy.arr0_OUT)  # disabled
# 003 Python Tips
# List Comprehension
# USING LIST COMPREHENSION
# TO FIND TOP EARNERS
# gpt-4 Text Prompt
# Create a geometric 3D model with
# 
# Container Data Structures
# with
# USING LIST COMPREHENSION
# TO FIND TOP EARNERS
# 
# in python 3 code for the python 3 script
# node in grasshopper for Rhino8WIP using the
# 
# Rhino Common API.
# 
# Output the parts of the model in different
# variable outputs in the python 3 node in
# grasshopper.
panel_4 = Panel(number)  # disabled
number_2 = Number(numpy.arr1_OUT)  # disabled
panel_5 = Panel(number_2)  # disabled
number_3 = Number(numpy.arr2_OUT)  # disabled
panel_6 = Panel(number_3)  # disabled
number_4 = Number(numpy.arr3_OUT)  # disabled
number_slider_4 = Slider(10, range=0..100)  # disabled
panel_7 = Panel(number_4)  # disabled
multiplication_3 = Multiplication(A=number, B=number_slider_4)  # disabled
multiplication_4 = Multiplication(A=number_2, B=number_slider_4)  # disabled
construct_point = ConstructPoint(XCoordinate=multiplication_3, YCoordinate=graft(multiplication_3), ZCoordinate=0)  # disabled
construct_point_2 = ConstructPoint(XCoordinate=multiplication_3, YCoordinate=graft(multiplication_3), ZCoordinate=multiplication_4)  # disabled
unit_x = UnitX(Factor=number_3)  # disabled
line = Line(StartPoint=construct_point, EndPoint=construct_point_2)  # disabled
move = Move(Geometry=line, Motion=unit_x)  # -> Geometry, Transform; disabled
list_item = ListItem(List=graft(line), Index=0, Wrap=True)  # disabled
list_item_2 = ListItem(List=graft(move.Geometry), Index=0, Wrap=True)  # disabled
unit_y = UnitY(Factor=number_4)  # disabled
loft = Loft(
    Curves=[list_item, list_item_2],
    Options={Adjust=False, Closed=False, LoftEnds=0, LoftSimp=0, LoftType=0, Rebuild=10, Refit=0.01})  # disabled
extrude = Extrude(Base=loft, Direction=graft(unit_y))  # disabled

number_slider_5 = Slider(10, range=0..10)  # disabled
# gpt-4 Initial Response
# Creating a full Grasshopper script with Rhino Common API
# calls requires more than just Python code snippets,
# as it involves interacting with the Grasshopper environment and Rhino's APIs.
# However, I can provide you with a high-level overview and code snippets
# for the various components you mentioned:
# creating a geometric 3D model using containers,
# using list comprehension to find top earners,
# and outputting the model parts to different variables in a Python node in Grasshopper.
number_slider_6 = Slider(10, range=0..10)  # disabled
number_slider_7 = Slider(10, range=0..10)  # disabled
# 2nd gpt-4 Text Prompt
# make this geometric model more complex and parametric please
# gpt-4 2nd Response
# Certainly! Let's create a more complex and
# parametric geometric model using Rhino
# Common API in Grasshopper. We'll create a
# parametric tower with variable heights and a
# twisting shape. This example will showcase how
# to use Grasshopper sliders to control
# parameters and generate a more intricate
# model.
# 
# Certainly! Let's create a more complex and
# parametric geometric model using Rhino
# Common API in Grasshopper. We'll create a
# parametric tower with variable heights and a
# twisting shape. This example will showcase how
# to use Grasshopper sliders to control
# parameters and generate a more intricate
# model.
number_slider_8 = Slider(3, range=0..10)  # disabled
number_slider_9 = Slider(7.92, range=0..10)  # disabled
number_slider_10 = Slider(4, range=0..10)  # disabled
number_slider_11 = Slider(360, range=0..360)  # disabled
number_slider_12 = Slider(20, range=0..20)  # disabled
top_earners = Script(x_ran=number_slider_6, y_ran=number_slider_5, z_ran=number_slider_7, space=number_slider_8)  # -> out, a, b, c; inputs x_ran: Int32, y_ran: Int32, z_ran: Int32, space: Int32; disabled
# ---------- top_earners: Python ----------
import Rhino.Geometry as rg
import ghpythonlib.treehelpers as th
import numpy as np

# Create containers for geometric data
points = [rg.Point3d(0, 0, 0), rg.Point3d(1, 1, 1), rg.Point3d(2, 2, 2)]  # Example points
curves = [rg.LineCurve(points[i], points[i + 1]) for i in range(len(points) - 1)]

# Create a lofted surface
loft_brep = rg.Brep.CreateFromLoft(curves, rg.Point3d.Unset, rg.Point3d.Unset, rg.LoftType.Normal, closed=False)

# Get the first brep from the list (loft creates a list of Breps)
brep = loft_brep[0]

# Add brep to the Rhino document
if brep.IsValid:
    scriptcontext.doc.Objects.AddBrep(brep)

earners = [
    {"name": "Alice", "earnings": 10000},
    {"name": "Bob", "earnings": 15000},
    {"name": "Carol", "earnings": 8000},
    # ... more earners ...
]

top_earners = [earner for earner in earners if earner["earnings"] > 10000]

# Convert the data to Grasshopper trees
point_tree = th.list_to_tree([[p.X, p.Y, p.Z] for p in points])
curve_tree = th.list_to_tree(curves)

# Convert the brep to a list of breps
brep_list = [brep] if brep else []
brep_tree = th.list_to_tree(brep_list)

# Output the trees to different outputs
a = point_tree
b = curve_tree
c = brep_tree
# ---------- end top_earners ----------
top_earners_2 = Script(num_floors=number_slider_10, floor_height=number_slider_9, twist_angle=number_slider_11, twist_steps=number_slider_12)  # -> out, a, b, c; inputs num_floors: Int32, floor_height: Double, twist_angle: Int32, twist_steps: Int32; disabled
# ---------- top_earners_2: Python ----------
import Rhino.Geometry as rg
import ghpythonlib.treehelpers as th
import math

# Parameters
base_point = rg.Point3d(0, 0, 0)
#num_floors = 10
#floor_height = 5.0
#twist_angle = 30.0  # in degrees
#twist_steps = 20

# Create containers for geometric data
points = []

for i in range(num_floors + 1):
    z = i * floor_height
    angle = math.radians(twist_angle * i / num_floors)
    x = math.cos(angle) * z
    y = math.sin(angle) * z
    points.append(rg.Point3d(x, y, z))

# Create curves for the tower structure
curves = [rg.LineCurve(points[i], points[i + 1]) for i in range(len(points) - 1)]

# Create a lofted surface
loft_brep = rg.Brep.CreateFromLoft(curves, rg.Point3d.Unset, rg.Point3d.Unset, rg.LoftType.Normal, closed=False)

# Get the first brep from the list (loft creates a list of Breps)
brep = loft_brep[0]

# Add brep to the Rhino document
if brep.IsValid:
    scriptcontext.doc.Objects.AddBrep(brep)

# Convert the data to Grasshopper trees
point_tree = th.list_to_tree([[p.X, p.Y, p.Z] for p in points])
curve_tree = th.list_to_tree(curves)

# Convert the brep to a list of breps
brep_list = [brep] if brep else []
brep_tree = th.list_to_tree(brep_list)

# Output the trees to different outputs
a = point_tree
b = curve_tree
c = brep_tree
# ---------- end top_earners_2 ----------
curve = Curve(top_earners_2.b)  # disabled
brep = Brep(top_earners_2.c)  # disabled
panel_8 = Panel(top_earners.out)  # disabled
entwine = Entwine(Branch00=top_earners.a, Branch01=top_earners.b, Branch02=top_earners.c, FlattenInputs=True)  # disabled
panel_9 = Panel(top_earners_2.out)  # disabled
entwine_2 = Entwine(Branch00=top_earners_2.a, Branch01=curve, Branch02=brep, FlattenInputs=True)  # disabled
panel_10 = Panel(entwine)  # disabled
panel_11 = Panel(entwine_2)  # disabled

# ==== cluster Oscillation
list = ClusterInput()
list_length = ListLength(List=list)
B = ClusterInput()
division = Division(A=list_length, B=B)
cosine = Cosine(Value=division)
sine = Sine(Value=division)
result = ClusterOutput(cosine)
result_2 = ClusterOutput(sine)
