# Grasshopper definition 033_List_Com_Words_High_Info_Value.gh (Grasshopper 1.0.7)
# plug-ins: RhinoCodePluginGH

# ----
# Oscillation Algorithm
# The oscillation algorithm can be use to animate
# any geometry that is driven by a number sliders.
# Simply swap out the number sliders at the
# multiplication node in the oscillation script.
panel = Panel("1")  # disabled
trigger = Trigger(Interval=20, TimerInterval=20, Target=data_recorder)  # disabled
number_slider = Slider(157, range=0..1000)  # disabled
data_recorder = DataRecorder(panel, DataLimit=-10, RecordData=False)  # disabled
oscillation = Oscillation(list=data_recorder, B=number_slider)  # -> result_2, result; disabled
panel_2 = Panel([oscillation.result_2, oscillation.result])  # disabled
multiplication = Multiplication(A=oscillation.result_2)  # disabled
multiplication_2 = Multiplication(A=oscillation.result)  # disabled

# ----
# #The Numpy Array:
# A Multidimensional Array Object
# test_random
number_slider_2 = Slider(4, range=0..4)  # disabled
number_slider_3 = Slider(5, range=0..20)  # disabled
numpy = Script(rows=number_slider_2, columns=number_slider_3)  # -> out, a, arr0_OUT, arr1_OUT, arr2_OUT, arr3_OUT; inputs rows: Int32, columns: Int32; disabled
# ---------- numpy: Python ----------
"""Grasshopper Script"""
#! python 3
a = "Welcome to Wickerson Studios!"
print(a)

# r: numpy

import numpy

arr = numpy.random.rand(rows, columns)

print(arr)
print(type(arr))
arr = arr.tolist()
print(arr)

arr_OUT = [arr[i] if i < rows else False for i in range(4)]
arr0_OUT, arr1_OUT, arr2_OUT, arr3_OUT = arr_OUT
# ---------- end numpy ----------
panel_3 = Panel(numpy.a)  # disabled
number = Number(numpy.arr0_OUT)  # disabled
# 003 Python Tips
# List Comprehension
# USING LIST COMPREHENSION
# TO FIND WORDS WITH HIGH
# INFORMATION VALUE
# gpt-4 Text Prompt
# Create a geometric 3D model with
# 
# Container Data Structures
# with
# USING LIST COMPREHENSION
# TO FIND WORDS WITH HIGH
# INFORMATION VALUE
# use this in the script instead: ## One-Liner
# w = [[x for x in line.split() if len(x)>3] for line in text.split('\n')]
# 
# in python 3 code for the python 3 script
# node in grasshopper for Rhino8WIP using the
# 
# Rhino Common API.
# 
# Output the parts of the model in different
# variable outputs in the python 3 node in
# grasshopper.
panel_4 = Panel(number)  # disabled
number_2 = Number(numpy.arr1_OUT)  # disabled
panel_5 = Panel(number_2)  # disabled
number_3 = Number(numpy.arr2_OUT)  # disabled
panel_6 = Panel(number_3)  # disabled
number_4 = Number(numpy.arr3_OUT)  # disabled
number_slider_4 = Slider(10, range=0..100)  # disabled
panel_7 = Panel(number_4)  # disabled
multiplication_3 = Multiplication(A=number, B=number_slider_4)  # disabled
multiplication_4 = Multiplication(A=number_2, B=number_slider_4)  # disabled
construct_point = ConstructPoint(XCoordinate=multiplication_3, YCoordinate=graft(multiplication_3), ZCoordinate=0)  # disabled
construct_point_2 = ConstructPoint(XCoordinate=multiplication_3, YCoordinate=graft(multiplication_3), ZCoordinate=multiplication_4)  # disabled
unit_x = UnitX(Factor=number_3)  # disabled
line = Line(StartPoint=construct_point, EndPoint=construct_point_2)  # disabled
move = Move(Geometry=line, Motion=unit_x)  # -> Geometry, Transform; disabled
list_item = ListItem(List=graft(line), Index=0, Wrap=True)  # disabled
list_item_2 = ListItem(List=graft(move.Geometry), Index=0, Wrap=True)  # disabled
unit_y = UnitY(Factor=number_4)  # disabled
loft = Loft(
    Curves=[list_item, list_item_2],
    Options={Adjust=False, Closed=False, LoftEnds=0, LoftSimp=0, LoftType=0, Rebuild=10, Refit=0.01})  # disabled
extrude = Extrude(Base=loft, Direction=graft(unit_y))  # disabled

# ----
# gpt-4 Initial Response
# Creating a complete 3D geometric model within a single text
# response isn't feasible. However, I can provide you with a Python code snippet
# that demonstrates how to use container data structures, list comprehension,
# and output variables within a Grasshopper Python node using the Rhino Common API.
# You can use this as a starting point and adapt it to your specific needs.
# 2nd gpt-4 Text Prompt
# Great, nowmake the script much more complex model
# with complex trigonometric polynomials and the
# NUMPY python library. Be sure to incorporate the previous code logic.
# ensure that this script produces 3d geometry as
# well for Data visualization purposes.
number_slider_5 = Slider(4, range=0..10)  # disabled
# gpt-4 2nd Response
# Certainly! I'll enhance the script by incorporating
#  complex trigonometric polynomials and the
# NumPy library for more advanced calculations.
# Here's the updated code:
number_slider_6 = Slider(7, range=0..10)
words_high_info_value = Script(numChar=number_slider_5)  # -> out, a, b, c; inputs numChar: Int32; disabled
# ---------- words_high_info_value: Python ----------
import rhinoscriptsyntax as rs

def main():
    # Sample text containing lines of words
    text = "apple banana cherry\norange date\ngrape pineapple"

    # Use list comprehension to process the text
    w = [[x for x in line.split() if len(x) > 3] for line in text.split('\n')]

    # Flatten the nested list
    words = [word for sublist in w for word in sublist]

    # Create lists to store different parts of the model
    high_info_words = [word for word in words if len(word) > numChar]
    low_info_words = [word for word in words if len(word) <= numChar]

    # Output variables for Grasshopper
    high_info_output = high_info_words
    low_info_output = low_info_words

    # Print results
    print("High Information Words:", high_info_output)
    print("Low Information Words:", low_info_output)

    # Create simple point objects for visualization (replace with actual geometry)
    for idx, word in enumerate(words):
        point = rs.AddPoint(idx, len(word) * 0.1, 0)
        rs.ObjectName(point, word)

if __name__ == "__main__":
    main()
# ---------- end words_high_info_value ----------
words_high_info_value_2 = Script(numChar=number_slider_6)  # -> out, a; inputs numChar: Int32
# ---------- words_high_info_value_2: Python ----------
import rhinoscriptsyntax as rs
import Grasshopper as gh

def main():
    # Sample text containing lines of words
    text = "apple banana cherry\norange date\ngrape pineapple"

    # Use list comprehension to process the text
    w = [[x for x in line.split() if len(x) > 3] for line in text.split('\n')]

    # Flatten the nested list
    words = [word for sublist in w for word in sublist]

    # Define the number of characters threshold
    #numChar = 6

    # Create lists to store different parts of the model
    high_info_words = [word for word in words if len(word) > numChar]
    low_info_words = [word for word in words if len(word) <= numChar]

    # Print results
    print("High Information Words:", high_info_words)
    print("Low Information Words:", low_info_words)

    # Create simple point objects for visualization
    points = []
    for idx, word in enumerate(words):
        point = rs.AddPoint(idx, len(word) * 0.1, 0)
        if point:
            rs.ObjectName(point, word)
            points.append(point)

    return points  # Return the list of points

def create_geometry_from_points(points):
    geometry_ids = []
    for point in points:
        circle = rs.AddCircle(point, 0.1)  # Create a circle at the point
        if circle:
            rs.ObjectName(circle, "Circle")
            geometry_ids.append(circle)
    return geometry_ids

if __name__ == "__main__":
    output_points = main()  # Store the returned points
    output_geometry = create_geometry_from_points(output_points)
    
    # Output the geometry IDs
    a = output_geometry
# ---------- end words_high_info_value_2 ----------
panel_8 = Panel(words_high_info_value.out)  # disabled
panel_9 = Panel(words_high_info_value_2.out)
entwine = Entwine(Branch00=words_high_info_value_2.a, FlattenInputs=True)
entwine_2 = Entwine(Branch00=words_high_info_value.a, Branch01=words_high_info_value.b, Branch02=words_high_info_value.c, FlattenInputs=True)  # disabled
panel_10 = Panel(words_high_info_value_2.a)
panel_11 = Panel(entwine_2)  # disabled

# ==== cluster Oscillation
list = ClusterInput()
list_length = ListLength(List=list)
B = ClusterInput()
division = Division(A=list_length, B=B)
cosine = Cosine(Value=division)
sine = Sine(Value=division)
result = ClusterOutput(cosine)
result_2 = ClusterOutput(sine)
