# Grasshopper definition 034_Reading_File.gh (Grasshopper 1.0.7)
# plug-ins: RhinoCodePluginGH

# ----
# Oscillation Algorithm
# The oscillation algorithm can be use to animate
# any geometry that is driven by a number sliders.
# Simply swap out the number sliders at the
# multiplication node in the oscillation script.
panel = Panel("1")  # disabled
trigger = Trigger(Interval=20, TimerInterval=20, Target=data_recorder)  # disabled
number_slider = Slider(157, range=0..1000)  # disabled
data_recorder = DataRecorder(panel, DataLimit=-10, RecordData=False)  # disabled
oscillation = Oscillation(list=data_recorder, B=number_slider)  # -> result_2, result; disabled
panel_2 = Panel([oscillation.result_2, oscillation.result])  # disabled
multiplication = Multiplication(A=oscillation.result_2)  # disabled
multiplication_2 = Multiplication(A=oscillation.result)  # disabled

# ----
# gpt-4 Initial Response
# Creating a complete Grasshopper definition
# involving Rhino Common API, file reading, and
# geometry generation is quite complex and
# requires a detailed step-by-step approach.
# Below, I'll provide you with a simplified example
# that demonstrates the basic concepts. You can
# expand upon this example to fit your specific
# needs and use-case.
# 2nd gpt-4 Text Prompt
# Great, now make the script much more complex model
# with complex trigonometric polynomials and the
# NUMPY python library. Be sure to incorporate the previous code logic.
# ensure that this script produces 3d geometry as
# well for Data visualization purposes.
panel_3 = Panel("C:\Users\Sculpture\Desktop\readFile.py")  # disabled

# ----
# #The Numpy Array:
# A Multidimensional Array Object
# test_random
number_slider_2 = Slider(4, range=0..4)  # disabled
number_slider_3 = Slider(4, range=0..20)  # disabled
numpy = Script(rows=number_slider_2, columns=number_slider_3)  # -> out, a, arr0_OUT, arr1_OUT, arr2_OUT, arr3_OUT; inputs rows: Int32, columns: Int32; disabled
# ---------- numpy: Python ----------
"""Grasshopper Script"""
#! python 3
a = "Welcome to Wickerson Studios!"
print(a)

# r: numpy, geopandas

import numpy

arr = numpy.random.rand(rows, columns)

print(arr)
print(type(arr))
arr = arr.tolist()
print(arr)

arr_OUT = [arr[i] if i < rows else False for i in range(4)]
arr0_OUT, arr1_OUT, arr2_OUT, arr3_OUT = arr_OUT
# ---------- end numpy ----------
panel_4 = Panel(numpy.a)  # disabled
number = Number(numpy.arr0_OUT)  # disabled
# 003 Python Tips
# Reading A File
# Reading A File: print([line.strip() for line in open("readFile.py")])
# gpt-4 Text Prompt
# Create a geometric 3D model with
# 
# Container Data Structures with
# Reading A File:
# use this in the script:
# print([line.strip() for line in open("readFile.py")])
# 
# 
# in python 3 code for the python 3 script
# node in grasshopper for Rhino8WIP using the
# 
# Rhino Common API to create some geometry as well.
# 
# Output the parts of the model in different
# variable outputs in the python 3 node in
# grasshopper.
panel_5 = Panel(number)  # disabled
number_2 = Number(numpy.arr1_OUT)  # disabled
panel_6 = Panel(number_2)  # disabled
number_3 = Number(numpy.arr2_OUT)  # disabled
panel_7 = Panel(number_3)  # disabled
number_4 = Number(numpy.arr3_OUT)  # disabled
number_slider_4 = Slider(10, range=0..100)  # disabled
panel_8 = Panel(number_4)  # disabled
multiplication_3 = Multiplication(A=number, B=number_slider_4)  # disabled
multiplication_4 = Multiplication(A=number_2, B=number_slider_4)  # disabled
construct_point = ConstructPoint(XCoordinate=multiplication_3, YCoordinate=graft(multiplication_3), ZCoordinate=0)  # disabled
construct_point_2 = ConstructPoint(XCoordinate=multiplication_3, YCoordinate=graft(multiplication_3), ZCoordinate=multiplication_4)  # disabled
unit_x = UnitX(Factor=number_3)  # disabled
line = Line(StartPoint=construct_point, EndPoint=construct_point_2)  # disabled
move = Move(Geometry=line, Motion=unit_x)  # -> Geometry, Transform; disabled
list_item = ListItem(List=graft(line), Index=0, Wrap=True)  # disabled
list_item_2 = ListItem(List=graft(move.Geometry), Index=0, Wrap=True)  # disabled
unit_y = UnitY(Factor=number_4)  # -> graft(UnitVector); disabled
loft = Loft(
    Curves=[list_item, list_item_2],
    Options={Adjust=False, Closed=False, LoftEnds=0, LoftSimp=0, LoftType=0, Rebuild=10, Refit=0.01})  # disabled
extrude = Extrude(Base=loft, Direction=unit_y)  # disabled

number_slider_5 = Slider(18, range=0..24)
number_slider_6 = Slider(8, range=0..24)  # disabled
number_slider_7 = Slider(0.75, range=0..2)  # disabled
number_slider_8 = Slider(24, range=0..24)  # disabled
# gpt-4 2nd Response
# Certainly! Let's create a more complex script
# that generates 3D geometry using complex
# trigonometric polynomials and the NumPy library
# for enhanced functionality. In this example, we'll
# generate a surface using a combination of sine
# and cosine functions. This surface will be
# constructed using points, and the points will be
# visualized as geometry in Rhino's 3D space.
panel_9 = Panel("C:\Users\Sculpture\Desktop\readFile.py")  # disabled
panel_10 = Panel("C:\Users\Sculpture\Desktop\readFile.py")  # disabled
reading_a_file = Script(FilePath=panel_3)  # -> out, a; inputs FilePath: String; disabled
# ---------- reading_a_file: Python ----------
import scriptcontext as sc
import Rhino

# Read the file path input
file_path = FilePath

# Read the lines from the file
lines = []
with open(file_path, "r") as file:
    lines = file.readlines()

# Create a list to store the generated points
points = []
for line in lines:
    try:
        x, y, z = map(float, line.strip().split(","))
        point = Rhino.Geometry.Point3d(x, y, z)
        points.append(point)
    except ValueError:
        # Skip non-numeric lines and continue
        pass

# Output the generated points
a = points
# ---------- end reading_a_file ----------
reading_a_file_2 = Script(FilePath="C:\Users\Sculpture\Desktop\readFile.py", u=number_slider_5, v=number_slider_5, scale=Slider(0.6, range=0..2))  # -> out, a, b; inputs FilePath: String, u: Int32, v: Int32, scale: Double
# ---------- reading_a_file_2: Python ----------
import scriptcontext as sc
import Rhino
import numpy as np

# Read the file path input
file_path = FilePath

# Read the lines from the file
lines = []
with open(file_path, "r") as file:
    lines = file.readlines()

# Create a list to store the generated points
points = []
for line in lines:
    try:
        x, y, z = map(float, line.strip().split(","))
        point = Rhino.Geometry.Point3d(x, y, z)
        points.append(point)
    except ValueError:
        # Skip non-numeric lines and continue
        pass

# Generate a complex trigonometric polynomial surface
u_vals = np.linspace(0, 2 * np.pi, u)
v_vals = np.linspace(0, np.pi, v)
u_mesh, v_mesh = np.meshgrid(u_vals, v_vals)
x_vals = np.real(np.sin(u_mesh) * np.cos(v_mesh))
y_vals = np.real(np.sin(u_mesh) * np.sin(v_mesh))
z_vals = np.real(np.cos(u_mesh))

# Modify surface points using the points
for point in points:
    x_index = int(point.X * (len(u_vals) - 1) / 10)
    y_index = int(point.Y * (len(v_vals) - 1) / 10)
    z_vals[x_index, y_index] += point.Z * 0.1

# Create a surface using the modified values
surface_points = []
for i in range(len(u_vals)):
    for j in range(len(v_vals)):
        point = Rhino.Geometry.Point3d(x_vals[i, j], y_vals[i, j], z_vals[i, j])
        surface_points.append(point)

# Output the combined points (from the file and the modified surface)
a = surface_points 
b = points
# ---------- end reading_a_file_2 ----------
reading_a_file_3 = Script(FilePath=panel_9, u=number_slider_8, v=number_slider_8)  # -> out, a, b; inputs FilePath: String, u: Int32, v: Int32; disabled
# ---------- reading_a_file_3: Python ----------
import scriptcontext as sc
import Rhino
import numpy as np

# Read the file path input
file_path = FilePath

# Read the lines from the file
lines = []
with open(file_path, "r") as file:
    lines = file.readlines()

# Create a list to store the generated points
points = []
for line in lines:
    try:
        x, y, z = map(float, line.strip().split(","))
        point = Rhino.Geometry.Point3d(x, y, z)
        points.append(point)
    except ValueError:
        # Skip non-numeric lines and continue
        pass

# Generate a complex trigonometric polynomial surface
u_vals = np.linspace(0, 2 * np.pi, u)
v_vals = np.linspace(0, np.pi, v)
u_mesh, v_mesh = np.meshgrid(u_vals, v_vals)
x_vals = np.real(np.sin(u_mesh) * np.cos(v_mesh))
y_vals = np.real(np.sin(u_mesh) * np.sin(v_mesh))
z_vals = np.real(np.cos(u_mesh))

# Create a surface using the generated points
surface_points = []
for i in range(len(u_vals)):
    for j in range(len(v_vals)):
        point = Rhino.Geometry.Point3d(x_vals[i, j], y_vals[i, j], z_vals[i, j])
        surface_points.append(point)

# Output the combined points (from the file and the surface)
a = points
b = surface_points
# ---------- end reading_a_file_3 ----------
reading_a_file_4 = Script(FilePath=panel_10, u=number_slider_6, v=number_slider_6, scale=number_slider_7)  # -> out, a, b; inputs FilePath: String, u: Int32, v: Int32, scale: Double; disabled
# ---------- reading_a_file_4: Python ----------
import scriptcontext as sc
import Rhino
import numpy as np

# Read the file path input
file_path = FilePath

# Read the lines from the file
lines = []
with open(file_path, "r") as file:
    lines = file.readlines()

# Create a list to store the generated points
points = []
for line in lines:
    try:
        x, y, z = map(float, line.strip().split(","))
        point = Rhino.Geometry.Point3d(x, y, z)
        points.append(point)
    except ValueError:
        # Skip non-numeric lines and continue
        pass

# Generate a complex trigonometric polynomial surface
u_vals = np.linspace(0, 2 * np.pi, u)
v_vals = np.linspace(0, np.pi, v)
u_mesh, v_mesh = np.meshgrid(u_vals, v_vals)

# Modify the surface shape using points
x_vals = np.real(np.sin(u_mesh) * np.cos(v_mesh))
y_vals = np.real(np.sin(u_mesh) * np.sin(v_mesh))
z_vals = np.real(np.cos(u_mesh))

for point in points:
    x_index = int(point.X * len(u_vals) / 10)
    y_index = int(point.Y * len(v_vals) / 10)
    z_vals[x_index, y_index] += point.Z * scale

# Create a surface using the modified values
surface_points = []
for i in range(len(u_vals)):
    for j in range(len(v_vals)):
        point = Rhino.Geometry.Point3d(x_vals[i, j], y_vals[i, j], z_vals[i, j])
        surface_points.append(point)

# Output the combined points (from the file and the modified surface)
a = points 
b = surface_points
# ---------- end reading_a_file_4 ----------
sphere = Sphere(Base=reading_a_file.a, Radius=1)  # disabled
panel_11 = Panel(reading_a_file.out)  # disabled
entwine = Entwine(FlattenInputs=True)  # disabled
point = Point(reading_a_file_2.b)
point_2 = Point(reading_a_file_2.a)
panel_12 = Panel(reading_a_file_2.out)
point_3 = Point(reading_a_file_3.b)  # disabled
point_4 = Point(reading_a_file_4.b)  # disabled
point_5 = Point(reading_a_file_3.a)  # disabled
point_6 = Point(reading_a_file_4.a)  # disabled
panel_13 = Panel(reading_a_file_3.out)  # disabled
panel_14 = Panel(reading_a_file_4.out)  # disabled
entwine_2 = Entwine(Branch00=point_2, Branch01=point, FlattenInputs=True)
entwine_3 = Entwine(Branch00=point_5, Branch01=point_3, FlattenInputs=True)  # disabled
entwine_4 = Entwine(Branch00=point_6, Branch01=point_4, FlattenInputs=True)  # disabled
panel_15 = Panel(reading_a_file.a)  # disabled
panel_16 = Panel(entwine_2)
panel_17 = Panel(entwine_3)  # disabled
panel_18 = Panel(entwine_4)  # disabled

# ==== cluster Oscillation
list = ClusterInput()
list_length = ListLength(List=list)
B = ClusterInput()
division = Division(A=list_length, B=B)
cosine = Cosine(Value=division)
sine = Sine(Value=division)
result = ClusterOutput(cosine)
result_2 = ClusterOutput(sine)
