# Grasshopper definition 035_Lambdas_map_functions.gh (Grasshopper 1.0.7)
# plug-ins: RhinoCodePluginGH

# ----
# Oscillation Algorithm
# The oscillation algorithm can be use to animate
# any geometry that is driven by a number sliders.
# Simply swap out the number sliders at the
# multiplication node in the oscillation script.
panel = Panel("1")
trigger = Trigger(Interval=20, TimerInterval=20, Target=data_recorder)
data_recorder = DataRecorder(panel, DataLimit=-10, RecordData=False)
oscillation = Oscillation(list=data_recorder, B=Slider(46, range=0..1000))  # -> result_2, result
panel_2 = Panel([oscillation.result_2, oscillation.result])
multiplication = Multiplication(A=oscillation.result_2, B=Slider(2.44, range=-3..3))
multiplication_2 = Multiplication(A=oscillation.result, B=Slider(3, range=-3..3))

panel_3 = Panel("""anonymous1
Michael
random text
another anonymous
anonymous
Mich
another anonymous
anonymous1
Mich
another anonymous
anonymous1
Michael
rando
Michael
random text
another anonymous""")
panel_4 = Panel("""anonymous1
Michael
random text
another anonymous
Wickerson 
just text
anonymous again""")  # disabled
# To make the script more sophisticated, I'll integrate:
# 
# Complex Numbers and their Trigonometric Relations: Specifically, Euler's formula which is
# 
# e ^ix =cos(x)+isin(x)
# 
# This will let us treat the trigonometric function as a complex function.
# 3D Grid of Points: Instead of just a single line, let's generate a grid in 3D space based on the trigonometric functions.
# Geometry Displacement: We'll use complex trigonometric functions to influence the position of these points in 3D space.
panel_5 = Panel("""anonymous1
Michael
random text
another anonymous
Wickerson 
just text
anonymous again
another anonymous
Wickerson 
just text
anonymous again
random text
another anonymous
Wickerson 
just text
anonymous again""")  # disabled
panel_6 = Panel("""anonymous1
Michael
random text
another anonymous
Wickerson 
just text
anonymous again""")  # disabled

# ----
# #The Numpy Array:
# A Multidimensional Array Object
# test_random
number_slider = Slider(4, range=0..4)  # disabled
number_slider_2 = Slider(4, range=0..20)  # disabled
numpy = Script(rows=number_slider, columns=number_slider_2)  # -> out, a, arr0_OUT, arr1_OUT, arr2_OUT, arr3_OUT; inputs rows: Int32, columns: Int32; disabled
# ---------- numpy: Python ----------
"""Grasshopper Script"""
#! python 3
a = "Welcome to Wickerson Studios!"
print(a)

# r: numpy, geopandas

import numpy

arr = numpy.random.rand(rows, columns)

print(arr)
print(type(arr))
arr = arr.tolist()
print(arr)

arr_OUT = [arr[i] if i < rows else False for i in range(4)]
arr0_OUT, arr1_OUT, arr2_OUT, arr3_OUT = arr_OUT
# ---------- end numpy ----------
panel_7 = Panel(numpy.a)  # disabled
number = Number(numpy.arr0_OUT)  # disabled
# 003 Python Tips
# USING LAMBDA AND MAP
# FUNCTIONS
# mark = map(lambda s: (True, s) if 'anonymous' in s else (False, s), txt)
# gpt-4 Text Prompt
# Create a geometric 3D model with
# 
# Container Data Structures with
# Lambdas and Map Functions
# use this in the script:
# mark = map(lambda s: (True, s) if 'anonymous' in s else (False, s), txt)
# 
# 
# in python 3 code for the python 3 script
# node in grasshopper for Rhino8WIP using the
# 
# Rhino Common API to create some geometry as well.
# 
# Output the parts of the model in different
# variable outputs in the python 3 node in
# grasshopper.
panel_8 = Panel(number)  # disabled
number_2 = Number(numpy.arr1_OUT)  # disabled
panel_9 = Panel(number_2)  # disabled
number_3 = Number(numpy.arr2_OUT)  # disabled
panel_10 = Panel(number_3)  # disabled
number_4 = Number(numpy.arr3_OUT)  # disabled
number_slider_3 = Slider(10, range=0..100)  # disabled
panel_11 = Panel(number_4)  # disabled
multiplication_3 = Multiplication(A=number, B=number_slider_3)  # disabled
multiplication_4 = Multiplication(A=number_2, B=number_slider_3)  # disabled
construct_point = ConstructPoint(XCoordinate=multiplication_3, YCoordinate=graft(multiplication_3), ZCoordinate=0)  # disabled
construct_point_2 = ConstructPoint(XCoordinate=multiplication_3, YCoordinate=graft(multiplication_3), ZCoordinate=multiplication_4)  # disabled
unit_x = UnitX(Factor=number_3)  # disabled
line = Line(StartPoint=construct_point, EndPoint=construct_point_2)  # disabled
move = Move(Geometry=line, Motion=unit_x)  # -> Geometry, Transform; disabled
list_item = ListItem(List=graft(line), Index=0, Wrap=True)  # disabled
list_item_2 = ListItem(List=graft(move.Geometry), Index=0, Wrap=True)  # disabled
unit_y = UnitY(Factor=number_4)  # -> graft(UnitVector); disabled
loft = Loft(
    Curves=[list_item, list_item_2],
    Options={Adjust=False, Closed=False, LoftEnds=0, LoftSimp=0, LoftType=0, Rebuild=10, Refit=0.01})  # disabled
extrude = Extrude(Base=loft, Direction=unit_y)  # disabled

panel_12 = Panel("""anonymous1
Michael
random text
another anonymous
Wickerson 
just text
anonymous again
another anonymous
Wickerson 
just text
anonymous again
random text
another anonymous
Wickerson 
just text
anonymous again""")  # disabled
panel_13 = Panel("""anonymous1
Michael
random text
another anonymous
Wickerson 
just text
anonymous again""")  # disabled
# gpt-4 Initial Response
# Sure! Let's create a simple geometric 3D model using Grasshopper
# for Rhino8WIP (based on your description). We'll do this step-by-step:
# 
# Input Data: For simplicity, let's assume txt contains some strings, and
# we are interested in marking the ones containing the word "anonymous".
# 
# Processing: We'll process these strings using the provided lambda function.
# 
# Output: For each string that contains "anonymous", we'll create a 3D point in Rhino.
# If the string is marked as True, the point will be at a certain height (let's say, height 10).
# Otherwise, it will be at the base level (height 0).
# 2nd gpt-4 Text Prompt
# Great, now make the script much more complex model
# with complex trigonometric polynomials and the
# NUMPY python library. Be sure to incorporate the previous code logic.
# ensure that this script produces 3d geometry as
# well for Data visualization purposes.
# gpt-4 2nd Response
# Certainly! Let's elaborate on the previous idea by introducing a complex trigonometric polynomial to modify the geometry:
# 
# Complex Trigonometric Polynomial:
# A trigonometric polynomial is a sum of sines and cosines. For this example, let's use:
# 
# f(t)=sin(t)+cos(2t)+sin(3t)
# 
# Using NumPy will help us in evaluating these efficiently for a range of values.
# 
# Geometry Modulation:
# We'll utilize the trigonometric function to:
# 
# Alter the x-coordinates of our points.
# Vary the height of our points (not just 0 and 10 but in a continuous manner).
panel_14 = Panel("""anonymous1
Michael
random text
another anonymous
Wickerson 
just text
anonymous again""")  # disabled
lambdas_and_map = Script(txt=panel_3, A=multiplication, B=multiplication_2, rev=Slider(67, range=0..360))  # -> out, a, b, d; inputs txt: list of String, A: Double, B: Double, rev: Int32
# ---------- lambdas_and_map: Python ----------
import Rhino.Geometry as rg
import numpy as np

# Sample txt data
#txt = ["anonymous1", "random text", "another anonymous", "just text", "anonymous again"]

# Mark strings with the lambda function
marked = list(map(lambda s: (True, s) if 'anonymous' in s else (False, s), txt))

# Trigonometric polynomial
def trig_poly(t):
    return np.exp(1j * t) + A * np.exp(2j * t) + B * np.exp(3j * t)

# Generate points influenced by complex trig functions
def generate_spiral_points(step, revolutions):
    points = []
    colors = []
    
    for r in np.linspace(0, revolutions * 2 * np.pi, int(revolutions * rev)):
        complex_val = trig_poly(r)
        
        flag, _ = marked[int(r) % len(marked)]
        mod_amplitude = 5 if flag else 1
        z_modulation = 2 if flag else 0.5
        
        x = mod_amplitude * np.abs(complex_val) * np.cos(np.angle(complex_val))
        y = mod_amplitude * np.abs(complex_val) * np.sin(np.angle(complex_val))
        z = r * z_modulation
        
        points.append(rg.Point3d(x, y, z))
        
        if flag:
            colors.append((255, 0, 0))
        else:
            colors.append((0, 255, 0))
            
    return points, colors

points, colors = generate_spiral_points(np.pi / 50, 10)
curve = rg.Curve.CreateInterpolatedCurve(points, 3)

# Outputs
a = points
b = curve
d = colors
# ---------- end lambdas_and_map ----------
lambdas_and_map_2 = Script(txt=panel_4)  # -> out, a, b; inputs txt: list of String; disabled
# ---------- lambdas_and_map_2: Python ----------
import Rhino.Geometry as rg
import numpy as np

# Sample txt data
#txt = ["anonymous1", "random text", "another anonymous", "just text", "anonymous again"]

# Mark strings with the lambda function
marked = list(map(lambda s: (True, s) if 'anonymous' in s else (False, s), txt))

def complex_trig_polynomial(t):
    # Complex trigonometric polynomial
    return np.exp(1j*t) + 0.5*np.exp(2j*t) + 0.25*np.exp(3j*t)

def modulated_complex_trig(t, flag):
    amplitude = 15 if flag else 5
    complex_val = complex_trig_polynomial(t)
    return amplitude * complex_val.real, amplitude * complex_val.imag

# Generate grid of points influenced by complex trig functions
def generate_grid_points(grid_size, step):
    points = []
    for i in range(grid_size):
        for j in range(grid_size):
            t = i * j * step
            flag_index = (i * grid_size + j) % len(marked)
            flag, _ = marked[flag_index]
            mod_x, mod_y = modulated_complex_trig(t, flag)
            z_val = 10 * np.sin(t) if flag else 0  # Modulate height based on trig function and flag
            point = rg.Point3d(i + mod_x, j + mod_y, z_val)
            points.append(point)
    # Sort points by x, then by y, then by z
    sorted_points = sorted(points, key=lambda pt: (pt.X, pt.Y, pt.Z))
    return sorted_points

def create_mesh_from_points(points, grid_size):
    mesh = rg.Mesh()
    for pt in points:
        mesh.Vertices.Add(pt)
    
    for i in range(grid_size - 1):
        for j in range(grid_size - 1):
            mesh.Faces.AddFace(i + j*grid_size, (i+1) + j*grid_size, (i+1) + (j+1)*grid_size, i + (j+1)*grid_size)
    
    return mesh

grid_size = 10
step = np.pi / 20
points = generate_grid_points(grid_size, step)
mesh = create_mesh_from_points(points, grid_size)

# Outputs
a = points  # List of 3D points displaced in a grid based on complex trig functions
b = mesh  # Mesh derived from the points to visualize a complex surface
# ---------- end lambdas_and_map_2 ----------
lambdas_and_map_3 = Script(txt=panel_6)  # -> out, a, b; inputs txt: list of String; disabled
# ---------- lambdas_and_map_3: Python ----------
import Rhino.Geometry as rg
import numpy as np

# Sample txt data
#txt = ["anonymous1", "random text", "another anonymous", "just text", "anonymous again"]

# Mark strings with the lambda function
marked = list(map(lambda s: (True, s) if 'anonymous' in s else (False, s), txt))

def complex_trig_polynomial(t):
    # Complex trigonometric polynomial
    return np.exp(1j*t) + 0.5*np.exp(2j*t) + 0.25*np.exp(3j*t)

def modulated_complex_trig(t, flag):
    amplitude = 15 if flag else 5
    complex_val = complex_trig_polynomial(t)
    return amplitude * complex_val.real, amplitude * complex_val.imag

# Generate grid of points influenced by complex trig functions
def generate_grid_points(grid_size, step):
    points = []
    for i in range(grid_size):
        for j in range(grid_size):
            t = i * j * step
            flag_index = (i * grid_size + j) % len(marked)
            flag, _ = marked[flag_index]
            mod_x, mod_y = modulated_complex_trig(t, flag)
            z_val = 10 * np.sin(t) if flag else 0  # Modulate height based on trig function and flag
            point = rg.Point3d(i + mod_x, j + mod_y, z_val)
            points.append(point)
    # Sort points by x, then by y, then by z
    sorted_points = sorted(points, key=lambda pt: (pt.X, pt.Y, pt.Z))
    return sorted_points

def create_nurbs_surface_from_points(points, grid_size):
    # Create curves from sorted points
    curves = []
    for i in range(grid_size):
        curve_points = points[i::grid_size]
        curve = rg.Curve.CreateInterpolatedCurve(curve_points, 3)  # 3 is the degree of the curve
        curves.append(curve)
    
    # Loft through curves to generate a NURBS surface
    loft_type = rg.LoftType.Normal
    loft_rebuild = 0
    nurbs_surfaces = rg.Brep.CreateFromLoft(curves, rg.Point3d.Unset, rg.Point3d.Unset, loft_type, False)
    
    if len(nurbs_surfaces) == 0:
        return None
    return nurbs_surfaces[0]  # Assuming a single continuous surface is produced

grid_size = 10
step = np.pi / 20
points = generate_grid_points(grid_size, step)
nurbs_surface = create_nurbs_surface_from_points(points, grid_size)

# Outputs
a = points  # List of 3D points displaced in a grid based on complex trig functions
b = nurbs_surface  # NURBS surface created from the sorted points
# ---------- end lambdas_and_map_3 ----------
lambdas_and_map_4 = Script(txt=panel_5)  # -> out, a; inputs txt: list of String; disabled
# ---------- lambdas_and_map_4: Python ----------
import Rhino.Geometry as rg
import numpy as np

# Sample txt data
#txt = ["anonymous1", "random text", "another anonymous", "just text", "anonymous again"]

# Mark strings with the lambda function
marked = list(map(lambda s: (True, s) if 'anonymous' in s else (False, s), txt))

def complex_trig(t):
    # Euler's formula: e^(ix) = cos(x) + i*sin(x)
    complex_val = np.exp(1j * t)
    return complex_val.real, complex_val.imag

# Complex trigonometric modulation with amplitude control based on flag
def modulated_complex_trig(t, flag):
    amplitude = 15 if flag else 5
    real, imag = complex_trig(t)
    return amplitude * real, amplitude * imag

# Generate grid of points influenced by complex trig functions
def generate_grid_points(grid_size, step):
    points = []
    for i in range(grid_size):
        for j in range(grid_size):
            t = i * j * step
            flag = (i + j) % 2 == 0
            mod_x, mod_y = modulated_complex_trig(t, flag)
            z_val = 10 * np.sin(t) if flag else 0  # Modulate height based on trig function and flag
            point = rg.Point3d(i + mod_x, j + mod_y, z_val)
            points.append(point)
    return points

grid_size = 10
step = np.pi / 20
points = generate_grid_points(grid_size, step)

# Outputs
a = points  # List of 3D points displaced in a grid based on complex trig functions
# ---------- end lambdas_and_map_4 ----------
lambdas_and_map_5 = Script(txt=panel_13)  # -> out, a, b; inputs txt: list of String; disabled
# ---------- lambdas_and_map_5: Python ----------
import Rhino.Geometry as rg
import numpy as np

# Sample txt data
txt = ["anonymous1", "random text", "another anonymous", "just text", "anonymous again"]

# Mark strings with the lambda function
marked = list(map(lambda s: (True, s) if 'anonymous' in s else (False, s), txt))

def trig_polynomial(t):
    return np.sin(t) + np.cos(2*t) + np.sin(3*t)

# Convert marked data to geometry
points = []
curves = []  # For added complexity
for index, (flag, text) in enumerate(marked):
    t = index * np.pi / 2  # Ensuring we get a good range of our trig function
    mod_x = 5 * trig_polynomial(t)  # Modulate the x-coordinate
    height = 10 * trig_polynomial(t) if flag else 0  # Modulate height based on trig function and flag
    point = rg.Point3d(index*5 + mod_x, 0, height)
    points.append(point)
    
    # For added complexity: Connect each point to the next with a curve
    if index > 0:
        curve = rg.Line(points[index-1], point).ToNurbsCurve()
        curves.append(curve)

# Outputs
a = points  # List of 3D points
b = curves  # List of curves connecting the points
# ---------- end lambdas_and_map_5 ----------
lambdas_and_map_6 = Script(txt=panel_12)  # -> out, a, b, c; inputs txt: list of String; disabled
# ---------- lambdas_and_map_6: Python ----------
import Rhino.Geometry as rg
import numpy as np

# Sample txt data
#txt = ["anonymous1", "random text", "another anonymous", "just text", "anonymous again"]

# Mark strings with the lambda function
marked = list(map(lambda s: (True, s) if 'anonymous' in s else (False, s), txt))

def trig_polynomial(t):
    return np.sin(t) + np.cos(2*t) + np.sin(3*t)

# Complex trigonometric modulation
def complex_modulation(t, flag):
    amplitude = 5
    if flag:
        return (amplitude * np.sin(t), amplitude * np.cos(2*t))
    else:
        return (amplitude * np.cos(t), amplitude * np.sin(2*t))

# Convert marked data to geometry
points = []
curves = []
surfaces = []

for index, (flag, text) in enumerate(marked):
    t = index * np.pi / 2  # Ensuring we get a good range of our trig function
    
    mod_x, mod_y = complex_modulation(t, flag)
    height = 10 * trig_polynomial(t) if flag else 0  # Modulate height based on trig function and flag
    point = rg.Point3d(index*5 + mod_x, mod_y, height)
    points.append(point)
    
    # For added complexity: Connect each point to the next with a curve
    if index > 0:
        curve = rg.Line(points[index-1], point).ToNurbsCurve()
        curves.append(curve)

        # Create a surface between two successive curves
        if len(curves) > 1:
            lofted_surfaces = rg.Brep.CreateFromLoft([curves[-2], curves[-1]], rg.Point3d.Unset, rg.Point3d.Unset, rg.LoftType.Normal, False)
            if lofted_surfaces:
                surfaces.extend(lofted_surfaces)

# Outputs
a = points  # List of 3D points
b = curves  # List of curves connecting the points
c = surfaces  # Lofted surfaces between curves
# ---------- end lambdas_and_map_6 ----------
lambdas_and_map_7 = Script(txt=panel_14)  # -> out, a; inputs txt: list of String; disabled
# ---------- lambdas_and_map_7: Python ----------
import Rhino.Geometry as rg

# Sample txt data
#txt = ["anonymous1", "Michael", "random text", "another anonymous", "Wickerson", "just text", "anonymous again"]

# Mark strings with the lambda function
marked = list(map(lambda s: (True, s) if 'anonymous' in s else (False, s), txt))

# Convert marked data to geometry
points = []
for index, (flag, text) in enumerate(marked):
    height = 10 if flag else 0
    point = rg.Point3d(index*5, 0, height)  # Spacing the points out by 5 units
    points.append(point)

# Outputs
a = points  # List of 3D points
# ---------- end lambdas_and_map_7 ----------
point = Point(lambdas_and_map_2.a)  # disabled
geometry = Geometry(lambdas_and_map_2.b)  # disabled
curve = Curve(lambdas_and_map.b)
point_2 = Point(lambdas_and_map_3.a)  # disabled
point_3 = Point(lambdas_and_map.a)
geometry_2 = Geometry(lambdas_and_map_3.b)  # disabled
point_4 = Point(lambdas_and_map_4.a)  # disabled
sphere = Sphere(Base=lambdas_and_map_5.a, Radius=1)  # disabled
sphere_2 = Sphere(Base=lambdas_and_map_6.a, Radius=1)  # disabled
sphere_3 = Sphere(Base=lambdas_and_map_7.a, Radius=1)  # disabled
point_5 = Point(lambdas_and_map_5.a)  # disabled
panel_15 = Panel(lambdas_and_map.out)
point_6 = Point(lambdas_and_map_7.a)  # disabled
point_7 = Point(lambdas_and_map_6.a)  # disabled
panel_16 = Panel(lambdas_and_map_2.out)  # disabled
geometry_3 = Geometry(lambdas_and_map_6.c)  # disabled
panel_17 = Panel(lambdas_and_map_4.out)  # disabled
panel_18 = Panel(lambdas_and_map_3.out)  # disabled
panel_19 = Panel(lambdas_and_map_5.out)  # disabled
panel_20 = Panel(lambdas_and_map_7.out)  # disabled
panel_21 = Panel(lambdas_and_map_6.out)  # disabled
panel_22 = Panel(lambdas_and_map.d)
entwine = Entwine(Branch00=point, Branch01=geometry, FlattenInputs=True)  # disabled
entwine_2 = Entwine(Branch00=point_3, Branch01=curve, Branch02=lambdas_and_map.d, FlattenInputs=True)
entwine_3 = Entwine(Branch00=point_2, Branch01=geometry_2, FlattenInputs=True)  # disabled
entwine_4 = Entwine(Branch00=point_4, FlattenInputs=True)  # disabled
entwine_5 = Entwine(Branch00=point_5, Branch01=sphere, Branch02=lambdas_and_map_5.b, FlattenInputs=True)  # disabled
entwine_6 = Entwine(Branch00=point_7, Branch01=sphere_2, Branch02=lambdas_and_map_6.b, Branch03=geometry_3, FlattenInputs=True)  # disabled
entwine_7 = Entwine(Branch00=point_6, Branch01=sphere_3, FlattenInputs=True)  # disabled
panel_23 = Panel(entwine)  # disabled
panel_24 = Panel(entwine_2)
panel_25 = Panel(entwine_4)  # disabled
panel_26 = Panel(entwine_3)  # disabled
panel_27 = Panel(entwine_5)  # disabled
panel_28 = Panel(entwine_7)  # disabled
panel_29 = Panel(entwine_6)  # disabled

# ==== cluster Oscillation
list = ClusterInput()
list_length = ListLength(List=list)
B = ClusterInput()
division = Division(A=list_length, B=B)
cosine = Cosine(Value=division)
sine = Sine(Value=division)
result = ClusterOutput(cosine)
result_2 = ClusterOutput(sine)
